# Dynamo graph Watch Image.dyn (Dynamo 1.1.0.2093)

code_block = CodeBlock { 0..19..1; }
byCoordinates = Point.ByCoordinates(x=code_block, y=code_block, lacing=CrossProduct)
file_path = Filename("C:\Users\Ronnie Parsons\Desktop\Dynamo Example Files\_REFERENCE\samplebitmap.jpg")
fromPath = FileObject(file_path)  # "File.FromPath"
readFromFile = Image.ReadFromFile(fromPath)
watch_image = WatchImageCore(readFromFile)
code_block_2 = CodeBlock { 20; }
pixels = Image.Pixels(image=watch_image, xSamples=code_block_2, ySamples=code_block_2)
watch = Watch(pixels)
red = Color.Red(watch)
code_block_3 = CodeBlock { 500; }
div = red / code_block_3
byCenterPointRadius = Circle.ByCenterPointRadius(centerPoint=byCoordinates, radius=div)
