# Dynamo graph ExportToSAT (geometry, filePath).dyn (Dynamo 1.1.0.2093)

byCenterPointRadius = Circle.ByCenterPointRadius()
extrudeAsSolid = Curve.ExtrudeAsSolid(byCenterPointRadius)
file_path = Filename("..\..\..\..\_REFERENCE\exportsample.sat")
exportToSAT = ExportWithUnits(extrudeAsSolid, file_path, exportedUnit=Millimeters)
