# Dynamo graph ByLoft_gc.dyn (Dynamo 1.0.0.1180)

code_block = CodeBlock { Point.ByCoordinates(0, 10, 0); Point.ByCoordinates(10, 10, 0); }
byStartPointEndPoint = Line.ByStartPointEndPoint(startPoint=code_block.out0, endPoint=code_block.out1)
code_block_2 = CodeBlock { Point.ByCoordinates(0, 0, 0); Point.ByCoordinates(10, 0, 0); }
byStartPointEndPoint_2 = Line.ByStartPointEndPoint(startPoint=code_block_2.out0, endPoint=code_block_2.out1)
create = List.Create(byStartPointEndPoint, byStartPointEndPoint_2)
code_block_3 = CodeBlock { 0..10..1; }
number_slider = DoubleSlider(2.9, range=0..100 step 0.1)
code_block_4 = CodeBlock { 0..360..36; }
code_block_5 = CodeBlock(a=number_slider, x=code_block_4) { a*Math.Sin(x); }
byCoordinates = Point.ByCoordinates(y=code_block_3, z=code_block_5)
byPoints = NurbsCurve.ByPoints(byCoordinates)
byLoft = Surface.ByLoft(create, byPoints)
