# Dynamo graph ByLoft_gcs.dyn (Dynamo 1.0.0.1180)

code_block = CodeBlock { Point.ByCoordinates(0, 10, 0); Point.ByCoordinates(10, 10, 0); }
byStartPointEndPoint = Line.ByStartPointEndPoint(startPoint=code_block.out0, endPoint=code_block.out1)
code_block_2 = CodeBlock { Point.ByCoordinates(0, 0, 0); Point.ByCoordinates(10, 0, 0); }
byStartPointEndPoint_2 = Line.ByStartPointEndPoint(startPoint=code_block_2.out0, endPoint=code_block_2.out1)
create = List.Create(byStartPointEndPoint, byStartPointEndPoint_2)
number_slider = DoubleSlider(5.9, range=0..10 step 0.1)
code_block_3 = CodeBlock(a=number_slider) { Point.ByCoordinates(a, 0, 0); Point.ByCoordinates(a, 10, 0); }
byStartPointEndPoint_3 = Line.ByStartPointEndPoint(startPoint=code_block_3.out0, endPoint=code_block_3.out1)
code_block_4 = CodeBlock { 0..10..1; }
number_slider_2 = DoubleSlider(2.9, range=0..100 step 0.1)
code_block_5 = CodeBlock { 0..360..36; }
code_block_6 = CodeBlock(a=number_slider_2, x=code_block_5) { a*Math.Sin(x); }
byCoordinates = Point.ByCoordinates(y=code_block_4, z=code_block_6)
byPoints = NurbsCurve.ByPoints(byCoordinates)
create_2 = List.Create(byStartPointEndPoint_3, byPoints)
byLoft = Surface.ByLoft(create, create_2)
