# Dynamo graph NormalizeDepth.dyn (Dynamo 1.1.0.2093)

code_block = CodeBlock { 0..12..#6; }
create = List.Create(code_block, code_block)
create_2 = List.Create(code_block, create)
watch = Watch(create_2)
normalizeDepth = NormalizeDepth(watch)
watch_2 = Watch(normalizeDepth)
