# Dynamo graph SortIndexByValue (list).dyn (Dynamo 1.1.0.2093)

code_block = CodeBlock { 10; }
randomList = Math.RandomList(code_block)
code_block_2 = CodeBlock(x=randomList) { x*10; }
watch = Watch(code_block_2)
sortIndexByValue = SortIndexByValue(watch)
watch_2 = Watch(sortIndexByValue)
