# Dynamo graph And.dyn (Dynamo 1.0.0.1180)

boolean = BoolSelector(true)
boolean_2 = BoolSelector(false)
and_ = boolean && boolean_2
watch = Watch(and_)
boolean_3 = BoolSelector(true)
boolean_4 = BoolSelector(true)
and_2 = boolean_3 && boolean_4
watch_2 = Watch(and_2)
boolean_5 = BoolSelector(false)
boolean_6 = BoolSelector(false)
and_3 = boolean_5 && boolean_6
watch_3 = Watch(and_3)
