# Dynamo graph GreaterThanOrEqualTo.dyn (Dynamo 1.0.0.1180)

number_slider = DoubleSlider(54, range=0..100 step 1)
number_slider_2 = DoubleSlider(5, range=0..10 step 1)
ge = number_slider >= number_slider_2
watch = Watch(ge)
