# Dynamo graph Modulo - Ex 2.dyn (Dynamo 1.2.0.2831)

integer_slider = IntegerSlider(9, range=0..20 step 1)
code_block = CodeBlock(a=integer_slider) { 0..a; }
watch = Watch(code_block)
integer_slider_2 = IntegerSlider(4, range=0..20 step 1)
# note: "x" divided by "y", and the remainder is the output
# note: If the remainder is 0, then the number X is divisable by Y
mod = watch % integer_slider_2
watch_2 = Watch(mod)
code_block_2 = CodeBlock(x=watch, y=integer_slider_2) { x+" is not divisable by "+y; }
code_block_3 = CodeBlock { 0; }
gt = _ > code_block_3  # unwired: arg0
replaceByCondition = Replace(watch_2, code_block_2, gt)
watch_3 = Watch(replaceByCondition)
code_block_4 = CodeBlock(x=watch, y=integer_slider_2) { x+" is divisable by "+y; }
code_block_5 = CodeBlock { 0; }
eq = _ == code_block_5  # unwired: arg0
replaceByCondition_2 = Replace(watch_3, code_block_4, eq)
watch_4 = Watch(replaceByCondition_2)
