# Dynamo graph Convert Between Units.dyn (Dynamo 1.1.0.2093)

code_block = CodeBlock { 4; }
convert_between_units = DynamoConvert(code_block, conversionMetric=Length, conversionFrom=Meters, conversionTo=Feet)
watch = Watch(convert_between_units)
