# Dynamo graph ByParametersOnCurveReference (parameters, curve, familyType).dyn (Dynamo 1.3.0.875)

number_slider = DoubleSlider(0.12, range=0..1 step 0.01)
number_slider_2 = DoubleSlider(0.3, range=0..1 step 0.01)
number_slider_3 = DoubleSlider(0.39, range=0..1 step 0.01)
number_slider_4 = DoubleSlider(0.57, range=0..1 step 0.01)
code_block = CodeBlock(a=number_slider, b=number_slider_2, c=number_slider_3, d=number_slider_4) { {a,b,c,d}; }
code_block_2 = CodeBlock { {0,10,20,30}; {0,10,0,10}; }
byCoordinates = Point.ByCoordinates(x=code_block_2.out0, z=code_block_2.out1)
byControlPoints = NurbsCurve.ByControlPoints(byCoordinates)
code_block_3 = CodeBlock { {0,10,10}; {-10,-10,0}; }
translate = Geometry.Translate(geometry=byControlPoints, yTranslation=code_block_3.out0, zTranslation=code_block_3.out1)
code_block_4 = CodeBlock(a=byControlPoints, b=translate) { Flatten({a,b}); }
byCurve = ModelCurve.ByCurve(code_block_4)
elementCurveReference = CurveElement.ElementCurveReference(byCurve)
family_types = FamilyTypes("adaptive component - line:adaptive component - line")
byParametersOnCurveReference = AdaptiveComponent.ByParametersOnCurveReference(code_block, elementCurveReference, family_types)
