# Dynamo graph ByCurvesAndDivisions (curve, divisions).dyn (Dynamo 1.3.0.875)

code_block = CodeBlock { {0,10,20,30}; {0,10,0,10}; }
byCoordinates = Point.ByCoordinates(x=code_block.out0, y=code_block.out1)
byControlPoints = NurbsCurve.ByControlPoints(byCoordinates)
code_block_2 = CodeBlock { 30; 10; }
translate = Geometry.Translate(geometry=byControlPoints, xTranslation=code_block_2.out0, yTranslation=code_block_2.out1)
create = List.Create(byControlPoints, translate)
referenceCurveByCurve = ModelCurve.ReferenceCurveByCurve(create)
integer_slider = IntegerSlider(7, range=0..10 step 1)
byCurvesAndDivisions = DividedPath.ByCurvesAndDivisions(referenceCurveByCurve, integer_slider)
