# Dynamo graph GetByName.dyn (Dynamo 1.3.0.875)

code_block = CodeBlock { "600 x 1200mm"; }
code_block_2 = CodeBlock { "Model"; }
getByName = FillPatternElement.GetByName(name=code_block, fillPatternTarget=code_block_2)
