# Dynamo graph If.dyn (Dynamo 1.0.0.1180)

integer_slider = IntegerSlider(25, range=0..100 step 1)
randomList = Math.RandomList(integer_slider)
code_block = CodeBlock(x=randomList) { Math.Floor(x*100); }
integer_slider_2 = IntegerSlider(3, range=0..10 step 1)
code_block_2 = CodeBlock(x=code_block, a=integer_slider_2) { x%a==0; }
byCenterPointRadius = Sphere.ByCenterPointRadius()
byLengths = Cuboid.ByLengths()
if_ = If(test=code_block_2, true=byCenterPointRadius, false=byLengths)
code_block_3 = CodeBlock { 2; }
sequence = Sequence(amount=integer_slider, step=code_block_3, lacing=Longest)
translate = Geometry.Translate(geometry=if_, xTranslation=sequence)
