# Dynamo graph Python Script From String.dyn (Dynamo 1.1.0.2093)

file_path = Filename("..\..\..\..\_REFERENCE\pythonsample.txt")
readText = File.ReadText(file_path)
byCorners = Cuboid.ByCorners()
origin = Point.Origin()
code_block = CodeBlock { Vector.ByCoordinates(1,0.5,0.5); }
code_block_2 = CodeBlock { 10; }
rotate = Geometry.Rotate(geometry=byCorners, origin=origin, axis=code_block, degrees=code_block_2)
code_block_3 = CodeBlock { 3; }
code_block_4 = CodeBlock { 10; }
python_script_from_string = PythonStringNode(script=readText, IN[0]=rotate, IN[1]=code_block_3, IN[2]=code_block_4, IN[3]=code_block_4)
