# Dynamo graph Points.dyn (Dynamo 1.3.1.1736)

file_path = Filename("..\..\..\..\..\..\..\..\..\..\..\Desktop\September 21st 9AM.sdf")
parse = Analyze.Daylighting.DaylightingResults.Parse(file_path)
points = Analyze.Daylighting.DaylightingResults.Points(parse)
