# Dynamo graph G.dyn (Dynamo 1.3.1.1736)

code_block = CodeBlock { 56; 231; 12; }
byRGB = Analyze.Daylighting.Illuminance.ByRGB(code_block.out0, code_block.out1, code_block.out2)
G = Analyze.Daylighting.Illuminance.G(byRGB)
