# Dynamo graph Upload Cloud Render Data.dyn (Dynamo 1.3.1.1736)

code_block = CodeBlock { "{3D}"; }
export_cloud_render_data = ExportDocumentRenderData(code_block)
upload_cloud_render_data = UploadRenderData(export_cloud_render_data)
