# Dynamo graph ByTypeConstants.dyn (Dynamo 1.3.1.1736)

select_skymodeltype = SkyModelTypeDropDown("Perez")
code_block = CodeBlock { {51,82}; {360,522}; {259,329}; }
byTypeConstants = Analyze.Render.SkyModel.ByTypeConstants(select_skymodeltype, code_block.out0, code_block.out1, code_block.out2)
