# Dynamo graph AllTrue.dyn (Dynamo 1.2.0.2690)

boolean = BoolSelector(true)
boolean_2 = BoolSelector(false)
create = List.Create(boolean, boolean_2)
watch = Watch(create)
allTrue = AllTrue(watch)
watch_2 = Watch(allTrue)
create_2 = List.Create(boolean, boolean)
watch_3 = Watch(create_2)
allTrue_2 = AllTrue(watch_3)
watch_4 = Watch(allTrue_2)
create_3 = List.Create(create, create_2)
watch_5 = Watch(create_3)
allTrue_3 = AllTrue(watch_5)
watch_6 = Watch(allTrue_3)
allTrue_4 = AllTrue(watch_5@L2)
watch_7 = Watch(allTrue_4)
