# Dynamo graph Equals.dyn (Dynamo 1.1.0.2093)

eq = _ == _
number_slider = DoubleSlider(2, range=0..5 step 1)
byCenterPointRadius = Circle.ByCenterPointRadius(radius=number_slider)
radius = Circle.Radius(byCenterPointRadius)
number_slider_2 = DoubleSlider(1, range=0..5 step 1)
byCenterPointRadius_2 = Circle.ByCenterPointRadius(radius=number_slider_2)
radius_2 = Circle.Radius(byCenterPointRadius_2)
equals = Equals(radius, radius_2)
watch = Watch(equals)
