# Dynamo graph Flatten.dyn (Dynamo 1.1.0.2093)

code_block = CodeBlock { 0..19..#11; }
byCoordinates = Point.ByCoordinates(x=code_block, y=code_block, lacing=CrossProduct)
flatten = Flatten(byCoordinates)
index = IntegerSlider(39, range=0..120 step 1)
getItemAtIndex = List.GetItemAtIndex(list=flatten, index=index)
watch = Watch(getItemAtIndex)
byCenterPointRadius = Sphere.ByCenterPointRadius(centerPoint=watch)
code_block_2 = CodeBlock { 25..44..#11; 0..19..#11; }
byCoordinates_2 = Point.ByCoordinates(x=code_block_2.out0, y=code_block_2.out1, lacing=CrossProduct)
index_2 = IntegerSlider(3, range=0..10 step 1)
getItemAtIndex_2 = List.GetItemAtIndex(list=byCoordinates_2, index=index_2)
watch_2 = Watch(getItemAtIndex_2)
byCenterPointRadius_2 = Sphere.ByCenterPointRadius(centerPoint=watch_2)
