# Dynamo graph GroupByFunction.dyn (Dynamo 1.1.0.2093)

code_block = CodeBlock { 0..9..#10; }
number = DoubleInput(3)
chop = List.Chop(list=code_block, lengths=number)
getItemAtIndex = List.GetItemAtIndex()
groupByFunction = GroupByFunction(chop, getItemAtIndex)
watch = Watch(groupByFunction)
watch_2 = Watch(chop)
watch_3 = Watch(code_block)
getItemAtIndex_2 = List.GetItemAtIndex()
groupByFunction_2 = GroupByFunction(watch_3, getItemAtIndex_2)
watch_4 = Watch(groupByFunction_2)
