# Dynamo graph ImportFromCSV (filePath).dyn (Dynamo 1.1.0.2093)

code_block = CodeBlock { 0..4..1; 0..2..1; }
byCoordinates = Point.ByCoordinates(x=code_block.out0, y=code_block.out1, lacing=CrossProduct)
ZAxis = Vector.ZAxis()
file_path = Filename("..\..\..\_REFERENCE\sample.csv")
importFromCSV = ImportFromCSV(file_path)
watch = Watch(importFromCSV)
code_block_2 = CodeBlock { 4; }
div = watch / code_block_2
translate = Geometry.Translate(geometry=byCoordinates, direction=ZAxis, distance=div)
