# Dynamo graph ImportFromCSV (filePath, transpose).dyn (Dynamo 1.1.0.2093)

code_block = CodeBlock { 0..4..1; }
byCoordinates = Point.ByCoordinates(x=code_block, y=code_block, lacing=CrossProduct)
ZAxis = Vector.ZAxis()
file_path = Filename("..\..\..\_REFERENCE\sample-transpose.csv")
boolean = BoolSelector(false)
importFromCSV = ImportFromCSV(file_path, boolean)
watch = Watch(importFromCSV)
code_block_2 = CodeBlock { 4; }
div = watch / code_block_2
translate = Geometry.Translate(geometry=byCoordinates, direction=ZAxis, distance=div)
