# Dynamo graph IndexOf.dyn (Dynamo 1.1.0.2093)

code_block = CodeBlock { 0..19..#11; }
watch = Watch(code_block)
code_block_2 = CodeBlock { 3.8; }
indexOf = IndexOf(watch, code_block_2)
watch_2 = Watch(indexOf)
