# Dynamo graph Insert (list, element, index).dyn (Dynamo 1.1.0.2093)

code_block = CodeBlock { 0..12..#6; }
watch = Watch(code_block)
code_block_2 = CodeBlock { "Hello"; "List!"; }
create = List.Create(code_block_2.out0, code_block_2.out1)
code_block_3 = CodeBlock { 2; }
insert = Insert(code_block, create, code_block_3)
watch_2 = Watch(insert)
