# Dynamo graph IsHomogeneous.dyn (Dynamo 1.1.0.2093)

code_block = CodeBlock { 0..12..#6; }
code_block_2 = CodeBlock { "a string"; }
code_block_3 = CodeBlock { 2; }
insert = Insert(code_block, code_block_2, code_block_3)
watch = Watch(insert)
isHomogeneous = IsHomogeneous(watch)
watch_2 = Watch(isHomogeneous)
watch_3 = Watch(code_block)
isHomogeneous_2 = IsHomogeneous(watch_3)
watch_4 = Watch(isHomogeneous_2)
