# Dynamo graph IsRectangular.dyn (Dynamo 1.1.0.2093)

code_block = CodeBlock { 0..9..#10; }
code_block_2 = CodeBlock(x=code_block) { x*2; }
byCoordinates = Point.ByCoordinates(x=code_block_2, y=code_block_2, lacing=CrossProduct)
ZAxis = Vector.ZAxis()
count = Count(byCoordinates)
randomList = Math.RandomList(count)
scale = Vector.Scale(vector=ZAxis, scale_factor=randomList)
translate = Geometry.Translate(geometry=byCoordinates, direction=scale)
byPoints = NurbsSurface.ByPoints(translate)
watch = Watch(translate)
code_block_3 = CodeBlock { Point.ByCoordinates(1,0..20..2,0.142); }
code_block_4 = CodeBlock { 1; }
insert = Insert(watch, code_block_3, code_block_4)
watch_2 = Watch(insert)
byPoints_2 = NurbsSurface.ByPoints(watch_2)
isRectangular = IsRectangular(watch)
isRectangular_2 = IsRectangular(watch_2)
