# Dynamo graph IsUniformDepth.dyn (Dynamo 1.1.0.2093)

code_block = CodeBlock { 0..12..#6; }
create = List.Create(code_block, code_block)
create_2 = List.Create(code_block, create)
watch = Watch(create_2)
isUniformDepth = IsUniformDepth(watch)
watch_2 = Watch(isUniformDepth)
create_3 = List.Create(code_block, code_block, code_block)
watch_3 = Watch(create_3)
isUniformDepth_2 = IsUniformDepth(watch_3)
watch_4 = Watch(isUniformDepth_2)
