# Dynamo graph LoopWhile.dyn (Dynamo 1.1.0.2093)

code_block = CodeBlock { 0; }
code_block_2 = CodeBlock { 1; }
code_block_3 = CodeBlock { 100; }
lt = _ < code_block_3
code_block_4 = CodeBlock { 10; }
add = _ + code_block_4
loopWhile = LoopWhile(code_block_2, lt, add)
watch = Watch(loopWhile)
byCoordinates = Point.ByCoordinates(x=code_block, y=watch)
