# Dynamo graph MaximumItemByKey.dyn (Dynamo 1.1.0.2093)

maximumItemByKey = MaximumItemByKey()
code_block = CodeBlock { Point.ByCoordinates(0,0,0); Point.ByCoordinates(2,0,0); Point.ByCoordinates(5,0,0); }
code_block_2 = CodeBlock { 0.5; 1; 1.5; }
byCenterPointRadius = Circle.ByCenterPointRadius(centerPoint=code_block.out0, radius=code_block_2.out0)
byCenterPointRadius_2 = Circle.ByCenterPointRadius(centerPoint=code_block.out1, radius=code_block_2.out1)
byCenterPointRadius_3 = Circle.ByCenterPointRadius(centerPoint=code_block.out2, radius=code_block_2.out2)
create = List.Create(byCenterPointRadius, byCenterPointRadius_2, byCenterPointRadius_3)
radius = Circle.Radius()
maximumItemByKey_2 = MaximumItemByKey(create, radius)
