# Dynamo graph NormalizeDepth (list, rank).dyn (Dynamo 1.1.0.2093)

code_block = CodeBlock { 0..12..#6; }
create = List.Create(code_block, code_block)
create_2 = List.Create(code_block, create)
watch = Watch(create_2)
integer_slider = IntegerSlider(3, range=1..4 step 1)
normalizeDepth = NormalizeDepth(watch, integer_slider)
watch_2 = Watch(normalizeDepth)
