# Dynamo graph RemoveIfNot.dyn (Dynamo 1.1.0.2093)

removeIfNot = RemoveIfNot()
code_block = CodeBlock { p1 = Point.ByCoordinates(0,0,1); p2 = Point.ByCoordinates(2,4,3); l1 = Line.ByStartPointEndPoint(p1,p2); {p1,p2,l1}; }
watch = Watch(code_block.out3)
code_block_2 = CodeBlock { "Line"; }
removeIfNot_2 = RemoveIfNot(watch, code_block_2)
watch_2 = Watch(removeIfNot_2)
