# Dynamo graph RemoveKey.dyn (Dynamo 1.1.0.2093)

map = List.Map()
code_block = CodeBlock { 0..19..1; }
byCoordinates = Point.ByCoordinates(x=code_block, y=code_block, lacing=CrossProduct)
file_path = Filename("C:\Users\Ronnie Parsons\Desktop\Dynamo Example Files\_REFERENCE\samplebitmap.jpg")
fromPath = FileObject(file_path)  # "File.FromPath"
readFromFile = Image.ReadFromFile(fromPath)
watch_image = WatchImageCore(readFromFile)
code_block_2 = CodeBlock { 20; }
pixels = Image.Pixels(image=watch_image, xSamples=code_block_2, ySamples=code_block_2)
watch = Watch(pixels)
red = Color.Red(watch)
code_block_3 = CodeBlock { 500; }
div = red / code_block_3
byCenterPointRadius = Circle.ByCenterPointRadius(centerPoint=byCoordinates, radius=div)
watch_2 = Watch(byCenterPointRadius)
boolean = BoolSelector(false)
clean = List.Clean(list=watch_2, preserveIndices=boolean)
isNull = Object.IsNull(clean)
watch_3 = Watch(isNull)
boolean_2 = BoolSelector(true)
removeKey = RemoveKey(watch_3, boolean_2)
isNull_2 = Object.IsNull(watch_2)
watch_4 = Watch(isNull_2)
boolean_3 = BoolSelector(true)
removeKey_2 = RemoveKey(watch_4, boolean_3)
