# Dynamo graph Reorder.dyn (Dynamo 1.1.0.2093)

code_block = CodeBlock { 0..12..#6; }
watch = Watch(code_block)
code_block_2 = CodeBlock { 1; 5; 4; 2; 0; 3; }
create = List.Create(code_block_2.out0, code_block_2.out1, code_block_2.out2, code_block_2.out3, code_block_2.out4, code_block_2.out5)
reorder = Reorder(watch, create)
watch_2 = Watch(reorder)
