# Dynamo graph SetIntersection.dyn (Dynamo 1.1.0.2093)

code_block = CodeBlock { 0..9..#10; }
watch = Watch(code_block)
code_block_2 = CodeBlock { 0..18..#10; }
watch_2 = Watch(code_block_2)
setIntersection = SetIntersection(watch, watch_2)
watch_3 = Watch(setIntersection)
