# Dynamo graph SortByFunction.dyn (Dynamo 1.1.0.2093)

code_block = CodeBlock { Math.RandomList(20); Math.RandomList(20); }
code_block_2 = CodeBlock(x=code_block.out0, y=code_block.out1) { Point.ByCoordinates(10*x,10*y); }
byControlPoints = NurbsCurve.ByControlPoints(code_block_2)
X = Point.X()
sortByFunction = SortByFunction(code_block_2, X)
code_block_3 = CodeBlock { 10; }
translate = Geometry.Translate(geometry=sortByFunction, xTranslation=code_block_3)
byControlPoints_2 = NurbsCurve.ByControlPoints(translate)
Y = Point.Y()
sortByFunction_2 = SortByFunction(code_block_2, Y)
code_block_4 = CodeBlock { 20; }
translate_2 = Geometry.Translate(geometry=sortByFunction_2, xTranslation=code_block_4)
byControlPoints_3 = NurbsCurve.ByControlPoints(translate_2)
