# Dynamo graph SortIndexByValue (list, ascending).dyn (Dynamo 1.1.0.2093)

code_block = CodeBlock { 10; }
randomList = Math.RandomList(code_block)
code_block_2 = CodeBlock(x=randomList) { x*10; }
watch = Watch(code_block_2)
boolean = BoolSelector(true)
sortIndexByValue = SortIndexByValue(watch, boolean)
watch_2 = Watch(sortIndexByValue)
boolean_2 = BoolSelector(false)
sortIndexByValue_2 = SortIndexByValue(watch, boolean_2)
watch_3 = Watch(sortIndexByValue_2)
