# Dynamo graph TrueForAll.dyn (Dynamo 1.2.0.2831)

code_block = CodeBlock { 0..10; }

# group: Check the list to see if all of the values are greater than 11. Expected result of 'TrueForAll' is false
code_block_2 = CodeBlock { 11; }
gt = _ > code_block_2  # unwired: arg0
trueForAll = TrueForAll(code_block, gt)

# group: Check the list to see if all of the values are less than 11. Expected result of 'TrueForAll' is true
code_block_3 = CodeBlock { 11; }
lt = _ < code_block_3  # unwired: arg0
trueForAll_2 = TrueForAll(code_block, lt)

# group: Check the list to see if all of the values are less than < 5. Expected result of 'TrueForAll' is false
code_block_4 = CodeBlock { 5; }
lt_2 = _ < code_block_4  # unwired: arg0
trueForAll_3 = TrueForAll(code_block, lt_2)
