# Dynamo graph TrueForAny.dyn (Dynamo 1.2.0.2831)

code_block = CodeBlock { 0..10; }

# group: Check the list to see if any of the values are greater than 11. Expected result of 'TrueForAny' is false
code_block_2 = CodeBlock { 11; }
gt = _ > code_block_2  # unwired: arg0
trueForAny = TrueForAny(code_block, gt)

# group: Check the list to see if any of the values are less than < 5. Expected result of 'TrueForAny' is true
code_block_3 = CodeBlock { 5; }
lt = _ < code_block_3  # unwired: arg0
trueForAny_2 = TrueForAny(code_block, lt)
