# Dynamo graph Saturation.dyn (Dynamo 1.1.0.2093)

byLengths = Cuboid.ByLengths()
number_slider = DoubleSlider(51, range=0..255 step 1)
number_slider_2 = DoubleSlider(175, range=0..255 step 1)
byARGB = Color.ByARGB(a=number_slider, r=number_slider_2)
number_slider_3 = DoubleSlider(116, range=0..255 step 1)
number_slider_4 = DoubleSlider(179, range=0..255 step 1)
number_slider_5 = DoubleSlider(108, range=0..255 step 1)
byARGB_2 = Color.ByARGB(a=number_slider_3, g=number_slider_4, b=number_slider_5)
add = Color.Add(byARGB, byARGB_2)
byGeometryColor = Display.Display.ByGeometryColor(byLengths, add)
saturation = Color.Saturation(add)
watch = Watch(saturation)
