# Dynamo graph ByARGB.dyn (Dynamo 1.0.0.1180)

byLengths = Cuboid.ByLengths()
number_slider = DoubleSlider(255, range=0..255 step 1)
number_slider_2 = DoubleSlider(109, range=0..255 step 1)
number_slider_3 = DoubleSlider(203, range=0..255 step 1)
number_slider_4 = DoubleSlider(157, range=0..255 step 1)
byARGB = Color.ByARGB(a=number_slider, r=number_slider_2, g=number_slider_3, b=number_slider_4)
byGeometryColor = Display.Display.ByGeometryColor(byLengths, byARGB)
