# Dynamo graph Color_Range.dyn (Dynamo 1.1.0.2093)

byLengths = Cuboid.ByLengths()
code_block = CodeBlock { 0..20..2; }
translate = Geometry.Translate(geometry=byLengths, xTranslation=code_block)
number_slider = DoubleSlider(255, range=0..255 step 1)
number_slider_2 = DoubleSlider(255, range=0..255 step 1)
byARGB = Color.ByARGB(a=number_slider, r=number_slider_2)
number_slider_3 = DoubleSlider(255, range=0..255 step 1)
number_slider_4 = DoubleSlider(255, range=0..255 step 1)
byARGB_2 = Color.ByARGB(a=number_slider_3, g=number_slider_4)
create = List.Create(byARGB, byARGB_2)
code_block_2 = CodeBlock { {0.69,0.7}; }
code_block_3 = CodeBlock { 0..1..0.1; }
color_range = ColorRange(create, code_block_2, code_block_3)
byGeometryColor = Display.Display.ByGeometryColor(translate, color_range)
