# Dynamo graph Divide.dyn (Dynamo 1.1.0.2093)

byLengths = Cuboid.ByLengths()
number_slider = DoubleSlider(255, range=0..255 step 1)
number_slider_2 = DoubleSlider(255, range=0..255 step 1)
byARGB = Color.ByARGB(a=number_slider, r=number_slider_2)
number_slider_3 = DoubleSlider(2, range=0..10 step 0.1)
divide = Color.Divide(byARGB, number_slider_3)
byGeometryColor = Display.Display.ByGeometryColor(byLengths, divide)
