# Dynamo graph GetColorAtParameter.dyn (Dynamo 1.1.0.2093)

code_block = CodeBlock { 0..20..2; }
byCoordinates = Point.ByCoordinates(x=code_block, y=code_block, lacing=CrossProduct)
byLengths = Cuboid.ByLengths(origin=byCoordinates)
code_block_2 = CodeBlock { c1 = Color.ByARGB(255,0,255,0); c2 = Color.ByARGB(255,255,0,0); c3 = Color.ByARGB(255,0,0,255); {c1,c2,c3}; }
code_block_3 = CodeBlock { uv1 = UV.ByCoordinates(0,0); uv2 = UV.ByCoordinates(0.5,0.7); uv3 = UV.ByCoordinates(1,0); {uv1,uv2,uv3}; }
byColorsAndParameters = ColorRange2D.ByColorsAndParameters(code_block_2.out3, code_block_3.out3)
code_block_4 = CodeBlock { 0..1..0.1; }
byCoordinates_2 = UV.ByCoordinates(code_block_4, code_block_4, lacing=CrossProduct)
getColorAtParameter = ColorRange2D.GetColorAtParameter(byColorsAndParameters, byCoordinates_2)
byGeometryColor = Display.Display.ByGeometryColor(byLengths, getColorAtParameter)
