# Dynamo graph ByDate.dyn (Dynamo 1.1.0.2093)

code_block = CodeBlock { 2006; }
code_block_2 = CodeBlock { 8; }
code_block_3 = CodeBlock { 8; }
byDate = DateTime.ByDate(code_block, code_block_2, code_block_3)
watch = Watch(byDate)
