# Dynamo graph Components.dyn (Dynamo 1.1.0.2093)

now = DateTime.Now()
components = DateTime.Components(now)
watch = Watch(components.out0)
watch_2 = Watch(components.out1)
watch_3 = Watch(components.out2)
watch_4 = Watch(components.out3)
