# Dynamo graph DayOfYear.dyn (Dynamo 1.1.0.2093)

code_block = CodeBlock { 2006; }
code_block_2 = CodeBlock { 8; }
code_block_3 = CodeBlock { 8; }
code_block_4 = CodeBlock { 16; }
code_block_5 = CodeBlock { 24; }
byDateAndTime = DateTime.ByDateAndTime(code_block, code_block_2, code_block_3, code_block_4, code_block_5)
dayOfYear = DateTime.DayOfYear(byDateAndTime)
watch = Watch(dayOfYear)
