# Dynamo graph DaysInMonth.dyn (Dynamo 1.1.0.2093)

code_block = CodeBlock { 2006; }
code_block_2 = CodeBlock { 8; }
daysInMonth = DateTime.DaysInMonth(code_block, code_block_2)
watch = Watch(daysInMonth)
