# Dynamo graph IsDaylightSavingsTime.dyn (Dynamo 1.1.0.2093)

code_block = CodeBlock { "November 14, 2016 12:36 PM"; }
fromString = DateTime.FromString(code_block)
isDaylightSavingsTime = DateTime.IsDaylightSavingsTime(fromString)
watch = Watch(isDaylightSavingsTime)
