# Dynamo graph SubtractTimeSpan.dyn (Dynamo 1.1.0.2093)

now = DateTime.Now()
code_block = CodeBlock { 1; }
code_block_2 = CodeBlock { 8; }
create = TimeSpan.Create(code_block, code_block_2)
subtractTimeSpan = DateTime.SubtractTimeSpan(now, create)
watch = Watch(subtractTimeSpan)
