# Dynamo graph ReadFromFile.dyn (Dynamo 1.1.0.2093)

file_path = Filename("C:\Users\Username\sample.txt")
fromPath = FileObject(file_path)  # "File.FromPath"
readFromFile = CSV.ReadFromFile(fromPath)
watch = Watch(readFromFile)
