# Dynamo graph WriteToFile.dyn (Dynamo 1.1.0.2093)

file_path = Filename("..\..\..\..\..\..\..\..\..\..\..\Username\sample.txt")
code_block = CodeBlock { {{"value1",5},{"value2",10},{"value3",12}}; }
writeToFile = CSV.WriteToFile(file_path, code_block)
