# Dynamo graph Contents.dyn (Dynamo 1.1.0.2093)

directory_path = Directory("C:\Users\Username")
fromPath = DirectoryObject(directory_path)  # "Directory.FromPath"
code_block = CodeBlock { "*.txt"; }
contents = Directory.Contents(fromPath, code_block)
watch = Watch(contents)
