# Dynamo graph Copy.dyn (Dynamo 1.1.0.2093)

directory_path = Directory("C:\Users\Username\Folder1")
fromPath = DirectoryObject(directory_path)  # "Directory.FromPath"
directory_path_2 = Directory("C:\Users\Username\Folder2")
copy = Directory.Copy(fromPath, directory_path_2)
