# Dynamo graph Move.dyn (Dynamo 1.1.0.2093)

directory_path = Directory("C:\Users\Username\Folder1")
code_block = CodeBlock { "C:\Users\Username\Folder2"; }
move = Directory.Move(directory_path, code_block)
