# Dynamo graph Copy.dyn (Dynamo 1.1.0.2093)

file_path = Filename("..\..\..\..\..\..\..\..\..\..\..\Username\sample.txt")
fromPath = FileObject(file_path)  # "File.FromPath"
directory_path = Directory("C:\Users\Username\Folder1")
code_block = CodeBlock { "copy.txt"; }
combine = FilePath.Combine(directory_path, code_block)
copy = File.Copy(fromPath, combine)
