# Dynamo graph Exists.dyn (Dynamo 1.1.0.2093)

file_path = Filename("..\..\..\..\..\..\..\..\..\..\..\Username\sample.txt")
exists = File.Exists(file_path)
watch = Watch(exists)
delete = File.Delete(file_path)
