# Dynamo graph WriteText.dyn (Dynamo 1.1.0.2093)

file_path = Filename("..\..\..\..\..\..\..\..\..\..\..\Username\sample.txt")
code_block = CodeBlock { "\r\n"; }
code_block_2 = CodeBlock { {"1","2","3"}; }
join = String.Join(code_block, code_block_2)
writeText = File.WriteText(file_path, join)
