# Dynamo graph ChangeExtension.dyn (Dynamo 1.1.0.2093)

file_path = Filename("..\..\..\..\..\..\..\..\..\..\..\Username\sample.txt")
code_block = CodeBlock { "exp"; }
changeExtension = FilePath.ChangeExtension(file_path, code_block)
watch = Watch(changeExtension)
