# Dynamo graph Combine.dyn (Dynamo 1.1.0.2093)

file_path = Filename("..\..\..\..\..\..\..\..\..\..\..\Username\Folder1\sample.txt")
directory_path = Directory("C:\Users\Username")
fileName = FilePath.FileName(file_path)
combine = FilePath.Combine(directory_path, fileName)
move = File.Move(file_path, combine)
