# Dynamo graph FileName.dyn (Dynamo 1.1.0.2093)

file_path = Filename("..\..\..\..\..\..\..\..\..\..\..\Username\Folder1\sample.txt")
directoryName = FilePath.DirectoryName(file_path)
watch = Watch(directoryName)
fileName = FilePath.FileName(file_path)
watch_2 = Watch(fileName)
extension = FilePath.Extension(file_path)
watch_3 = Watch(extension)
