# Dynamo graph HasExtension.dyn (Dynamo 1.1.0.2093)

file_path = Filename("..\..\..\..\..\..\..\..\..\..\..\Username\Folder1\sample.txt")
hasExtension = FilePath.HasExtension(file_path)
watch = Watch(hasExtension)
