# Dynamo graph Dimensions.dyn (Dynamo 1.1.0.2093)

file_path = Filename("C:\Users\Username\sample.png")
fromPath = FileObject(file_path)  # "File.FromPath"
readFromFile = Image.ReadFromFile(fromPath)
dimensions = Image.Dimensions(readFromFile)
watch = Watch(dimensions.out0)
watch_2 = Watch(dimensions.out1)
