# Dynamo graph FromPixels_c.dyn (Dynamo 1.1.0.2093)

code_block = CodeBlock { 0..255..1; }
byARGB = Color.ByARGB(r=code_block, g=code_block, lacing=CrossProduct)
fromPixels = Image.FromPixels(byARGB)
watch_image = WatchImageCore(fromPixels)
