# Dynamo graph FromPixels_cwh.dyn (Dynamo 1.1.0.2093)

code_block = CodeBlock { 0..255..1; }
byARGB = Color.ByARGB(r=code_block, g=code_block)
code_block_2 = CodeBlock { 8; }
count = Count(byARGB)
div = count / code_block_2
fromPixels = Image.FromPixels(byARGB, code_block_2, div)
watch_image = WatchImageCore(fromPixels)
