# Dynamo graph Pixels.dyn (Dynamo 1.1.0.2093)

file_path = Filename("C:\Users\Username\sample.png")
fromPath = FileObject(file_path)  # "File.FromPath"
readFromFile = Image.ReadFromFile(fromPath)
code_block = CodeBlock { 100; 100; }
pixels = Image.Pixels(image=readFromFile, xSamples=code_block.out0, ySamples=code_block.out1)
watch = Watch(pixels)
