# Dynamo graph ReadFromFile.dyn (Dynamo 1.1.0.2093)

file_path = Filename("C:\Users\Username\sample.png")
fromPath = FileObject(file_path)  # "File.FromPath"
readFromFile = Image.ReadFromFile(fromPath)
watch_image = WatchImageCore(readFromFile)
