# Dynamo graph WriteToFile.dyn (Dynamo 1.1.0.2093)

file_path = Filename("C:\Users\Username\sample.png")
code_block = CodeBlock { 0..255..1; }
byARGB = Color.ByARGB(r=code_block, g=code_block, lacing=CrossProduct)
fromPixels = Image.FromPixels(byARGB)
writeToFile = Image.WriteToFile(file_path, fromPixels)
