# Dynamo graph Evaluate.dyn (Dynamo 1.1.0.2093)

code_block = CodeBlock { "if(x>y,true,false)"; }
code_block_2 = CodeBlock { {"x","y","true","false"}; }
code_block_3 = CodeBlock { Point.ByCoordinates(0,0); Point.ByCoordinates(4,0); }
create = List.Create(code_block_3.out0, code_block_3.out1)
circle1 = IntegerSlider(3, range=0..4 step 1)
circle2 = IntegerSlider(2, range=0..4 step 1)
create_2 = List.Create(circle1, circle2)
byCenterPointRadius = Circle.ByCenterPointRadius(centerPoint=create, radius=create_2)
radius = Circle.Radius(byCenterPointRadius)
watch = Watch(radius)
evaluate = Formula.Evaluate(code_block, code_block_2, watch)
watch_2 = Watch(evaluate)
