# Dynamo graph CodeBlock.dyn (Dynamo 1.0.1.1167)

code_block = CodeBlock { 10.5; "eureka!"; true; }
number = Watch(code_block.out0)
string = Watch(code_block.out1)
code_block_2 = CodeBlock { 0..6..2; 0..#8..2; 0..10..#5; }
range = Watch(code_block_2.out0)
sequence = Watch(code_block_2.out1)
range_interpolated_step = Watch(code_block_2.out2)
boolean = Watch(code_block.out2)
