# Dynamo graph DateTime.dyn (Dynamo 1.0.0.1180)

date_time = DateTime("March 14, 2015 9:26 PM")
watch = Watch(date_time)
date_time_2 = DateTime("November 05, 1955 12:00 AM")
watch_2 = Watch(date_time_2)
