# Dynamo graph IntegerSlider.dyn (Dynamo 1.0.1.1167)

number_slider = DoubleSlider(6.011, range=0..10 step 0.001)
integer_slider = DoubleSlider(5, range=0..10 step 1)
create_interpolated_range = CodeBlock(x=number_slider, y=integer_slider) { 0..x..#y; }
watch = Watch(create_interpolated_range)
