# Dynamo graph Number.dyn (Dynamo 1.0.0.1180)

number = DoubleInput(3.14)
create_sequence = CodeBlock(x=number) { 0..#8..x; }
watch = Watch(create_sequence)
code_block = CodeBlock { 3.14; }
create_sequence_2 = CodeBlock(x=code_block) { 0..#8..x; }
watch_2 = Watch(create_sequence_2)
