# Dynamo graph NumberSlider.dyn (Dynamo 1.0.1.1167)

number_slider = DoubleSlider(5.536, range=0..10 step 0.001)
create_sequence = CodeBlock(x=number_slider) { 0..#8..x; }
watch = Watch(create_sequence)
