# Dynamo custom node Output.dyf (Dynamo 1.1.0.2093)
# category: Core
# test

x = Input(x:double=2)  # First number
y = Input(y:double=10)  # Second number
code_block = CodeBlock(x=x, y=y) { (x/y)*100; }
Percentage = Output(code_block)  # Resulting Percentage of two Numbers
