# Dynamo graph String.dyn (Dynamo 1.0.0.1180)

string = StringInput(" ")
string_2 = StringInput("Hello")
code_block = CodeBlock { "World"; }
join = String.Join(string, string_2, code_block)
watch = Watch(join)
