# Dynamo graph AddItemToFront.dyn (Dynamo 1.0.0.1180)

code_block = CodeBlock { 20; }
code_block_2 = CodeBlock { 0..5..1; }
watch = Watch(code_block_2)
addItemToFront = List.AddItemToFront(item=code_block, list=watch)
watch_2 = Watch(addItemToFront)
