# Dynamo graph Chop.dyn (Dynamo 1.0.0.1180)

code_block = CodeBlock { 0..5..1; }
watch = Watch(code_block)
code_block_2 = CodeBlock { {1,3}; }
chop = List.Chop(list=watch, lengths=code_block_2)
watch_2 = Watch(chop)
