# Dynamo graph Clean.dyn (Dynamo 1.1.0.2093)

code_block = CodeBlock { {10, 4, null, 40, A}; }
watch = Watch(code_block)
boolean = BoolSelector(false)
clean = List.Clean(list=watch, preserveIndices=boolean)
watch_2 = Watch(clean)
