# Dynamo graph ContainsItem.dyn (Dynamo 1.0.0.1180)

code_block = CodeBlock { 0..5..1; }
watch = Watch(code_block)
code_block_2 = CodeBlock { 3; }
containsItem = List.ContainsItem(list=watch, item=code_block_2)
watch_2 = Watch(containsItem)
