# Dynamo graph Deconstruct.dyn (Dynamo 1.0.0.1180)

code_block = CodeBlock { 0..5..1; }
watch = Watch(code_block)
deconstruct = List.Deconstruct(list=watch)
watch_2 = Watch(deconstruct.first)
watch_3 = Watch(deconstruct.rest)
