# Dynamo graph DiagonalRight.dyn (Dynamo 1.1.0.2093)

code_block = CodeBlock { 0..10..#9; }
create = List.Create(code_block, code_block)
watch = Watch(create)
code_block_2 = CodeBlock { 4; }
diagonalRight = List.DiagonalRight(watch, code_block_2)
watch_2 = Watch(diagonalRight)
