# Dynamo graph DropEveryNthItem.dyn (Dynamo 1.0.0.1180)

integer_slider = IntegerSlider(1, range=0..100 step 1)
integer_slider_2 = IntegerSlider(25, range=0..100 step 1)
integer_slider_3 = IntegerSlider(2, range=0..100 step 1)
range = Range(start=integer_slider, end=integer_slider_2, step=integer_slider_3, lacing=Longest)
watch = Watch(range)
integer_slider_4 = IntegerSlider(2, range=-10..10 step 1)
dropEveryNthItem = List.DropEveryNthItem(list=watch, n=integer_slider_4)
watch_2 = Watch(dropEveryNthItem)
