# Dynamo graph Flatten.dyn (Dynamo 1.0.0.1180)

code_block = CodeBlock { 1..5..1; }
byLengths = Cuboid.ByLengths(width=code_block, length=code_block, height=code_block)
explode = Geometry.Explode(byLengths)
edges = Face.Edges(explode)
code_block_2 = CodeBlock { 1; }
flatten = List.Flatten(list=edges, amt=code_block_2)
watch = Watch(flatten)
