# Dynamo graph Join.dyn (Dynamo 1.0.0.1180)

code_block = CodeBlock { 1..5..2; }
watch = Watch(code_block)
code_block_2 = CodeBlock { 0..4..2; }
watch_2 = Watch(code_block_2)
join = List.Join(watch, watch_2)
watch_3 = Watch(join)
