# Dynamo graph LastItem.dyn (Dynamo 1.0.0.1180)

code_block = CodeBlock { 10; }
randomList = Math.RandomList(code_block)
code_block_2 = CodeBlock(x=randomList) { x*5; }
floor = Math.Floor(code_block_2)
watch = Watch(floor)
lastItem = List.LastItem(watch)
watch_2 = Watch(lastItem)
