# Dynamo graph ListCartesianProduct.dyn (Dynamo 1.0.0.1180)

add = _ + _
code_block = CodeBlock { 0..5..1; }
code_block_2 = CodeBlock { 1..5..2; }
cartesianProduct = List.CartesianProduct(add, code_block, code_block_2)
watch = Watch(cartesianProduct)
code_block_3 = CodeBlock { 0..5..1; }
code_block_4 = CodeBlock { 1..5..2; }
add_2 = code_block_3 + code_block_4  # lacing=CrossProduct
watch_2 = Watch(add_2)
