# Dynamo graph ListCombine.dyn (Dynamo 1.0.0.1180)

add = _ + _
code_block = CodeBlock { 0..5..1; }
code_block_2 = CodeBlock { 1..5..2; }
combine = List.Combine(add, code_block, code_block_2)
watch = Watch(combine)
