# Dynamo graph ListFilter.dyn (Dynamo 1.0.0.1180)

code_block = CodeBlock { 0..5..1; }
number = DoubleInput(2)
gt = _ > number
filter = List.Filter(code_block, gt)
watch = Watch(filter.out0)
watch_2 = Watch(filter.out1)
