# Dynamo graph ListScan.dyn (Dynamo 1.0.0.1180)

add = _ + _
code_block = CodeBlock { 10; }
code_block_2 = CodeBlock { 0..5..1; }
scan = ScanList(add, code_block, code_block_2)  # "List.Scan"
watch = Watch(scan)
