# Dynamo graph MinimumItem.dyn (Dynamo 1.0.0.1180)

code_block = CodeBlock { 10; }
randomList = Math.RandomList(code_block)
code_block_2 = CodeBlock(x=randomList) { x*50; }
floor = Math.Floor(code_block_2)
watch = Watch(floor)
minimumItem = List.MinimumItem(watch)
watch_2 = Watch(minimumItem)
