# Dynamo graph OfRepeatedItem.dyn (Dynamo 1.0.0.1180)

code_block = CodeBlock { 4; }
code_block_2 = CodeBlock { 10; }
ofRepeatedItem = List.OfRepeatedItem(item=code_block, amount=code_block_2)
watch = Watch(ofRepeatedItem)
