# Dynamo graph Permutations.dyn (Dynamo 1.0.0.1180)

code_block = CodeBlock { 0..5..1; }
watch = Watch(code_block)
code_block_2 = CodeBlock { 3; }
permutations = List.Permutations(watch, code_block_2)
watch_2 = Watch(permutations)
