# Dynamo graph RemoveItemAtIndex.dyn (Dynamo 1.0.0.1180)

code_block = CodeBlock { 0..5..1; }
watch = Watch(code_block)
code_block_2 = CodeBlock { 3; }
removeItemAtIndex = List.RemoveItemAtIndex(list=watch, indices=code_block_2)
watch_2 = Watch(removeItemAtIndex)
