# Dynamo graph ReplaceByCondition.dyn (Dynamo 1.0.0.1180)

code_block = CodeBlock { 0..5..1; }
watch = Watch(code_block)
code_block_2 = CodeBlock { 10; }
formula = Formula("x%2==0")
replaceByCondition = Replace(watch, code_block_2, formula)
watch_2 = Watch(replaceByCondition)
