# Dynamo graph Shuffle.dyn (Dynamo 1.0.0.1180)

integer_slider = IntegerSlider(1, range=0..100 step 1)
integer_slider_2 = IntegerSlider(25, range=0..100 step 1)
integer_slider_3 = IntegerSlider(2, range=0..100 step 1)
range = Range(start=integer_slider, end=integer_slider_2, step=integer_slider_3, lacing=Longest)
watch = Watch(range)
shuffle = List.Shuffle(watch)
watch_2 = Watch(shuffle)
