# Dynamo graph Slice.dyn (Dynamo 1.0.0.1180)

code_block = CodeBlock { 0..5..1; }
watch = Watch(code_block)
code_block_2 = CodeBlock { 2; }
code_block_3 = CodeBlock { 5; }
slice = List.Slice(watch, code_block_2, code_block_3)
watch_2 = Watch(slice)
