# Dynamo graph Sort.dyn (Dynamo 1.0.0.1180)

integer_slider = IntegerSlider(25, range=0..100 step 1)
randomList = Math.RandomList(integer_slider)
code_block = CodeBlock(x=randomList) { x*10; }
floor = Math.Floor(code_block)
watch = Watch(floor)
sort = List.Sort(watch)
watch_2 = Watch(sort)
