# Dynamo graph SortByKey.dyn (Dynamo 1.0.0.1180)

code_block = CodeBlock { 0..9..1; }
code_block_2 = CodeBlock { 10; }
randomList = Math.RandomList(code_block_2)
code_block_3 = CodeBlock(x=randomList) { x*5; }
floor = Math.Floor(code_block_3)
watch = Watch(floor)
sortByKey = List.SortByKey(list=code_block, keys=watch)
watch_2 = Watch(sortByKey.sorted_list)
watch_3 = Watch(sortByKey.sorted_keys)
