# Dynamo graph Sublists.dyn (Dynamo 1.0.0.1180)

code_block = CodeBlock { 0..9..1; }
code_block_2 = CodeBlock { 0..5; }
code_block_3 = CodeBlock { 2; }
sublists = List.Sublists(list=code_block, ranges=code_block_2, offset=code_block_3)
watch = Watch(sublists)
