# Dynamo graph TakeItems.dyn (Dynamo 1.0.0.1180)

code_block = CodeBlock { 0..9..1; }
integer_slider = IntegerSlider(4, range=0..10 step 1)
takeItems = List.TakeItems(list=code_block, amount=integer_slider)
watch = Watch(takeItems)
