# Dynamo graph Transpose.dyn (Dynamo 1.0.0.1180)

integer_slider = IntegerSlider(3, range=0..100 step 1)
randomList = Math.RandomList(integer_slider)
integer_slider_2 = IntegerSlider(4, range=0..100 step 1)
randomList_2 = Math.RandomList(integer_slider_2)
create = List.Create(randomList, randomList_2)
watch = Watch(create)
transpose = List.Transpose(watch)
watch_2 = Watch(transpose)
