# Dynamo graph UniqueItems.dyn (Dynamo 1.0.0.1180)

integer_slider = IntegerSlider(25, range=0..100 step 1)
randomList = Math.RandomList(integer_slider)
code_block = CodeBlock(x=randomList) { x*10; }
floor = Math.Floor(code_block)
watch = Watch(floor)
uniqueItems = List.UniqueItems(watch)
watch_2 = Watch(uniqueItems)
