# Dynamo graph ListCreate.dyn (Dynamo 1.0.0.1180)

integer_slider = IntegerSlider(1, range=0..100 step 1)
integer_slider_2 = IntegerSlider(25, range=0..100 step 1)
integer_slider_3 = IntegerSlider(2, range=0..100 step 1)
create = List.Create(integer_slider, integer_slider_2, integer_slider_3)
watch = Watch(create)
