# Dynamo graph Sequence.dyn (Dynamo 1.0.0.1180)

integer_slider = IntegerSlider(1, range=0..100 step 1)
integer_slider_2 = IntegerSlider(25, range=0..100 step 1)
integer_slider_3 = IntegerSlider(2, range=0..100 step 1)
sequence = Sequence(start=integer_slider, amount=integer_slider_2, step=integer_slider_3, lacing=Longest)
watch = Watch(sequence)
