# Dynamo graph Empty.dyn (Dynamo 1.1.0.2093)

empty = List.Empty()
code_block = CodeBlock { 2; 4; 7; 1; }
create = List.Create(empty, code_block.out0, code_block.out1, code_block.out2, code_block.out3)
watch = Watch(create)
