# Dynamo graph Longitude.dyn (Dynamo 1.1.0.2093)

code_block = CodeBlock { 45.5231; }
code_block_2 = CodeBlock { -122.679565; }
code_block_3 = CodeBlock { "Portland"; }
byLatitudeAndLongitude = DynamoUnits.Location.ByLatitudeAndLongitude(code_block, code_block_2, code_block_3)
longitude = DynamoUnits.Location.Longitude(byLatitudeAndLongitude)
watch = Watch(longitude)
