# Dynamo graph ScopeIf.dyn (Dynamo 1.1.0.2093)

boolean = BoolSelector(false)
code_block = CodeBlock { 0..20..2; 0..5..1; }
scopeIf = ScopedIf(boolean, code_block.out0, code_block.out1)
watch = Watch(scopeIf)
byCoordinates = Point.ByCoordinates(x=watch, y=watch, lacing=CrossProduct)
