# Dynamo graph Xor.dyn (Dynamo 1.0.0.1180)

code_block = CodeBlock { {true,true,false,false}; {true,false,true,false}; }
watch = Watch(code_block.out0)
watch_2 = Watch(code_block.out1)
xor = Logic.Xor(watch, watch_2)
watch_3 = Watch(xor)
