# Dynamo graph Identity.dyn (Dynamo 1.1.0.2093)

code_block = CodeBlock()
# ---------- code_block.designscript (5 lines) ----------
pt=Point.ByCoordinates(4,0);

circle=Circle.ByCenterPointRadius(Point.ByCoordinates(-2,0));

sphere=Sphere.ByCenterPointRadius(Point.ByCoordinates(1,0));
# ----------------------------------------
identity = Object.Identity(code_block.pt)
identity_2 = Object.Identity(code_block.circle)
identity_3 = Object.Identity(code_block.sphere)
