# Dynamo graph Contains.dyn (Dynamo 1.0.0.1180)

string = StringInput("Hello World")
string_2 = StringInput("E")
boolean = BoolSelector(true)
contains = String.Contains(str=string, searchFor=string_2, ignoreCase=boolean)
watch = Watch(contains)
