# Dynamo graph CountOccurrences.dyn (Dynamo 1.0.0.1180)

string = StringInput("Hello World")
string_2 = StringInput("L")
boolean = BoolSelector(true)
countOccurrences = String.CountOccurrences(string, string_2, boolean)
watch = Watch(countOccurrences)
