# Dynamo graph EndsWith.dyn (Dynamo 1.0.0.1180)

string = StringInput("Hello World")
string_2 = StringInput("orld")
boolean = BoolSelector(true)
endsWith = String.EndsWith(string, string_2, boolean)
watch = Watch(endsWith)
