# Dynamo graph IndexOf.dyn (Dynamo 1.0.0.1180)

string = StringInput("Hello World")
string_2 = StringInput("o")
boolean = BoolSelector(true)
indexOf = String.IndexOf(string=string, searchFor=string_2, ignoreCase=boolean)
watch = Watch(indexOf)
