# Dynamo graph Insert.dyn (Dynamo 1.0.0.1180)

string = StringInput("Hello World")
integer_slider = IntegerSlider(4, range=0..15 step 1)
string_2 = StringInput("HI!")
insert = String.Insert(str=string, index=integer_slider, toInsert=string_2)
watch = Watch(insert)
