# Dynamo graph Join.dyn (Dynamo 1.0.0.1180)

string = StringInput("_")
string_2 = StringInput("Hello")
string_3 = StringInput("World")
string_4 = StringInput("HI!")
join = String.Join(string, string_2, string_3, string_4)
watch = Watch(join)
