# Dynamo graph LastIndexOf.dyn (Dynamo 1.0.0.1180)

string = StringInput("Hello World")
string_2 = StringInput("o")
boolean = BoolSelector(false)
lastIndexOf = String.LastIndexOf(string, string_2, boolean)
watch = Watch(lastIndexOf)
