# Dynamo graph PadRight.dyn (Dynamo 1.0.0.1180)

string = StringInput("Hello World")
integer_slider = IntegerSlider(30, range=0..100 step 1)
string_2 = StringInput("_")
padRight = String.PadRight(string, integer_slider, string_2)
watch = Watch(padRight)
