# Dynamo graph Remove.dyn (Dynamo 1.0.0.1180)

string = StringInput("Hello World")
integer_slider = IntegerSlider(4, range=0..10 step 1)
integer_slider_2 = IntegerSlider(3, range=0..10 step 1)
remove = String.Remove(str=string, startIndex=integer_slider, count=integer_slider_2)
watch = Watch(remove)
