# Dynamo graph Replace.dyn (Dynamo 1.0.0.1180)

string = StringInput("Hello World")
string_2 = StringInput("o")
string_3 = StringInput("Hi!")
replace = String.Replace(str=string, searchFor=string_2, replaceWith=string_3)
watch = Watch(replace)
