# Dynamo graph StartsWith.dyn (Dynamo 1.0.0.1180)

string = StringInput("Hello World")
string_2 = StringInput("h")
boolean = BoolSelector(true)
startsWith = String.StartsWith(str=string, searchFor=string_2, ignoreCase=boolean)
watch = Watch(startsWith)
