# Dynamo graph Substring.dyn (Dynamo 1.0.0.1180)

string = StringInput("Hello World")
integer_slider = IntegerSlider(4, range=0..10 step 1)
integer_slider_2 = IntegerSlider(3, range=0..10 step 1)
substring = String.Substring(str=string, startIndex=integer_slider, length=integer_slider_2)
watch = Watch(substring)
