# Dynamo graph ToNumber.dyn (Dynamo 1.0.0.1180)

string = StringInput("      Hello World      ")
toNumber = String.ToNumber(string)
watch = Watch(toNumber)
string_2 = StringInput("5.2")
toNumber_2 = String.ToNumber(string_2)
watch_2 = Watch(toNumber_2)
