# Dynamo graph TrimLeadingWhitespace.dyn (Dynamo 1.0.0.1180)

string = StringInput("    Hello World    ")
string_2 = StringInput("H")
indexOf = String.IndexOf(string=string, searchFor=string_2)
watch = Watch(indexOf)
trimLeadingWhitespace = String.TrimLeadingWhitespace(string)
watch_2 = Watch(trimLeadingWhitespace)
string_3 = StringInput("H")
indexOf_2 = String.IndexOf(string=watch_2, searchFor=string_3)
watch_3 = Watch(indexOf_2)
