# Dynamo graph TrimWhitespace.dyn (Dynamo 1.0.0.1180)

string = StringInput("      Hello World      ")
trimLeadingWhitespace = String.TrimLeadingWhitespace(string)
watch = Watch(trimLeadingWhitespace)
string_2 = StringInput("      Hello World      ")
trimTrailingWhitespace = String.TrimTrailingWhitespace(string_2)
watch_2 = Watch(trimTrailingWhitespace)
string_3 = StringInput("      Hello World      ")
trimWhitespace = String.TrimWhitespace(string_3)
watch_3 = Watch(trimWhitespace)
