# Dynamo graph Add.dyn (Dynamo 1.1.0.2093)

code_block = CodeBlock { 10; }
create = TimeSpan.Create(code_block)
code_block_2 = CodeBlock { 5; }
create_2 = TimeSpan.Create(arg1=code_block_2)
add = TimeSpan.Add(create, create_2)
watch = Watch(add)
