# Dynamo graph ByDateDifference.dyn (Dynamo 1.1.0.2093)

now = DateTime.Now()
date_time = DateTime("November 14, 2000 11:57 AM")
byDateDifference = TimeSpan.ByDateDifference(now, date_time)
watch = Watch(byDateDifference)
