# Dynamo graph Components.dyn (Dynamo 1.1.0.2093)

code_block = CodeBlock { "5:6:21"; }
fromString = TimeSpan.FromString(code_block)
components = TimeSpan.Components(fromString)
watch = Watch(components.out0)
watch_2 = Watch(components.out1)
watch_3 = Watch(components.out2)
watch_4 = Watch(components.out3)
watch_5 = Watch(components.out4)
