# Dynamo graph Subtract.dyn (Dynamo 1.1.0.2093)

code_block = CodeBlock { 10; }
create = TimeSpan.Create(code_block)
watch = Watch(create)
code_block_2 = CodeBlock { 5; }
create_2 = TimeSpan.Create(arg1=code_block_2)
watch_2 = Watch(create_2)
subtract = TimeSpan.Subtract(watch, watch_2)
watch_3 = Watch(subtract)
