# Dynamo graph TotalSeconds.dyn (Dynamo 1.1.0.2093)

code_block = CodeBlock { 2; }
code_block_2 = CodeBlock { 3; }
code_block_3 = CodeBlock { 30; }
create = TimeSpan.Create(code_block, code_block_2, code_block_3)
watch = Watch(create)
totalSeconds = TimeSpan.TotalSeconds(watch)
watch_2 = Watch(totalSeconds)
