# Dynamo graph Watch 3D.dyn (Dynamo 1.1.0.2093)

number_slider = DoubleSlider(2.7, range=0.1..6 step 0.1)
byCenterPointRadius = Circle.ByCenterPointRadius(radius=number_slider)
regularPolygon = Polygon.RegularPolygon(circle=byCenterPointRadius)
code_block = CodeBlock { 3; }
extrudeAsSolid = Curve.ExtrudeAsSolid(regularPolygon, code_block)
watch_3d = Watch3D(extrudeAsSolid)
boundingBox = Geometry.BoundingBox(extrudeAsSolid)
toPolySurface = BoundingBox.ToPolySurface(boundingBox)
code_block_2 = CodeBlock(geometry=toPolySurface) { color = Color.ByARGB(100,141,198,217); Display.ByGeometryColor(geometry, color); }
