# Dynamo graph ByGeometryColor.dyn (Dynamo 1.1.0.2093)

code_block = CodeBlock { 4; }
byCenterPointRadius = Circle.ByCenterPointRadius(radius=code_block)
byPatch = Surface.ByPatch(byCenterPointRadius)
code_block_2 = CodeBlock { 200; 141; 198; 217; }
byARGB = Color.ByARGB(a=code_block_2.out0, r=code_block_2.out1, g=code_block_2.out2, b=code_block_2.out3)
byGeometryColor = Display.Display.ByGeometryColor(byPatch, byARGB)
