# Dynamo graph BySurfaceColors.dyn (Dynamo 1.1.0.2093)

code_block = CodeBlock { 4; }
byCenterPointRadius = Circle.ByCenterPointRadius(radius=code_block)
byPatch = Surface.ByPatch(byCenterPointRadius)
code_block_2 = CodeBlock { 200; 227; 136; 200; }
byARGB = Color.ByARGB(a=code_block_2.out0, r=code_block_2.out1, g=code_block_2.out2, b=code_block_2.out3)
code_block_3 = CodeBlock { 200; 141; 198; 217; }
byARGB_2 = Color.ByARGB(a=code_block_3.out0, r=code_block_3.out1, g=code_block_3.out2, b=code_block_3.out3)
create = List.Create(byARGB, byARGB_2)
bySurfaceColors = Display.Display.BySurfaceColors(byPatch, create)
