# Dynamo graph ByBestFitThroughPoints.dyn (Dynamo 1.0.1.1167)

code_block = CodeBlock { 4; }
randomList = Math.RandomList(code_block)
code_block_2 = CodeBlock(x=randomList) { x*5; }
randomList_2 = Math.RandomList(code_block)
code_block_3 = CodeBlock(x=randomList_2) { x*5; }
byCoordinates = Point.ByCoordinates(x=code_block_2, y=code_block_3)
byBestFitThroughPoints = Arc.ByBestFitThroughPoints(byCoordinates)
