# Dynamo graph ByFillet.dyn (Dynamo 1.0.1.1167)

code_block = CodeBlock { 1; }
randomList = Math.RandomList(code_block)
code_block_2 = CodeBlock(x=randomList) { x*5; }
randomList_2 = Math.RandomList(code_block)
code_block_3 = CodeBlock(x=randomList_2) { x*5; }
byCoordinates = Point.ByCoordinates(x=code_block_2, y=code_block_3)
YAxis = Vector.YAxis()
code_block_4 = CodeBlock { 5; }
byStartPointDirectionLength = Line.ByStartPointDirectionLength(startPoint=byCoordinates, direction=YAxis, length=code_block_4)
byCoordinates_2 = Point.ByCoordinates(x=code_block_3, y=code_block_2)
XAxis = Vector.XAxis()
byStartPointDirectionLength_2 = Line.ByStartPointDirectionLength(startPoint=byCoordinates_2, direction=XAxis, length=code_block_4)
number_slider = DoubleSlider(2.3, range=0..4 step 0.1)
byFillet = Arc.ByFillet(byStartPointDirectionLength, byStartPointDirectionLength_2, number_slider)
