# Dynamo graph ByFilletTangentToCurve.dyn (Dynamo 1.0.1.1167)

code_block = CodeBlock { 0; 5; 5; }
byCoordinates = Point.ByCoordinates(x=code_block.out0, y=code_block.out1)
byCoordinates_2 = Point.ByCoordinates(x=code_block.out1, y=code_block.out2)
byStartPointEndPoint = Line.ByStartPointEndPoint(startPoint=byCoordinates, endPoint=byCoordinates_2)
number_slider = DoubleSlider(0.8, range=0..3 step 0.1)
byCenterPointRadius = Circle.ByCenterPointRadius(centerPoint=byCoordinates_2, radius=number_slider)
byCoordinates_3 = Point.ByCoordinates(x=code_block.out2, y=code_block.out0)
byStartPointEndPoint_2 = Line.ByStartPointEndPoint(startPoint=byCoordinates_3, endPoint=byCoordinates)
byFilletTangentToCurve = Arc.ByFilletTangentToCurve(byStartPointEndPoint, byCenterPointRadius, byStartPointEndPoint_2)
