# Dynamo graph ByStartPointEndPointStartTangent.dyn (Dynamo 1.0.1.1167)

code_block = CodeBlock { 2; }
randomList = Math.RandomList(code_block)
code_block_2 = CodeBlock(x=randomList) { x*8; }
randomList_2 = Math.RandomList(code_block)
code_block_3 = CodeBlock(x=randomList_2) { x*8; }
byCoordinates = Point.ByCoordinates(x=code_block_2, y=code_block_3)
code_block_4 = CodeBlock { 0; 1; }
getItemAtIndex = List.GetItemAtIndex(list=byCoordinates, index=code_block_4.out0)
getItemAtIndex_2 = List.GetItemAtIndex(list=byCoordinates, index=code_block_4.out1)
XAxis = Vector.XAxis()
byStartPointEndPointStartTangent = Arc.ByStartPointEndPointStartTangent(getItemAtIndex, getItemAtIndex_2, XAxis)
