# Dynamo graph Contains.dyn (Dynamo 1.0.1.1167)

origin = Point.Origin()
number_slider = DoubleSlider(10.1, range=0..100 step 0.1)
byCenterPointRadius = Sphere.ByCenterPointRadius(centerPoint=origin, radius=number_slider)
byGeometry = BoundingBox.ByGeometry(byCenterPointRadius)
code_block = CodeBlock { 5; 5; 5; }
byCoordinates = Point.ByCoordinates(x=code_block.out0, y=code_block.out1, z=code_block.out2)
contains = BoundingBox.Contains(byGeometry, byCoordinates)
watch = Watch(contains)
toCuboid = BoundingBox.ToCuboid(byGeometry)
edges = Topology.Edges(toCuboid)
curveGeometry = Edge.CurveGeometry(edges)
