# Dynamo graph Intersection.dyn (Dynamo 1.0.1.1167)

origin = Point.Origin()
code_block = CodeBlock { 5; 2; 6; }
byCoordinates = Vector.ByCoordinates(x=code_block.out0, y=code_block.out1, z=code_block.out2)
number_slider = DoubleSlider(8.5, range=0..100 step 0.1)
translate = Geometry.Translate(geometry=origin, direction=byCoordinates, distance=number_slider)
byPointsRadius = Cone.ByPointsRadius(origin, translate, number_slider)
XAxis = Vector.XAxis()
code_block_2 = CodeBlock { 0; }
translate_2 = Geometry.Translate(geometry=byPointsRadius, direction=XAxis, distance=code_block_2)
byGeometry = BoundingBox.ByGeometry(translate_2)
number_slider_2 = DoubleSlider(10.7, range=0..100 step 0.1)
translate_3 = Geometry.Translate(geometry=byPointsRadius, direction=XAxis, distance=number_slider_2)
byGeometry_2 = BoundingBox.ByGeometry(translate_3)
intersection = BoundingBox.Intersection(byGeometry, byGeometry_2)
toCuboid = BoundingBox.ToCuboid(intersection)
