# Dynamo graph ByCorners.dyn (Dynamo 1.0.1.1167)

origin = Point.Origin()
code_block = CodeBlock { 5; 2; 6; }
byCoordinates = Vector.ByCoordinates(x=code_block.out0, y=code_block.out1, z=code_block.out2)
number_slider = DoubleSlider(14.3, range=0..100 step 0.1)
translate = Geometry.Translate(geometry=origin, direction=byCoordinates, distance=number_slider)
byCorners = BoundingBox.ByCorners(min=origin, max=translate)
toPolySurface = BoundingBox.ToPolySurface(byCorners)
edges = Topology.Edges(toPolySurface)
curveGeometry = Edge.CurveGeometry(edges)
