# Dynamo graph ByGeometry_gg.dyn (Dynamo 1.0.1.1167)

origin = Point.Origin()
code_block = CodeBlock { 5; 2; 6; }
byCoordinates = Vector.ByCoordinates(x=code_block.out0, y=code_block.out1, z=code_block.out2)
number_slider = DoubleSlider(7.7, range=0..100 step 0.1)
translate = Geometry.Translate(geometry=origin, direction=byCoordinates, distance=number_slider)
byPointsRadius = Cone.ByPointsRadius(origin, translate, number_slider)
XAxis = Vector.XAxis()
code_block_2 = CodeBlock { 0; }
translate_2 = Geometry.Translate(geometry=byPointsRadius, direction=XAxis, distance=code_block_2)
translate_3 = Geometry.Translate(geometry=byPointsRadius, direction=XAxis, distance=number_slider)
join = List.Join(translate_2, translate_3)
flatten = Flatten(join)
byGeometry = BoundingBox.ByGeometry(flatten)
toPolySurface = BoundingBox.ToPolySurface(byGeometry)
edges = Topology.Edges(toPolySurface)
curveGeometry = Edge.CurveGeometry(edges)
