# Dynamo graph MaxPoint.dyn (Dynamo 1.0.1.1167)

origin = Point.Origin()
number_slider = DoubleSlider(10.1, range=0..100 step 0.1)
byCenterPointRadius = Sphere.ByCenterPointRadius(centerPoint=origin, radius=number_slider)
byGeometry = BoundingBox.ByGeometry(byCenterPointRadius)
toCuboid = BoundingBox.ToCuboid(byGeometry)
edges = Topology.Edges(toCuboid)
curveGeometry = Edge.CurveGeometry(edges)
minPoint = BoundingBox.MinPoint(byGeometry)
maxPoint = BoundingBox.MaxPoint(byGeometry)
