# Dynamo graph ByCenterPointRadius.dyn (Dynamo 1.0.1.1167)

code_block = CodeBlock { 1; 2; 0; }
byCoordinates = Point.ByCoordinates(x=code_block.out0, y=code_block.out1, z=code_block.out2)
number_slider = DoubleSlider(1, range=0..100 step 0.1)
byCenterPointRadius = Circle.ByCenterPointRadius(centerPoint=byCoordinates, radius=number_slider)
