# Dynamo graph ByCenterPointRadiusNormal.dyn (Dynamo 1.0.1.1167)

code_block = CodeBlock { 1; 3; 3; }
byCoordinates = Point.ByCoordinates(x=code_block.out0, y=code_block.out1, z=code_block.out2)
number_slider = DoubleSlider(1.5, range=0..10 step 0.1)
origin = Point.Origin()
byTwoPoints = Vector.ByTwoPoints(start=byCoordinates, end=origin)
byCenterPointRadiusNormal = Circle.ByCenterPointRadiusNormal(byCoordinates, number_slider, byTwoPoints)
