# Dynamo graph ByThreePoints.dyn (Dynamo 1.0.1.1167)

number = DoubleInput(3)
randomList = Math.RandomList(number)
randomList_2 = Math.RandomList(number)
byCoordinates = Point.ByCoordinates(x=randomList, y=randomList_2)
deconstruct = List.Deconstruct(list=byCoordinates)
deconstruct_2 = List.Deconstruct(list=deconstruct.rest)
byThreePoints = Circle.ByThreePoints(deconstruct.first, deconstruct_2.first, deconstruct_2.rest)
