# Dynamo graph ByCoordinateSystemHeightRadius.dyn (Dynamo 1.0.1.1167)

code_block = CodeBlock { 0; 0; 0; }
byCoordinates = Point.ByCoordinates(x=code_block.out0, y=code_block.out1, z=code_block.out2)
byOrigin = CoordinateSystem.ByOrigin(byCoordinates)
number_slider = DoubleSlider(8.3, range=0..10 step 0.1)
number_slider_2 = DoubleSlider(4.3, range=0..10 step 0.1)
byCoordinateSystemHeightRadius = Cone.ByCoordinateSystemHeightRadius(byOrigin, number_slider, number_slider_2)
