# Dynamo graph ByPointsRadius.dyn (Dynamo 1.0.1.1167)

origin = Point.Origin()
ZAxis = Vector.ZAxis()
number_slider = DoubleSlider(4.7, range=0..10 step 0.1)
translate = Geometry.Translate(geometry=origin, direction=ZAxis, distance=number_slider)
number_slider_2 = DoubleSlider(4.7, range=0..10 step 0.1)
byPointsRadius = Cone.ByPointsRadius(origin, translate, number_slider_2)
