# Dynamo graph RadiusRatio.dyn (Dynamo 1.0.0.1180)

origin = Point.Origin()
ZAxis = Vector.ZAxis()
number_slider = DoubleSlider(4.7, range=0..10 step 0.1)
translate = Geometry.Translate(geometry=origin, direction=ZAxis, distance=number_slider)
number_slider_2 = DoubleSlider(4.7, range=0..10 step 0.1)
number_slider_3 = DoubleSlider(1.9, range=0..10 step 0.1)
byPointsRadii = Cone.ByPointsRadii(origin, translate, number_slider_2, number_slider_3)
radiusRatio = Cone.RadiusRatio(byPointsRadii)
