# Dynamo graph StartPoint.dyn (Dynamo 1.0.0.1180)

code_block = CodeBlock { 0; 0; }
byOrigin = CoordinateSystem.ByOrigin(x=code_block.out0, y=code_block.out1)
number_slider = DoubleSlider(8, range=0..10 step 0.1)
number_slider_2 = DoubleSlider(7.7, range=0..10 step 0.1)
number_slider_3 = DoubleSlider(4.4, range=0..10 step 0.1)
byCoordinateSystemHeightRadii = Cone.ByCoordinateSystemHeightRadii(byOrigin, number_slider, number_slider_2, number_slider_3)
startPoint = Cone.StartPoint(byCoordinateSystemHeightRadii)
