# Dynamo graph Inverse.dyn (Dynamo 1.1.0.2093)

code_block = CodeBlock { 1; }
number_slider = DoubleSlider(2, range=0..5 step 0.1)
byCoordinates = Point.ByCoordinates(x=code_block, y=number_slider)
byOriginVectors = CoordinateSystem.ByOriginVectors(origin=byCoordinates)
code_block_2 = CodeBlock { 2; }
byCoordinateSystemRadii = Ellipse.ByCoordinateSystemRadii(byOriginVectors, arg2=code_block_2)
inverse = CoordinateSystem.Inverse(byOriginVectors)
code_block_3 = CodeBlock { 2; }
byCoordinateSystemRadii_2 = Ellipse.ByCoordinateSystemRadii(inverse, arg2=code_block_3)
