# Dynamo graph IsEqualTo.dyn (Dynamo 1.1.0.2093)

code_block = CodeBlock { 1; }
code_block_2 = CodeBlock { 2; }
byCoordinates = Point.ByCoordinates(x=code_block, y=code_block_2)
byOriginVectors = CoordinateSystem.ByOriginVectors(origin=byCoordinates)
inverse = CoordinateSystem.Inverse(byOriginVectors)
code_block_3 = CodeBlock { -1; }
code_block_4 = CodeBlock { -2; }
byCoordinates_2 = Point.ByCoordinates(x=code_block_3, y=code_block_4)
byOriginVectors_2 = CoordinateSystem.ByOriginVectors(origin=byCoordinates_2)
isEqualTo = CoordinateSystem.IsEqualTo(inverse, byOriginVectors_2)
watch = Watch(isEqualTo)
isEqualTo_2 = CoordinateSystem.IsEqualTo(byOriginVectors, byOriginVectors_2)
watch_2 = Watch(isEqualTo_2)
