# Dynamo graph Mirror.dyn (Dynamo 1.1.0.2093)

code_block = CodeBlock { 2; 3; 1; }
byOrigin = CoordinateSystem.ByOrigin(code_block.out0, code_block.out1, code_block.out2)
YZ = Plane.YZ()
mirror = CoordinateSystem.Mirror(byOrigin, YZ)
watch = Watch(mirror)
