# Dynamo graph PostMultiplyBy.dyn (Dynamo 1.1.0.2093)

code_block = CodeBlock { Point.ByCoordinates(1,2,0); Point.ByCoordinates(-2,-2,0); Vector.ByCoordinates(1,1,1); }
byOriginVectors = CoordinateSystem.ByOriginVectors(origin=code_block.out0)
byOriginVectors_2 = CoordinateSystem.ByOriginVectors(origin=code_block.out1, yAxis=code_block.out2)
postMultiplyBy = CoordinateSystem.PostMultiplyBy(byOriginVectors, byOriginVectors_2)
