# Dynamo graph ByCylindricalCoordinates.dyn (Dynamo 1.1.0.2093)

code_block = CodeBlock { 2.8; }
code_block_2 = CodeBlock { 3.9; }
byRadiusHeight = Cylinder.ByRadiusHeight(arg1=code_block, arg2=code_block_2)
code_block_3 = CodeBlock { 0..719..#40; 0.5..3.4..#40; }
byCylindricalCoordinates = CoordinateSystem.ByCylindricalCoordinates(arg1=code_block, arg2=code_block_3.out0, arg3=code_block_3.out1)
indent_depth = DoubleSlider(0.6, range=0..2 step 0.1)
byCartesianCoordinates = Point.ByCartesianCoordinates(byCylindricalCoordinates, arg3=indent_depth)
indent_radius = DoubleSlider(0.76, range=0.1..1 step 0.01)
byCenterPointRadius = Sphere.ByCenterPointRadius(centerPoint=byCartesianCoordinates, radius=indent_radius)
differenceAll = Solid.DifferenceAll(byRadiusHeight, byCenterPointRadius)
code_block_4 = CodeBlock(geometry=byCenterPointRadius) { color = Color.ByARGB(10,141,198,217); Display.ByGeometryColor(geometry, color); }
