# Dynamo graph ByOrigin (origin).dyn (Dynamo 1.1.0.2093)

code_block = CodeBlock { 4; }
byCoordinates = Point.ByCoordinates(x=code_block, y=code_block)
byOrigin = CoordinateSystem.ByOrigin(byCoordinates)
watch = Watch(byOrigin)
