# Dynamo graph ByOrigin (x, y).dyn (Dynamo 1.1.0.2093)

code_block = CodeBlock { 4; }
code_block_2 = CodeBlock { 2; }
byOrigin = CoordinateSystem.ByOrigin(x=code_block, y=code_block_2)
watch = Watch(byOrigin)
