# Dynamo graph ByOrigin (x, y, z).dyn (Dynamo 1.1.0.2093)

code_block = CodeBlock { 4; }
code_block_2 = CodeBlock { 2; }
code_block_3 = CodeBlock { 1; }
byOrigin = CoordinateSystem.ByOrigin(code_block, code_block_2, code_block_3)
watch = Watch(byOrigin)
