# Dynamo graph ByPlane.dyn (Dynamo 1.1.0.2093)

code_block = CodeBlock { 2; }
code_block_2 = CodeBlock { -2; }
byCoordinates = Point.ByCoordinates(x=code_block, y=code_block_2, z=code_block)
code_block_3 = CodeBlock { 1; }
code_block_4 = CodeBlock { -1; }
byCoordinates_2 = Vector.ByCoordinates(x=code_block_3, y=code_block_4, z=code_block_3)
byOriginNormalXAxis = Plane.ByOriginNormalXAxis(origin=byCoordinates, normal=byCoordinates_2)
byPlane = CoordinateSystem.ByPlane(byOriginNormalXAxis)
