# Dynamo graph BySphericalCoordinates.dyn (Dynamo 1.1.0.2093)

code_block = CodeBlock { 4; }
number_slider = DoubleSlider(172.1, range=0..359 step 0.1)
number_slider_2 = DoubleSlider(240.1, range=0..359 step 0.1)
code_block_2 = CodeBlock(theta=number_slider, phi=number_slider_2) { 0..theta..#20; 0..phi..#20; }
bySphericalCoordinates = CoordinateSystem.BySphericalCoordinates(arg1=code_block, arg2=code_block_2.out0, arg3=code_block_2.out1)
byCartesianCoordinates = Point.ByCartesianCoordinates(bySphericalCoordinates)
ZAxis = CoordinateSystem.ZAxis(bySphericalCoordinates)
number_slider_3 = DoubleSlider(1.4, range=0.1..5 step 0.1)
byStartPointDirectionLength = Line.ByStartPointDirectionLength(startPoint=byCartesianCoordinates, direction=ZAxis, length=number_slider_3)
byLoft = Surface.ByLoft(byStartPointDirectionLength)
byCenterPointRadius = Sphere.ByCenterPointRadius(radius=code_block)
code_block_3 = CodeBlock(geometry=byCenterPointRadius) { color = Color.ByARGB(200,141,198,217); Display.ByGeometryColor(geometry, color); }
