# Dynamo graph Determinant.dyn (Dynamo 1.1.0.2093)

number_slider = DoubleSlider(2.6, range=0..5 step 0.1)
number_slider_2 = DoubleSlider(17.6, range=0..100 step 0.1)
number_slider_3 = DoubleSlider(1.1, range=0..4 step 0.1)
byCylindricalCoordinates = CoordinateSystem.ByCylindricalCoordinates(arg1=number_slider, arg2=number_slider_2, arg3=number_slider_3)
determinant = CoordinateSystem.Determinant(byCylindricalCoordinates)
watch = Watch(determinant)
