# Dynamo graph IsSingular.dyn (Dynamo 1.1.0.2093)

number_slider = DoubleSlider(0.9, range=0..5 step 0.1)
byOrigin = CoordinateSystem.ByOrigin(number_slider, number_slider, number_slider)
isSingular = CoordinateSystem.IsSingular(byOrigin)
watch = Watch(isSingular)
