# Dynamo graph IsUniscaledOrtho.dyn (Dynamo 1.1.0.2093)

code_block = CodeBlock { 2.3; }
byCoordinates = Vector.ByCoordinates(x=code_block)
byOriginVectors = CoordinateSystem.ByOriginVectors(xAxis=byCoordinates)
isUniscaledOrtho = CoordinateSystem.IsUniscaledOrtho(byOriginVectors)
watch = Watch(isUniscaledOrtho)
