# Dynamo graph Origin.dyn (Dynamo 1.1.0.2093)

code_block = CodeBlock { 4; }
number_slider = DoubleSlider(172.1, range=0..359 step 0.1)
number_slider_2 = DoubleSlider(240.1, range=0..359 step 0.1)
code_block_2 = CodeBlock(theta=number_slider, phi=number_slider_2) { 0..theta..#20; 0..phi..#20; }
bySphericalCoordinates = CoordinateSystem.BySphericalCoordinates(arg1=code_block, arg2=code_block_2.out0, arg3=code_block_2.out1)
origin = CoordinateSystem.Origin(bySphericalCoordinates)
