# Dynamo graph XAxis.dyn (Dynamo 1.1.0.2093)

code_block = CodeBlock { 2; 3; }
byOrigin = CoordinateSystem.ByOrigin(x=code_block.out0, y=code_block.out1)
XAxis = CoordinateSystem.XAxis(byOrigin)
watch = Watch(XAxis)
code_block_2 = CodeBlock { Point.ByCoordinates(2,3); 3; }
byStartPointDirectionLength = Line.ByStartPointDirectionLength(startPoint=code_block_2.out0, direction=XAxis, length=code_block_2.out1)
