# Dynamo graph YAxis.dyn (Dynamo 1.1.0.2093)

code_block = CodeBlock { 2; 3; }
byOrigin = CoordinateSystem.ByOrigin(x=code_block.out0, y=code_block.out1)
YAxis = CoordinateSystem.YAxis(byOrigin)
watch = Watch(YAxis)
code_block_2 = CodeBlock { Point.ByCoordinates(2,3); 3; }
byStartPointDirectionLength = Line.ByStartPointDirectionLength(startPoint=code_block_2.out0, direction=YAxis, length=code_block_2.out1)
