# Dynamo graph YScaleFactor.dyn (Dynamo 1.1.0.2093)

byOrigin = CoordinateSystem.ByOrigin()
number_slider = DoubleSlider(2.3, range=0..5 step 0.1)
scale = CoordinateSystem.Scale(byOrigin, number_slider)
YScaleFactor = CoordinateSystem.YScaleFactor(scale)
watch = Watch(YScaleFactor)
YScaleFactor_2 = CoordinateSystem.YScaleFactor(byOrigin)
watch_2 = Watch(YScaleFactor_2)
byRadiusHeight = Cylinder.ByRadiusHeight(byOrigin)
code_block = CodeBlock(geometry=byRadiusHeight) { color = Color.ByARGB(100,141,198,217); Display.ByGeometryColor(geometry, color); }
byRadiusHeight_2 = Cylinder.ByRadiusHeight(scale)
code_block_2 = CodeBlock(geometry=byRadiusHeight_2) { color = Color.ByARGB(100,141,198,217); Display.ByGeometryColor(geometry, color); }
