# Dynamo graph ZScaleFactor.dyn (Dynamo 1.1.0.2093)

byOrigin = CoordinateSystem.ByOrigin()
number_slider = DoubleSlider(2.3, range=0..5 step 0.1)
scale = CoordinateSystem.Scale(byOrigin, number_slider)
ZScaleFactor = CoordinateSystem.ZScaleFactor(scale)
watch = Watch(ZScaleFactor)
ZScaleFactor_2 = CoordinateSystem.ZScaleFactor(byOrigin)
watch_2 = Watch(ZScaleFactor_2)
byRadiusHeight = Cylinder.ByRadiusHeight(scale)
code_block = CodeBlock(geometry=byRadiusHeight) { color = Color.ByARGB(100,141,198,217); Display.ByGeometryColor(geometry, color); }
byRadiusHeight_2 = Cylinder.ByRadiusHeight(byOrigin)
code_block_2 = CodeBlock(geometry=byRadiusHeight_2) { color = Color.ByARGB(100,141,198,217); Display.ByGeometryColor(geometry, color); }
