# Dynamo graph ZXPlane.dyn (Dynamo 1.1.0.2093)

origin = Point.Origin()
byOriginVectors = CoordinateSystem.ByOriginVectors(origin=origin)
code_block = CodeBlock { 1; }
byCoordinates = Vector.ByCoordinates(y=code_block)
number_slider = DoubleSlider(38.7, range=0..100 step 0.1)
rotate = CoordinateSystem.Rotate(coordinateSystem=byOriginVectors, origin=origin, axis=byCoordinates, degrees=number_slider)
ZXPlane = CoordinateSystem.ZXPlane(rotate)
