# Dynamo graph ByLengths.dyn (Dynamo 1.0.0.1180)

number_slider = DoubleSlider(7.3, range=0..20 step 0.1)
number_slider_2 = DoubleSlider(11.8, range=0..20 step 0.1)
number_slider_3 = DoubleSlider(5.7, range=0..20 step 0.1)
byLengths = Cuboid.ByLengths(width=number_slider, length=number_slider_2, height=number_slider_3)
