# Dynamo graph ByLengths_origin.dyn (Dynamo 1.0.0.1180)

code_block = CodeBlock { 2; }
randomList = Math.RandomList(code_block)
code_block_2 = CodeBlock(x=randomList) { x*12; }
code_block_3 = CodeBlock { 0; 1; }
getItemAtIndex = List.GetItemAtIndex(list=code_block_2, index=code_block_3.out0)
getItemAtIndex_2 = List.GetItemAtIndex(list=code_block_2, index=code_block_3.out1)
byCoordinates = Point.ByCoordinates(x=getItemAtIndex, y=getItemAtIndex_2)
number_slider = DoubleSlider(7.3, range=0..20 step 0.1)
number_slider_2 = DoubleSlider(11.8, range=0..20 step 0.1)
number_slider_3 = DoubleSlider(5.7, range=0..20 step 0.1)
byLengths = Cuboid.ByLengths(origin=byCoordinates, width=number_slider, length=number_slider_2, height=number_slider_3)
