# Dynamo graph CoordinateSystemAtSegmentLength.dyn (Dynamo 1.0.0.1180)

code_block = CodeBlock { 6; }
randomList = Math.RandomList(code_block)
code_block_2 = CodeBlock(x=randomList) { x*10; }
randomList_2 = Math.RandomList(code_block)
code_block_3 = CodeBlock(x=randomList_2) { x*10; }
randomList_3 = Math.RandomList(code_block)
code_block_4 = CodeBlock(x=randomList_3) { x*5; }
byCoordinates = Point.ByCoordinates(x=code_block_2, y=code_block_3, z=code_block_4)
byControlPoints = NurbsCurve.ByControlPoints(byCoordinates)
number_slider = DoubleSlider(14.55, range=0..30 step 0.01)
coordinateSystemAtSegmentLength = Curve.CoordinateSystemAtSegmentLength(byControlPoints, number_slider)
