# Dynamo graph ExtrudeAsSolid_direction_distance.dyn (Dynamo 1.0.0.1180)

number_slider = DoubleSlider(5, range=3..10 step 1)
code_block = CodeBlock(a=number_slider) { 0..360..360/(a-1); }
randomList = Math.RandomList(number_slider)
code_block_2 = CodeBlock(x=randomList) { x*5; }
byCylindricalCoordinates = Point.ByCylindricalCoordinates(arg1=code_block, arg3=code_block_2)
boolean = BoolSelector(true)
byPoints = NurbsCurve.ByPoints(byCylindricalCoordinates, boolean)
code_block_3 = CodeBlock { 3; -2; 1; }
byCoordinates = Vector.ByCoordinates(x=code_block_3.out0, y=code_block_3.out1, z=code_block_3.out2)
number_slider_2 = DoubleSlider(2, range=-10..10 step 0.1)
extrudeAsSolid = Curve.ExtrudeAsSolid(curve=byPoints, direction=byCoordinates, distance=number_slider_2)
