# Dynamo graph Join.dyn (Dynamo 1.3.0.875)

code_block = CodeBlock { Point.Origin(); Point.ByCoordinates(0,5,3); Point.ByCoordinates(0,10,0); }
byThreePoints = Arc.ByThreePoints(firstPoint=code_block.out0, secondPoint=code_block.out1, thirdPoint=code_block.out2)
code_block_2 = CodeBlock { Point.ByCoordinates(10,10,0); Point.ByCoordinates(10,0,0); }
byStartPointEndPoint = Line.ByStartPointEndPoint(startPoint=code_block_2.out0, endPoint=code_block_2.out1)
boolean = BoolSelector(true)
boolean_2 = BoolSelector(false)
byBlendBetweenCurves = Curve.ByBlendBetweenCurves(byThreePoints, byStartPointEndPoint, boolean, boolean_2)
join = Curve.Join(curve=byThreePoints, curves=byBlendBetweenCurves)
