# Dynamo graph Project.dyn (Dynamo 1.0.0.1180)

code_block = CodeBlock { 6; }
randomList = Math.RandomList(code_block)
code_block_2 = CodeBlock(x=randomList) { x*10; }
randomList_2 = Math.RandomList(code_block)
code_block_3 = CodeBlock(x=randomList_2) { x*10; }
randomList_3 = Math.RandomList(code_block)
code_block_4 = CodeBlock(x=randomList_3) { x*10; }
byCoordinates = Point.ByCoordinates(x=code_block_2, y=code_block_3, z=code_block_4)
byControlPoints = NurbsCurve.ByControlPoints(byCoordinates)
code_block_5 = CodeBlock { 3; 2; 3; }
byCoordinates_2 = Point.ByCoordinates(x=code_block_5.out0, y=code_block_5.out1, z=code_block_5.out2)
byCenterPointRadius = Sphere.ByCenterPointRadius(centerPoint=byCoordinates_2)
YAxis = Vector.YAxis()
project = Curve.Project(curve=byControlPoints, baseGeometry=byCenterPointRadius, projectionDirection=YAxis)
