# Dynamo graph PullOntoSurface.dyn (Dynamo 1.0.0.1180)

code_block = CodeBlock { Point.ByCoordinates(5,5,2); }
number_slider = DoubleSlider(1.9, range=0..5 step 0.1)
byCenterPointRadius = Circle.ByCenterPointRadius(centerPoint=code_block, radius=number_slider)
code_block_2 = CodeBlock { 0..10..1; }
code_block_3 = CodeBlock { 0..360..36; }
sin = Math.Sin(code_block_3)
byCoordinates = Point.ByCoordinates(y=code_block_2, z=sin)
byPoints = NurbsCurve.ByPoints(byCoordinates)
origin = Point.Origin()
ZAxis = Vector.ZAxis()
code_block_4 = CodeBlock { -90; }
rotate = Geometry.Rotate(geometry=byPoints, origin=origin, axis=ZAxis, degrees=code_block_4)
bySweep = Surface.BySweep(byPoints, rotate)
pullOntoSurface = Curve.PullOntoSurface(byCenterPointRadius, bySweep)
