# Dynamo graph SplitByPoints.dyn (Dynamo 1.0.0.1180)

code_block = CodeBlock { 6; }
randomList = Math.RandomList(code_block)
code_block_2 = CodeBlock(x=randomList) { x*10; }
sort = List.Sort(code_block_2)
randomList_2 = Math.RandomList(code_block)
code_block_3 = CodeBlock(x=randomList_2) { x*10; }
sort_2 = List.Sort(code_block_3)
byCoordinates = Point.ByCoordinates(x=sort, y=sort_2)
byPoints = NurbsCurve.ByPoints(byCoordinates)
splitByPoints = Curve.SplitByPoints(curve=byPoints, points=byCoordinates)
