# Dynamo graph SweepAsSolid.dyn (Dynamo 1.0.0.1180)

code_block = CodeBlock { 2; }
byWidthLength = Rectangle.ByWidthLength(width=code_block)
code_block_2 = CodeBlock { 0..180..36; }
cos = Math.Cos(code_block_2)
code_block_3 = CodeBlock(x=cos) { x-2; }
code_block_4 = CodeBlock { 0..5..1; }
byCoordinates = Point.ByCoordinates(x=code_block_3, z=code_block_4)
byPoints = NurbsCurve.ByPoints(byCoordinates)
sweepAsSolid = Curve.SweepAsSolid(byWidthLength, byPoints)
