# Dynamo graph TrimSegmentsByParameter_even.dyn (Dynamo 1.0.0.1180)

code_block = CodeBlock { 6; }
randomList = Math.RandomList(code_block)
code_block_2 = CodeBlock(x=randomList) { x*10; }
randomList_2 = Math.RandomList(code_block)
code_block_3 = CodeBlock(x=randomList_2) { x*10; }
byCoordinates = Point.ByCoordinates(x=code_block_2, y=code_block_3)
byControlPoints = NurbsCurve.ByControlPoints(byCoordinates)
code_block_4 = CodeBlock { 0..1..0.1; }
boolean = BoolSelector(false)
trimSegmentsByParameter = Curve.TrimSegmentsByParameter(byControlPoints, code_block_4, boolean)
