# Dynamo graph ByIsoCurveOnSurface.dyn (Dynamo 1.0.0.1180)

code_block = CodeBlock { 0..25..#5; }
byCoordinates = Point.ByCoordinates(x=code_block, y=code_block, lacing=CrossProduct)
asVector = Point.AsVector(byCoordinates)
length = Vector.Length(asVector)
random = Math.Random(length)
translate = Geometry.Translate(geometry=byCoordinates, zTranslation=random)
byPoints = NurbsSurface.ByPoints(translate)
number_slider = DoubleSlider(1, range=0..1 step 1)
number_slider_2 = DoubleSlider(0.37, range=0..1 step 0.01)
byIsoCurveOnSurface = Curve.ByIsoCurveOnSurface(baseSurface=byPoints, direction=number_slider, parameter=number_slider_2)
