# Dynamo graph ByParameterLineOnSurface.dyn (Dynamo 1.0.0.1180)

code_block = CodeBlock { 0..25..#5; }
byCoordinates = Point.ByCoordinates(x=code_block, y=code_block, lacing=CrossProduct)
asVector = Point.AsVector(byCoordinates)
length = Vector.Length(asVector)
random = Math.Random(length)
translate = Geometry.Translate(geometry=byCoordinates, zTranslation=random)
byPoints = NurbsSurface.ByPoints(translate)
number_slider = DoubleSlider(0.37, range=0..1 step 0.01)
number_slider_2 = DoubleSlider(0.37, range=0..1 step 0.01)
byCoordinates_2 = UV.ByCoordinates(number_slider, number_slider_2)
number_slider_3 = DoubleSlider(0.62, range=0..1 step 0.01)
number_slider_4 = DoubleSlider(0.75, range=0..1 step 0.01)
byCoordinates_3 = UV.ByCoordinates(number_slider_3, number_slider_4)
byParameterLineOnSurface = Curve.ByParameterLineOnSurface(byPoints, byCoordinates_2, byCoordinates_3)
