# Dynamo graph StartPoint.dyn (Dynamo 1.0.0.1180)

code_block = CodeBlock { 5; }
randomList = Math.RandomList(code_block)
code_block_2 = CodeBlock(x=randomList) { x*10; }
randomList_2 = Math.RandomList(code_block)
code_block_3 = CodeBlock(x=randomList_2) { x*10; }
byCoordinates = Point.ByCoordinates(x=code_block_2, y=code_block_3)
byControlPoints = NurbsCurve.ByControlPoints(byCoordinates)
startPoint = Curve.StartPoint(byControlPoints)
