# Dynamo graph ByPointsRadius.dyn (Dynamo 1.1.0.2093)

origin = Point.Origin()
top_position = DoubleSlider(0, range=-4..4 step 0.1)
height_z = DoubleSlider(5.3, range=0.1..8 step 0.1)
byCoordinates = Point.ByCoordinates(x=top_position, z=height_z)
radius = DoubleSlider(1.6, range=0.1..5 step 0.1)
byPointsRadius = Cylinder.ByPointsRadius(origin, byCoordinates, radius)
code_block = CodeBlock(geometry=byPointsRadius) { color = Color.ByARGB(100,141,198,217); Display.ByGeometryColor(geometry, color); }
