# Dynamo graph ByRadiusHeight.dyn (Dynamo 1.1.0.2093)

code_block = CodeBlock { 4; }
byCoordinates = Point.ByCoordinates(x=code_block, y=code_block)
code_block_2 = CodeBlock { Vector.ByCoordinates(1,4,1); }
byOriginVectors = CoordinateSystem.ByOriginVectors(origin=byCoordinates, yAxis=code_block_2)
number_slider = DoubleSlider(2.8, range=0..100 step 0.1)
number_slider_2 = DoubleSlider(3.4, range=0..100 step 0.1)
byRadiusHeight = Cylinder.ByRadiusHeight(byOriginVectors, number_slider, number_slider_2)
code_block_3 = CodeBlock(geometry=byRadiusHeight) { color = Color.ByARGB(100,141,198,217); Display.ByGeometryColor(geometry, color); }
