# Dynamo graph Radius.dyn (Dynamo 1.1.0.2093)

number_slider = DoubleSlider(3.1, range=0.1..4 step 0.1)
code_block = CodeBlock { 10; }
byRadiusHeight = Cylinder.ByRadiusHeight(arg1=number_slider, arg2=code_block)
radius = Cylinder.Radius(byRadiusHeight)
watch = Watch(radius)
code_block_2 = CodeBlock(geometry=byRadiusHeight) { color = Color.ByARGB(100,141,198,217); Display.ByGeometryColor(geometry, color); }
