# Dynamo graph CurveGeometry.dyn (Dynamo 1.1.0.2093)

code_block = CodeBlock { 5; }
byCenterPointRadius = Circle.ByCenterPointRadius(radius=code_block)
code_block_2 = CodeBlock { 6; }
regularPolygon = Polygon.RegularPolygon(circle=byCenterPointRadius, numberSides=code_block_2)
code_block_3 = CodeBlock { 3; }
extrudeAsSolid = Curve.ExtrudeAsSolid(regularPolygon, code_block_3)
edges = Topology.Edges(extrudeAsSolid)
code_block_4 = CodeBlock { 4; }
getItemAtIndex = List.GetItemAtIndex(list=edges, index=code_block_4)
curveGeometry = Edge.CurveGeometry(getItemAtIndex)
code_block_5 = CodeBlock(geometry=extrudeAsSolid) { color = Color.ByARGB(100,141,198,217); Display.ByGeometryColor(geometry, color); }
