# Dynamo graph StartVertex.dyn (Dynamo 1.1.0.2093)

code_block = CodeBlock { 5; }
byCenterPointRadius = Circle.ByCenterPointRadius(radius=code_block)
code_block_2 = CodeBlock { 6; }
regularPolygon = Polygon.RegularPolygon(circle=byCenterPointRadius, numberSides=code_block_2)
byPatch = Surface.ByPatch(regularPolygon)
code_block_3 = CodeBlock(geometry=byPatch) { color = Color.ByARGB(100,141,198,217); Display.ByGeometryColor(geometry, color); }
edges = Face.Edges(byPatch)
code_block_4 = CodeBlock { 4; }
getItemAtIndex = List.GetItemAtIndex(list=edges, index=code_block_4)
startVertex = Edge.StartVertex(getItemAtIndex)
pointGeometry = Vertex.PointGeometry(startVertex)
