# Dynamo graph MajorAxis.dyn (Dynamo 1.0.0.1180)

YZ = Plane.YZ()
number_slider = DoubleSlider(5.5, range=0..20 step 0.1)
number_slider_2 = DoubleSlider(6.4, range=0..20 step 0.1)
byPlaneRadii = Ellipse.ByPlaneRadii(YZ, number_slider, number_slider_2)
majorAxis = Ellipse.MajorAxis(byPlaneRadii)
