# Dynamo graph CenterPoint.dyn (Dynamo 1.0.0.1180)

XY = Plane.XY()
number_slider = DoubleSlider(9.4, range=0..20 step 0.1)
number_slider_2 = DoubleSlider(8.6, range=0..20 step 0.1)
number_slider_3 = DoubleSlider(8.6, range=0..20 step 0.1)
number_slider_4 = DoubleSlider(271.1, range=0..360 step 0.1)
byPlaneRadiiAngles = EllipseArc.ByPlaneRadiiAngles(XY, number_slider, number_slider_2, number_slider_3, number_slider_4)
centerPoint = EllipseArc.CenterPoint(byPlaneRadiiAngles)
