# Dynamo graph Vertices.dyn (Dynamo 1.1.0.2093)

code_block = CodeBlock { 5; }
byCenterPointRadius = Circle.ByCenterPointRadius(radius=code_block)
code_block_2 = CodeBlock { 6; }
regularPolygon = Polygon.RegularPolygon(circle=byCenterPointRadius, numberSides=code_block_2)
code_block_3 = CodeBlock { 4; }
extrudeAsSolid = Curve.ExtrudeAsSolid(regularPolygon, code_block_3)
faces = Topology.Faces(extrudeAsSolid)
code_block_4 = CodeBlock { 1; }
getItemAtIndex = List.GetItemAtIndex(list=faces, index=code_block_4)
surfaceGeometry = Face.SurfaceGeometry(getItemAtIndex)
code_block_5 = CodeBlock(geometry=surfaceGeometry) { color = Color.ByARGB(100,141,198,217); Display.ByGeometryColor(geometry, color); }
code_block_6 = CodeBlock(geometry=extrudeAsSolid) { color = Color.ByARGB(100,141,198,217); Display.ByGeometryColor(geometry, color); }
vertices = Face.Vertices(getItemAtIndex)
pointGeometry = Vertex.PointGeometry(vertices)
