# Dynamo graph IsAlmostEqualTo.dyn (Dynamo 1.1.0.2093)

byRadiusHeight = Cylinder.ByRadiusHeight()
byCenterPointRadius = Circle.ByCenterPointRadius()
extrudeAsSolid = Curve.ExtrudeAsSolid(byCenterPointRadius)
isAlmostEqualTo = Geometry.IsAlmostEqualTo(byRadiusHeight, extrudeAsSolid)
watch = Watch(isAlmostEqualTo)
x_position = DoubleSlider(0, range=0..4 step 0.1)
height_z = DoubleSlider(1, range=1..2 step 0.1)
code_block = CodeBlock(x=x_position, z=height_z) { Point.ByCoordinates(x,0,0); Point.ByCoordinates(x,0,z); }
byPointsRadius = Cylinder.ByPointsRadius(code_block.out0, code_block.out1)
isAlmostEqualTo_2 = Geometry.IsAlmostEqualTo(byPointsRadius, byRadiusHeight)
watch_2 = Watch(isAlmostEqualTo_2)
code_block_2 = CodeBlock(geo1=byPointsRadius, geo2=byRadiusHeight, geo3=extrudeAsSolid) { geometry = {geo1, geo2, geo3}; color = Color.ByARGB(100,141,198,217); Display.ByGeometryColor(geometry, color); }
identity = Object.Identity(code_block_2.out2)
