# Dynamo graph Mirror.dyn (Dynamo 1.0.1.1167)

origin = Point.Origin()
code_block = CodeBlock { 5; 2; 8; }
byCoordinates = Point.ByCoordinates(x=code_block.out0, y=code_block.out1, z=code_block.out2)
byPointsRadius = Cone.ByPointsRadius(origin, byCoordinates, code_block.out0)
YZ = Plane.YZ()
mirror = Geometry.Mirror(geometry=byPointsRadius, mirrorPlane=YZ)
