# Dynamo graph Rotate_gbd.dyn (Dynamo 1.0.1.1167)

origin = Point.Origin()
code_block = CodeBlock { 5; 2; 8; }
byCoordinates = Point.ByCoordinates(x=code_block.out0, y=code_block.out1, z=code_block.out2)
byPointsRadius = Cone.ByPointsRadius(origin, byCoordinates, code_block.out0)
XY = Plane.XY()
number_slider = DoubleSlider(62.1, range=1..359 step 0.1)
rotate = Geometry.Rotate(byPointsRadius, XY, number_slider)
