# Dynamo graph Rotate_goad.dyn (Dynamo 1.0.1.1167)

XY = Plane.XY()
origin = Point.Origin()
code_block = CodeBlock { 5; 2; 8; }
byCoordinates = Point.ByCoordinates(x=code_block.out0, y=code_block.out1, z=code_block.out2)
byPointsRadius = Cone.ByPointsRadius(origin, byCoordinates, code_block.out0)
YAxis = Vector.YAxis()
number_slider = DoubleSlider(44.6, range=1..359 step 0.1)
rotate = Geometry.Rotate(geometry=byPointsRadius, origin=byCoordinates, axis=YAxis, degrees=number_slider)
