# Dynamo graph Scale_gbft.dyn (Dynamo 1.0.1.1167)

origin = Point.Origin()
code_block = CodeBlock { 5; 2; 8; }
byCoordinates = Point.ByCoordinates(x=code_block.out0, y=code_block.out1, z=code_block.out2)
byPointsRadius = Cone.ByPointsRadius(origin, byCoordinates, code_block.out0)
centroid = Solid.Centroid(byPointsRadius)
scale = Geometry.Scale(byPointsRadius, byCoordinates, origin, centroid)
vertices = Topology.Vertices(byPointsRadius)
pointGeometry = Vertex.PointGeometry(vertices)
byBestFitThroughPoints = Line.ByBestFitThroughPoints(pointGeometry)
byTwoPoints = Vector.ByTwoPoints(start=origin, end=byCoordinates)
byCenterPointRadiusNormal = Circle.ByCenterPointRadiusNormal(origin, code_block.out0, byTwoPoints)
