# Dynamo graph Scale_gpxyz.dyn (Dynamo 1.0.1.1167)

origin = Point.Origin()
code_block = CodeBlock { 5; 2; 8; }
byCoordinates = Point.ByCoordinates(x=code_block.out0, y=code_block.out1, z=code_block.out2)
byPointsRadius = Cone.ByPointsRadius(origin, byCoordinates, code_block.out0)
YZ = Plane.YZ()
number_slider = DoubleSlider(2, range=0.1..5 step 0.1)
number_slider_2 = DoubleSlider(1.4, range=0.1..5 step 0.1)
number_slider_3 = DoubleSlider(0.9, range=0.1..5 step 0.1)
scale = Geometry.Scale(byPointsRadius, YZ, number_slider, number_slider_2, number_slider_3)
