# Dynamo graph Scale_gxyz.dyn (Dynamo 1.0.1.1167)

origin = Point.Origin()
code_block = CodeBlock { 5; 2; 8; }
byCoordinates = Point.ByCoordinates(x=code_block.out0, y=code_block.out1, z=code_block.out2)
byPointsRadius = Cone.ByPointsRadius(origin, byCoordinates, code_block.out0)
number_slider = DoubleSlider(2.1, range=0.1..5 step 0.1)
number_slider_2 = DoubleSlider(1.3, range=0.1..5 step 0.1)
number_slider_3 = DoubleSlider(0.9, range=0.1..5 step 0.1)
scale = Geometry.Scale(geometry=byPointsRadius, xamount=number_slider, yamount=number_slider_2, zamount=number_slider_3)
vertices = Topology.Vertices(byPointsRadius)
pointGeometry = Vertex.PointGeometry(vertices)
byBestFitThroughPoints = Line.ByBestFitThroughPoints(pointGeometry)
byTwoPoints = Vector.ByTwoPoints(start=origin, end=byCoordinates)
byCenterPointRadiusNormal = Circle.ByCenterPointRadiusNormal(origin, code_block.out0, byTwoPoints)
