# Dynamo graph SerializeAsSAB (geometry).dyn (Dynamo 1.1.0.2093)

byCenterPointRadius = Circle.ByCenterPointRadius()
extrudeAsSolid = Curve.ExtrudeAsSolid(byCenterPointRadius)
serializeAsSAB = Geometry.SerializeAsSAB(extrudeAsSolid)
watch = Watch(serializeAsSAB)
