# Dynamo graph Split.dyn (Dynamo 1.0.1.1167)

code_block = CodeBlock { 8; 2; 5; }
byCoordinates = Point.ByCoordinates(x=code_block.out0, y=code_block.out1, z=code_block.out2)
code_block_2 = CodeBlock { 5; 2; 8; }
byCoordinates_2 = Point.ByCoordinates(x=code_block_2.out0, y=code_block_2.out1, z=code_block_2.out2)
byPointsRadius = Cone.ByPointsRadius(byCoordinates, byCoordinates_2, code_block_2.out0)
byTwoPoints = Vector.ByTwoPoints(start=byCoordinates, end=byCoordinates_2)
number_slider = DoubleSlider(2.3, range=0..3 step 0.1)
translate = Geometry.Translate(geometry=byPointsRadius, direction=byTwoPoints, distance=number_slider)
split = Geometry.Split(geometry=byPointsRadius, other=translate)
code_block_3 = CodeBlock { 0; }
getItemAtIndex = List.GetItemAtIndex(list=split, index=code_block_3)
vertices = Topology.Vertices(byPointsRadius)
pointGeometry = Vertex.PointGeometry(vertices)
byBestFitThroughPoints = Line.ByBestFitThroughPoints(pointGeometry)
