# Dynamo graph Translate_gdd.dyn (Dynamo 1.0.1.1167)

code_block = CodeBlock { 8; 2; 5; }
byCoordinates = Point.ByCoordinates(x=code_block.out0, y=code_block.out1, z=code_block.out2)
code_block_2 = CodeBlock { 5; 2; 8; }
byCoordinates_2 = Point.ByCoordinates(x=code_block_2.out0, y=code_block_2.out1, z=code_block_2.out2)
byPointsRadius = Cone.ByPointsRadius(byCoordinates, byCoordinates_2, code_block_2.out0)
XAxis = Vector.XAxis()
number_slider = DoubleSlider(13.1, range=0..100 step 0.1)
translate = Geometry.Translate(geometry=byPointsRadius, direction=XAxis, distance=number_slider)
