# Dynamo graph ContextCoordinateSystem.dyn (Dynamo 1.1.0.2093)

code_block = CodeBlock { Point.ByCoordinates(3,0,0); }
byCenterPointRadius = Circle.ByCenterPointRadius(centerPoint=code_block)
extrudeAsSolid = Curve.ExtrudeAsSolid(byCenterPointRadius)
contextCoordinateSystem = Geometry.ContextCoordinateSystem(extrudeAsSolid)
code_block_2 = CodeBlock(geometry=extrudeAsSolid) { color = Color.ByARGB(100,141,198,217); Display.ByGeometryColor(geometry, color); }
