# Dynamo graph AxisDirection.dyn (Dynamo 1.0.0.1180)

code_block = CodeBlock { 3; 5; }
byCoordinates = Point.ByCoordinates(x=code_block.out0, y=code_block.out1)
YAxis = Vector.YAxis()
number_slider = DoubleSlider(4.4, range=0..20 step 0.1)
number_slider_2 = DoubleSlider(2.7, range=0..20 step 0.1)
number_slider_3 = DoubleSlider(1.8, range=0..20 step 0.1)
byCoordinates_2 = Point.ByCoordinates(x=number_slider, y=number_slider_2, z=number_slider_3)
number_slider_4 = DoubleSlider(3.1, range=0..20 step 0.1)
number_slider_5 = DoubleSlider(608, range=0..1000 step 0.1)
byAxis = Helix.ByAxis(byCoordinates, YAxis, byCoordinates_2, number_slider_4, number_slider_5)
axisDirection = Helix.AxisDirection(byAxis)
