# Dynamo graph ByIndices (a, b, c) (a, b, c).dyn (Dynamo 1.1.0.2093)

code_block = CodeBlock { Math.RandomList(3)*2; Math.RandomList(3)*2; Math.RandomList(3)*2; }
byCoordinates = Point.ByCoordinates(x=code_block.out0, y=code_block.out1, z=code_block.out2)
code_block_2 = CodeBlock { 0; 1; 2; }
byIndices = IndexGroup.ByIndices(code_block_2.out0, code_block_2.out1, code_block_2.out2)
byPointsFaceIndices = Mesh.ByPointsFaceIndices(byCoordinates, byIndices)
