# Dynamo graph ByIndices (a, b, c, d) (a, b, c, d) (a, b, c, d).dyn (Dynamo 1.1.0.2093)

code_block = CodeBlock { 4; }
randomList = Math.RandomList(code_block)
code_block_2 = CodeBlock(x=randomList) { x*2; }
code_block_3 = CodeBlock { 4; }
randomList_2 = Math.RandomList(code_block_3)
code_block_4 = CodeBlock(x=randomList_2) { x*2; }
code_block_5 = CodeBlock { 4; }
randomList_3 = Math.RandomList(code_block_5)
code_block_6 = CodeBlock(x=randomList_3) { x*2; }
byCoordinates = Point.ByCoordinates(x=code_block_2, y=code_block_4, z=code_block_6)
code_block_7 = CodeBlock { 0; 1; 2; 3; }
byIndices = IndexGroup.ByIndices(code_block_7.out0, code_block_7.out1, code_block_7.out2, code_block_7.out3)
byPointsFaceIndices = Mesh.ByPointsFaceIndices(byCoordinates, byIndices)
