# Dynamo graph A.dyn (Dynamo 1.1.0.2093)

code_block = CodeBlock { pt1 = Point.ByCoordinates(0,2,1); pt2 = Point.ByCoordinates(2,2,3); pt3 = Point.ByCoordinates(1,1,0); {pt1, pt2, pt3}; }
code_block_2 = CodeBlock { 0; 1; 2; }
byIndices = IndexGroup.ByIndices(code_block_2.out0, code_block_2.out1, code_block_2.out2)
byPointsFaceIndices = Mesh.ByPointsFaceIndices(code_block.out3, byIndices)
A = IndexGroup.A(byIndices)
watch = Watch(A)
