# Dynamo graph ByTangency.dyn (Dynamo 1.0.0.1180)

code_block = CodeBlock { {0,1,2,3}; {0,1,2,6}; }
byCoordinates = Point.ByCoordinates(x=code_block.out0, y=code_block.out1)
byControlPoints = NurbsCurve.ByControlPoints(byCoordinates)
number_slider = DoubleSlider(0.47, range=0..2 step 0.01)
byTangency = Line.ByTangency(byControlPoints, number_slider)
