# Dynamo graph Direction.dyn (Dynamo 1.0.0.1180)

integer_slider = IntegerSlider(13, range=3..20 step 1)
randomList = Math.RandomList(integer_slider)
code_block = CodeBlock(x=randomList) { x*2; }
randomList_2 = Math.RandomList(integer_slider)
code_block_2 = CodeBlock(y=randomList_2) { y*3; }
byCoordinates = Point.ByCoordinates(x=code_block, y=code_block_2)
byBestFitThroughPoints = Line.ByBestFitThroughPoints(byCoordinates)
direction = Line.Direction(byBestFitThroughPoints)
