# Dynamo graph ControlPoints.dyn (Dynamo 1.0.0.1180)

code_block = CodeBlock { 9; }
randomList = Math.RandomList(code_block)
formula = Formula("x*20", x=randomList)
sort = List.Sort(formula)
randomList_2 = Math.RandomList(code_block)
formula_2 = Formula("y*20", y=randomList_2)
sort_2 = List.Sort(formula_2)
byCoordinates = Point.ByCoordinates(x=sort, y=sort_2)
byPoints = NurbsCurve.ByPoints(byCoordinates)
controlPoints = NurbsCurve.ControlPoints(byPoints)
