# Dynamo graph ByControlPoints_p.dyn (Dynamo 1.0.1.1167)

code_block = CodeBlock { {0,1,2,3}; {0,1,2,6}; }
byCoordinates = Point.ByCoordinates(x=code_block.out0, y=code_block.out1)
byControlPoints = NurbsCurve.ByControlPoints(byCoordinates)
