# Dynamo graph ByControlPoints_pd.dyn (Dynamo 1.0.1.1167)

code_block = CodeBlock { 6; }
randomList = Math.RandomList(code_block)
sort = List.Sort(randomList)
randomList_2 = Math.RandomList(code_block)
sort_2 = List.Sort(randomList_2)
byCoordinates = Point.ByCoordinates(x=sort, y=sort_2)
code_block_2 = CodeBlock { 3; }
byControlPoints = NurbsCurve.ByControlPoints(byCoordinates, code_block_2)
