# Dynamo graph ByControlPoints_pdc.dyn (Dynamo 1.0.1.1167)

code_block = CodeBlock { 6; }
randomList = Math.RandomList(code_block)
code_block_2 = CodeBlock(x=randomList) { x*15; }
sort = List.Sort(code_block_2)
randomList_2 = Math.RandomList(code_block)
code_block_3 = CodeBlock(x=randomList_2) { x*15; }
sort_2 = List.Sort(code_block_3)
byCoordinates = Point.ByCoordinates(x=sort, y=sort_2)
code_block_4 = CodeBlock { 3; }
boolean = BoolSelector(false)
byControlPoints = NurbsCurve.ByControlPoints(byCoordinates, code_block_4, boolean)
