# Dynamo graph ByPointsTangents.dyn (Dynamo 1.0.1.1167)

byCenterPointRadius = Circle.ByCenterPointRadius()
code_block = CodeBlock { 0..0.5..#5; }
pointAtParameter = Curve.PointAtParameter(curve=byCenterPointRadius, param=code_block)
code_block_2 = CodeBlock { -5; 0; 0; }
byCoordinates = Vector.ByCoordinates(x=code_block_2.out0, y=code_block_2.out1, z=code_block_2.out2)
byPointsTangents = NurbsCurve.ByPointsTangents(pointAtParameter, byCoordinates, byCoordinates)
