# Dynamo graph ControlPoints.dyn (Dynamo 1.1.0.2093)

code_block = CodeBlock { 4; }
randomList = Math.RandomList(code_block)
code_block_2 = CodeBlock(x=randomList) { x*10; }
randomList_2 = Math.RandomList(code_block)
code_block_3 = CodeBlock(x=randomList_2) { x*10; }
randomList_3 = Math.RandomList(code_block)
code_block_4 = CodeBlock(x=randomList_3) { x*10; }
byCoordinates = Point.ByCoordinates(x=code_block_2, y=code_block_3, z=code_block_4)
boolean = BoolSelector(true)
byPoints = NurbsCurve.ByPoints(byCoordinates, boolean)
byPatch = Surface.ByPatch(byPoints)
approximateWithTolerance = Surface.ApproximateWithTolerance(byPatch)
controlPoints = NurbsSurface.ControlPoints(approximateWithTolerance)
