# Dynamo graph Weights.dyn (Dynamo 1.1.0.2093)

code_block = CodeBlock { 0..9..#10; }
code_block_2 = CodeBlock(x=code_block) { x*2; }
code_block_3 = CodeBlock { 0..9..#20; }
code_block_4 = CodeBlock(x=code_block_3) { x*2; }
byCoordinates = Point.ByCoordinates(x=code_block_2, y=code_block_4, lacing=CrossProduct)
ZAxis = Vector.ZAxis()
count = Count(byCoordinates)
randomList = Math.RandomList(count)
scale = Vector.Scale(vector=ZAxis, scale_factor=randomList)
translate = Geometry.Translate(geometry=byCoordinates, direction=scale)
byPoints = NurbsSurface.ByPoints(translate)
weights = NurbsSurface.Weights(byPoints)
watch = Watch(weights)
