# Dynamo graph ByControlPoints.dyn (Dynamo 1.0.1.1167)

code_block = CodeBlock { 0..25..#10; }
byCoordinates = Point.ByCoordinates(x=code_block, y=code_block, lacing=CrossProduct)
ZAxis = Vector.ZAxis()
count = Count(byCoordinates)
randomList = Math.RandomList(count)
code_block_2 = CodeBlock(x=randomList) { x*3; }
scale = Vector.Scale(vector=ZAxis, scale_factor=code_block_2)
translate = Geometry.Translate(geometry=byCoordinates, direction=scale)
code_block_3 = CodeBlock { 3; 3; }
byControlPoints = NurbsSurface.ByControlPoints(controlVertices=translate, uDegree=code_block_3.out0, vDegree=code_block_3.out1)
