# Dynamo graph DegreeV.dyn (Dynamo 1.1.0.2093)

code_block = CodeBlock { 0..10..#20; }
code_block_2 = CodeBlock(x=code_block) { x*2; }
byCoordinates = Point.ByCoordinates(x=code_block_2, y=code_block_2, lacing=CrossProduct)
ZAxis = Vector.ZAxis()
count = Count(byCoordinates)
randomList = Math.RandomList(count)
scale = Vector.Scale(vector=ZAxis, scale_factor=randomList)
translate = Geometry.Translate(geometry=byCoordinates, direction=scale)
integer_slider = IntegerSlider(2, range=1..3 step 1)
integer_slider_2 = IntegerSlider(3, range=1..3 step 1)
byPoints = NurbsSurface.ByPoints(translate, integer_slider, integer_slider_2)
degreeV = NurbsSurface.DegreeV(byPoints)
watch = Watch(degreeV)
