# Dynamo graph IsPeriodicInU.dyn (Dynamo 1.1.0.2093)

code_block = CodeBlock { 0..10..#20; }
code_block_2 = CodeBlock(x=code_block) { x*2; }
byCoordinates = Point.ByCoordinates(x=code_block_2, y=code_block_2, lacing=CrossProduct)
ZAxis = Vector.ZAxis()
count = Count(byCoordinates)
randomList = Math.RandomList(count)
scale = Vector.Scale(vector=ZAxis, scale_factor=randomList)
translate = Geometry.Translate(geometry=byCoordinates, direction=scale)
byPoints = NurbsSurface.ByPoints(translate)
isPeriodicInU = NurbsSurface.IsPeriodicInU(byPoints)
watch = Watch(isPeriodicInU)
