# Dynamo graph IsRational.dyn (Dynamo 1.1.0.2093)

code_block = CodeBlock { Math.RandomList(4)*10; Math.RandomList(4)*10; Math.RandomList(4)*10; }
byCoordinates = Point.ByCoordinates(x=code_block.out0, y=code_block.out1, z=code_block.out2)
boolean = BoolSelector(true)
byPoints = NurbsCurve.ByPoints(byCoordinates, boolean)
byPatch = Surface.ByPatch(byPoints)
approximateWithTolerance = Surface.ApproximateWithTolerance(byPatch)
isRational = NurbsSurface.IsRational(approximateWithTolerance)
watch = Watch(isRational)
