# Dynamo graph ToCoordinateSystem.dyn (Dynamo 1.0.0.1180)

code_block = CodeBlock { 9; }
randomList = Math.RandomList(code_block)
formula = Formula("x*5", x=randomList)
randomList_2 = Math.RandomList(code_block)
formula_2 = Formula("y*5", y=randomList_2)
randomList_3 = Math.RandomList(code_block)
formula_3 = Formula("z*5", z=randomList_3)
byCoordinates = Point.ByCoordinates(x=formula, y=formula_2, z=formula_3)
byBestFitThroughPoints = Plane.ByBestFitThroughPoints(byCoordinates)
toCoordinateSystem = Plane.ToCoordinateSystem(byBestFitThroughPoints)
