# Dynamo graph ByOriginNormal.dyn (Dynamo 1.0.0.1180)

code_block = CodeBlock { 5; 1; -3; }
byCoordinates = Point.ByCoordinates(x=code_block.out0, y=code_block.out1, z=code_block.out2)
YAxis = Vector.YAxis()
byOriginNormal = Plane.ByOriginNormal(origin=byCoordinates, normal=YAxis)
