# Dynamo graph ByThreePoints.dyn (Dynamo 1.0.0.1180)

code_block = CodeBlock { 5; 1; -3; }
byCoordinates = Point.ByCoordinates(x=code_block.out0, y=code_block.out1, z=code_block.out2)
code_block_2 = CodeBlock { 1; -3; 2; }
byCoordinates_2 = Point.ByCoordinates(x=code_block_2.out0, y=code_block_2.out1, z=code_block_2.out2)
code_block_3 = CodeBlock { 0; 7; -4; }
byCoordinates_3 = Point.ByCoordinates(x=code_block_3.out0, y=code_block_3.out1, z=code_block_3.out2)
byThreePoints = Plane.ByThreePoints(byCoordinates, byCoordinates_2, byCoordinates_3)
