# Dynamo graph Add.dyn (Dynamo 1.0.0.1180)

code_block = CodeBlock { 1; 5; 1; }
byCoordinates = Point.ByCoordinates(x=code_block.out0, y=code_block.out1, z=code_block.out2)
XAxis = Vector.XAxis()
add = Point.Add(point=byCoordinates, vectorToAdd=XAxis)
