# Dynamo graph AsVector.dyn (Dynamo 1.0.0.1180)

code_block = CodeBlock { 1; 5; 1; }
byCoordinates = Point.ByCoordinates(x=code_block.out0, y=code_block.out1, z=code_block.out2)
byOrigin = CoordinateSystem.ByOrigin(byCoordinates)
number_slider = DoubleSlider(90, range=0..360 step 30)
number_slider_2 = DoubleSlider(70, range=0..180 step 10)
number_slider_3 = DoubleSlider(8, range=0..10 step 1)
bySphericalCoordinates = Point.BySphericalCoordinates(byOrigin, number_slider, number_slider_2, number_slider_3, lacing=CrossProduct)
asVector = Point.AsVector(bySphericalCoordinates)
