# Dynamo graph PruneDuplicates.dyn (Dynamo 1.0.0.1180)

integer_slider = IntegerSlider(38, range=0..100 step 1)
randomList = Math.RandomList(integer_slider)
code_block = CodeBlock(x=randomList) { x*9; }
randomList_2 = Math.RandomList(integer_slider)
code_block_2 = CodeBlock(x=randomList_2) { x*9; }
byCoordinates = Point.ByCoordinates(x=code_block, y=code_block_2)
code_block_3 = CodeBlock { 1; }
pruneDuplicates = Point.PruneDuplicates(points=byCoordinates, tolerance=code_block_3)
