# Dynamo graph ByCartesianCoordinates.dyn (Dynamo 1.0.1.1167)

origin = Point.Origin()
XAxis = Vector.XAxis()
ZAxis = Vector.ZAxis()
YAxis = Vector.YAxis()
byOriginVectors = CoordinateSystem.ByOriginVectors(origin=origin, xAxis=XAxis, yAxis=ZAxis, zAxis=YAxis)
number_slider = DoubleSlider(2, range=0..10 step 1)
number_slider_2 = DoubleSlider(4, range=1..10 step 1)
number_slider_3 = DoubleSlider(3, range=0..10 step 1)
code_block = CodeBlock(a=number_slider, b=number_slider_2, c=number_slider_3) { 0..a..1; 0..10..#b; 0..c..1; }
byCartesianCoordinates = Point.ByCartesianCoordinates(byOriginVectors, code_block.out0, code_block.out1, code_block.out2, lacing=CrossProduct)
