# Dynamo graph ByCoordinates (x, y, z).dyn (Dynamo 1.1.0.2093)

code_block = CodeBlock { 2; }
code_block_2 = CodeBlock { 3; }
code_block_3 = CodeBlock { 4; }
byCoordinates = Point.ByCoordinates(x=code_block, y=code_block_2, z=code_block_3)
