# Dynamo graph ByCoordinates.dyn (Dynamo 1.0.1.1167)

grid_bounds_xy = DoubleSlider(61, range=0..100 step 1)
grid_spacing = DoubleSlider(2, range=1..5 step 0.1)
code_block = CodeBlock(a=grid_bounds_xy, b=grid_spacing) { 0..a..b; }
byCoordinates = Point.ByCoordinates(x=code_block, y=code_block, lacing=CrossProduct)
