# Dynamo graph ByCoordinates_crossReference.dyn (Dynamo 1.0.1.1167)

number_slider = DoubleSlider(1, range=0..100 step 0.1)
number_slider_2 = DoubleSlider(1, range=0..100 step 0.1)
byCoordinates = Point.ByCoordinates(x=number_slider, y=number_slider_2, lacing=CrossProduct)
