# Dynamo graph CloseWithLine.dyn (Dynamo 1.0.0.1180)

integer_slider = IntegerSlider(4, range=0..20 step 1)
randomList = Math.RandomList(integer_slider)
code_block = CodeBlock(x=randomList) { x*10; }
randomList_2 = Math.RandomList(integer_slider)
code_block_2 = CodeBlock(x=randomList_2) { x*10; }
randomList_3 = Math.RandomList(integer_slider)
code_block_3 = CodeBlock(x=randomList_3) { x*10; }
byCoordinates = Point.ByCoordinates(x=code_block, y=code_block_2, z=code_block_3)
boolean = BoolSelector(false)
byPoints = PolyCurve.ByPoints(points=byCoordinates, connectLastToFirst=boolean)
closeWithLine = PolyCurve.CloseWithLine(byPoints)
