# Dynamo graph CloseWithLineAndTangentArcs.dyn (Dynamo 1.1.0.2093)

code_block = CodeBlock { 2; }
code_block_2 = CodeBlock { -3; }
byCoordinates = Point.ByCoordinates(x=code_block, y=code_block_2)
code_block_3 = CodeBlock { 4; }
byCoordinates_2 = Point.ByCoordinates(x=code_block_3, y=code_block)
byCoordinates_3 = Point.ByCoordinates(x=code_block_2, y=code_block_3)
create = List.Create(byCoordinates, byCoordinates_2, byCoordinates_3)
byPoints = PolyCurve.ByPoints(points=create)
number_slider = DoubleSlider(0.9, range=0.1..4 step 0.1)
number_slider_2 = DoubleSlider(1.2, range=0.1..4 step 0.1)
closeWithLineAndTangentArcs = PolyCurve.CloseWithLineAndTangentArcs(byPoints, number_slider, number_slider_2)
