# Dynamo graph CurveAtIndex.dyn (Dynamo 1.0.0.1180)

integer_slider = IntegerSlider(6, range=0..20 step 1)
randomList = Math.RandomList(integer_slider)
code_block = CodeBlock(x=randomList) { x*10; }
randomList_2 = Math.RandomList(integer_slider)
code_block_2 = CodeBlock(x=randomList_2) { x*10; }
byCoordinates = Point.ByCoordinates(x=code_block, y=code_block_2)
boolean = BoolSelector(false)
byPoints = PolyCurve.ByPoints(points=byCoordinates, connectLastToFirst=boolean)
integer_slider_2 = IntegerSlider(1, range=0..10 step 1)
boolean_2 = BoolSelector(false)
curveAtIndex = PolyCurve.CurveAtIndex(byPoints, integer_slider_2, boolean_2)
