# Dynamo graph ExtendWithEllipse.dyn (Dynamo 1.1.0.2093)

code_block = CodeBlock { pt1 = Point.ByCoordinates(4,2); pt2 = Point.ByCoordinates(-3,4); {pt1, pt2}; }
byPoints = PolyCurve.ByPoints(points=code_block.out2)
length = DoubleSlider(17.7, range=0.1..100 step 0.1)
radius_1 = DoubleSlider(8.7, range=0.1..100 step 0.1)
radius_2 = DoubleSlider(1.8, range=0.1..100 step 0.1)
code_block_2 = CodeBlock { 1; }
boolean = BoolSelector(true)
extendWithEllipse = PolyCurve.ExtendWithEllipse(byPoints, length, radius_1, radius_2, code_block_2, boolean)
