# Dynamo graph ExtendwithArc.dyn (Dynamo 1.0.0.1180)

integer_slider = IntegerSlider(6, range=0..20 step 1)
randomList = Math.RandomList(integer_slider)
code_block = CodeBlock(x=randomList) { x*10; }
randomList_2 = Math.RandomList(integer_slider)
code_block_2 = CodeBlock(x=randomList_2) { x*10; }
byCoordinates = Point.ByCoordinates(x=code_block, y=code_block_2)
boolean = BoolSelector(false)
byPoints = PolyCurve.ByPoints(points=byCoordinates, connectLastToFirst=boolean)
number_slider = DoubleSlider(13.1, range=0..20 step 0.1)
number_slider_2 = DoubleSlider(6.3, range=0..20 step 0.1)
boolean_2 = BoolSelector(false)
extendWithArc = PolyCurve.ExtendWithArc(byPoints, number_slider, number_slider_2, boolean_2)
