# Dynamo graph Fillet.dyn (Dynamo 1.1.0.2093)

code_block = CodeBlock()
# ---------- code_block.designscript (5 lines) ----------
pt1=Point.ByCoordinates(2,8,0);
pt2=Point.ByCoordinates(10,8,0);
pt3=Point.ByCoordinates(8,2,0);
pt4=Point.ByCoordinates(1,2,0);
{pt1,pt2,pt3,pt4};
# ----------------------------------------
boolean = BoolSelector(true)
byPoints = PolyCurve.ByPoints(points=code_block.out4, connectLastToFirst=boolean)
number_slider = DoubleSlider(1.81, range=0.1..2 step 0.01)
boolean_2 = BoolSelector(false)
fillet = PolyCurve.Fillet(byPoints, number_slider, boolean_2)
