# Dynamo graph Offset.dyn (Dynamo 1.0.0.1180)

integer_slider = IntegerSlider(3, range=0..20 step 1)
randomList = Math.RandomList(integer_slider)
code_block = CodeBlock(x=randomList) { x*10; }
randomList_2 = Math.RandomList(integer_slider)
code_block_2 = CodeBlock(x=randomList_2) { x*10; }
byCoordinates = Point.ByCoordinates(x=code_block, y=code_block_2)
boolean = BoolSelector(false)
byPoints = PolyCurve.ByPoints(points=byCoordinates, connectLastToFirst=boolean)
number_slider = DoubleSlider(3.5, range=0..20 step 0.1)
boolean_2 = BoolSelector(true)
offset = PolyCurve.Offset(byPoints, number_slider, boolean_2)
