# Dynamo graph ByJoinedCurves.dyn (Dynamo 1.0.1.1167)

code_block = CodeBlock { 1; 3; }
byCoordinates = Point.ByCoordinates(x=code_block.out0, y=code_block.out1)
number = DoubleInput(5)
byCenterPointRadius = Circle.ByCenterPointRadius(centerPoint=byCoordinates, radius=number)
regularPolygon = Polygon.RegularPolygon(circle=byCenterPointRadius, numberSides=number)
explode = Geometry.Explode(regularPolygon)
byJoinedCurves = PolyCurve.ByJoinedCurves(explode)
