# Dynamo graph ByPoints.dyn (Dynamo 1.0.1.1167)

code_block = CodeBlock { 1; 3; }
byCoordinates = Point.ByCoordinates(x=code_block.out0, y=code_block.out1)
number = DoubleInput(5)
byCenterPointRadius = Circle.ByCenterPointRadius(centerPoint=byCoordinates, radius=number)
integer_slider = IntegerSlider(9, range=3..15 step 1)
code_block_2 = CodeBlock(a=integer_slider) { 0..1..#a; }
pointAtParameter = Curve.PointAtParameter(curve=byCenterPointRadius, param=code_block_2)
boolean = BoolSelector(false)
byPoints = PolyCurve.ByPoints(points=pointAtParameter, connectLastToFirst=boolean)
