# Dynamo graph ByThickeningCurve.dyn (Dynamo 1.0.1.1167)

code_block = CodeBlock { 6; }
randomList = Math.RandomList(code_block)
code_block_2 = CodeBlock(x=randomList) { x*10; }
sort = List.Sort(code_block_2)
randomList_2 = Math.RandomList(code_block)
code_block_3 = CodeBlock(x=randomList_2) { x*10; }
sort_2 = List.Sort(code_block_3)
byCoordinates = Point.ByCoordinates(x=sort, y=sort_2)
byControlPoints = NurbsCurve.ByControlPoints(byCoordinates)
number_slider = DoubleSlider(0.7, range=0..1 step 0.1)
firstItem = List.FirstItem(byCoordinates)
lastItem = List.LastItem(byCoordinates)
byTwoPoints = Vector.ByTwoPoints(start=firstItem, end=lastItem)
byThickeningCurve = PolyCurve.ByThickeningCurve(curve=byControlPoints, thickness=number_slider, nor=byTwoPoints)
