# Dynamo graph Chamfer.dyn (Dynamo 1.1.0.2093)

origin = Point.Origin()
code_block = CodeBlock { 4; }
byCenterPointRadius = Circle.ByCenterPointRadius(centerPoint=origin, radius=code_block)
extrudeAsSolid = Curve.ExtrudeAsSolid(byCenterPointRadius, code_block)
edges = Face.Edges(extrudeAsSolid)
code_block_2 = CodeBlock { 0.5; }
chamfer = PolySurface.Chamfer(extrudeAsSolid, edges, code_block_2)
