# Dynamo graph EdgeCount.dyn (Dynamo 1.1.0.2093)

code_block = CodeBlock { 5; }
byCenterPointRadius = Circle.ByCenterPointRadius(radius=code_block)
code_block_2 = CodeBlock { 6; }
regularPolygon = Polygon.RegularPolygon(circle=byCenterPointRadius, numberSides=code_block_2)
code_block_3 = CodeBlock { 3; }
extrudeAsSolid = Curve.ExtrudeAsSolid(regularPolygon, code_block_3)
bySolid = PolySurface.BySolid(extrudeAsSolid)
edgeCount = PolySurface.EdgeCount(bySolid)
watch = Watch(edgeCount)
edges = Topology.Edges(extrudeAsSolid)
curveGeometry = Edge.CurveGeometry(edges)
code_block_4 = CodeBlock(geometry=bySolid) { color = Color.ByARGB(200,141,198,217); Display.ByGeometryColor(geometry, color); }
