# Dynamo graph ExtractSolids.dyn (Dynamo 1.1.0.2093)

code_block = CodeBlock { 5; }
byCenterPointRadius = Circle.ByCenterPointRadius(radius=code_block)
byPatch = Surface.ByPatch(byCenterPointRadius)
ZAxis = Vector.ZAxis()
code_block_2 = CodeBlock { 3; }
translate = Geometry.Translate(geometry=byPatch, direction=ZAxis, distance=code_block_2)
extrude = Curve.Extrude(curve=byCenterPointRadius, distance=code_block_2)
create = List.Create(translate, byPatch, extrude)
byJoinedSurfaces = PolySurface.ByJoinedSurfaces(create)
extractSolids = PolySurface.ExtractSolids(byJoinedSurfaces)
