# Dynamo graph LocateSurfacesByLine.dyn (Dynamo 1.1.0.2093)

code_block = CodeBlock { 3; }
byCenterPointRadius = Circle.ByCenterPointRadius(radius=code_block)
code_block_2 = CodeBlock { 6; }
regularPolygon = Polygon.RegularPolygon(circle=byCenterPointRadius, numberSides=code_block_2)
extrudeAsSolid = Curve.ExtrudeAsSolid(regularPolygon, code_block_2)
bySolid = PolySurface.BySolid(extrudeAsSolid)
code_block_3 = CodeBlock { Point.ByCoordinates(6,-6,3); Vector.ByCoordinates(-6,6,0); 20; }
byStartPointDirectionLength = Line.ByStartPointDirectionLength(startPoint=code_block_3.out0, direction=code_block_3.out1, length=code_block_3.out2)
locateSurfacesByLine = PolySurface.LocateSurfacesByLine(bySolid, byStartPointDirectionLength)
watch = Watch(locateSurfacesByLine)
code_block_4 = CodeBlock(geometry=bySolid) { color = Color.ByARGB(150,141,198,217); Display.ByGeometryColor(geometry, color); }
