# Dynamo graph LocateSurfacesByPoint.dyn (Dynamo 1.1.0.2093)

code_block = CodeBlock { 3; }
byCenterPointRadius = Circle.ByCenterPointRadius(radius=code_block)
code_block_2 = CodeBlock { 6; }
regularPolygon = Polygon.RegularPolygon(circle=byCenterPointRadius, numberSides=code_block_2)
extrudeAsSolid = Curve.ExtrudeAsSolid(regularPolygon, code_block_2)
bySolid = PolySurface.BySolid(extrudeAsSolid)
code_block_3 = CodeBlock { Point.ByCoordinates(-6,1,1); Vector.ByCoordinates(1,0,0.5); }
locateSurfacesByPoint = PolySurface.LocateSurfacesByPoint(bySolid, code_block_3.out0, code_block_3.out1)
watch = Watch(locateSurfacesByPoint)
byStartPointDirectionLength = Line.ByStartPointDirectionLength(startPoint=code_block_3.out0, direction=code_block_3.out1)
code_block_4 = CodeBlock(geometry=bySolid) { color = Color.ByARGB(200,141,198,217); Display.ByGeometryColor(geometry, color); }
