# Dynamo graph Surfaces.dyn (Dynamo 1.1.0.2093)

code_block = CodeBlock { 3; }
byCenterPointRadius = Circle.ByCenterPointRadius(radius=code_block)
code_block_2 = CodeBlock { 6; }
regularPolygon = Polygon.RegularPolygon(circle=byCenterPointRadius, numberSides=code_block_2)
extrudeAsSolid = Curve.ExtrudeAsSolid(regularPolygon, code_block_2)
bySolid = PolySurface.BySolid(extrudeAsSolid)
surfaces = PolySurface.Surfaces(bySolid)
watch = Watch(surfaces)
watch_2 = Watch(bySolid)
code_block_3 = CodeBlock(geometry=surfaces) { color = Color.ByARGB(200,141,198,217); Display.ByGeometryColor(geometry, color); }
