# Dynamo graph UnconnectedBoundaries.dyn (Dynamo 1.1.0.2093)

code_block = CodeBlock { Point.ByCoordinates(0,0,0); Point.ByCoordinates(0,0,6); }
create = List.Create(code_block.out0, code_block.out1)
code_block_2 = CodeBlock { 3; }
byCenterPointRadius = Circle.ByCenterPointRadius(centerPoint=create, radius=code_block_2)
code_block_3 = CodeBlock { 6; }
regularPolygon = Polygon.RegularPolygon(circle=byCenterPointRadius, numberSides=code_block_3)
byLoft = PolySurface.ByLoft(regularPolygon)
unconnectedBoundaries = PolySurface.UnconnectedBoundaries(byLoft)
code_block_4 = CodeBlock(geometry=byLoft) { color = Color.ByARGB(200,141,198,217); Display.ByGeometryColor(geometry, color); }
