# Dynamo graph VertexCount.dyn (Dynamo 1.1.0.2093)

code_block = CodeBlock { 3; }
byCenterPointRadius = Circle.ByCenterPointRadius(radius=code_block)
code_block_2 = CodeBlock { 6; }
regularPolygon = Polygon.RegularPolygon(circle=byCenterPointRadius, numberSides=code_block_2)
extrudeAsSolid = Curve.ExtrudeAsSolid(regularPolygon, code_block_2)
bySolid = PolySurface.BySolid(extrudeAsSolid)
vertexCount = PolySurface.VertexCount(bySolid)
watch = Watch(vertexCount)
code_block_3 = CodeBlock(geometry=bySolid) { color = Color.ByARGB(100,141,198,217); Display.ByGeometryColor(geometry, color); }
vertices = Face.Vertices(bySolid)
pointGeometry = Vertex.PointGeometry(vertices)
