# Dynamo graph ByJoinedSurfaces.dyn (Dynamo 1.1.0.2093)

origin = Point.Origin()
byCenterPointRadius = Circle.ByCenterPointRadius(centerPoint=origin)
code_block = CodeBlock { 3; }
extrude = Curve.Extrude(curve=byCenterPointRadius, distance=code_block)
byCoordinates = Point.ByCoordinates(z=code_block)
byCenterPointRadius_2 = Circle.ByCenterPointRadius(centerPoint=byCoordinates)
create = List.Create(byCenterPointRadius, byCenterPointRadius_2)
byPatch = Surface.ByPatch(create)
create_2 = List.Create(extrude, byPatch)
byJoinedSurfaces = PolySurface.ByJoinedSurfaces(create_2)
