# Dynamo graph ByLoft (crossSections).dyn (Dynamo 1.1.0.2093)

origin = Point.Origin()
byCenterPointRadius = Circle.ByCenterPointRadius(centerPoint=origin)
code_block = CodeBlock { 5; }
byCoordinates = Point.ByCoordinates(z=code_block)
code_block_2 = CodeBlock { 2; }
byCenterPointRadius_2 = Circle.ByCenterPointRadius(centerPoint=byCoordinates, radius=code_block_2)
create = List.Create(byCenterPointRadius, byCenterPointRadius_2)
byLoft = PolySurface.ByLoft(create)
