# Dynamo graph ByLoft (crossSections, guideCurve).dyn (Dynamo 1.1.0.2093)

origin = Point.Origin()
byCenterPointRadius = Circle.ByCenterPointRadius(centerPoint=origin)
code_block = CodeBlock { 5; }
byCoordinates = Point.ByCoordinates(z=code_block)
code_block_2 = CodeBlock { 2; }
byCenterPointRadius_2 = Circle.ByCenterPointRadius(centerPoint=byCoordinates, radius=code_block_2)
create = List.Create(byCenterPointRadius, byCenterPointRadius_2)
code_block_3 = CodeBlock { 1; }
code_block_4 = CodeBlock { 2; }
byCoordinates_2 = Point.ByCoordinates(y=code_block_3, z=code_block_4)
byThreePoints = Arc.ByThreePoints(firstPoint=origin, secondPoint=byCoordinates_2, thirdPoint=byCoordinates)
byLoft = PolySurface.ByLoft(create, byThreePoints)
