# Dynamo graph BySolid.dyn (Dynamo 1.1.0.2093)

code_block = CodeBlock { 5; }
byCenterPointRadius = Circle.ByCenterPointRadius(radius=code_block)
code_block_2 = CodeBlock { 6; }
regularPolygon = Polygon.RegularPolygon(circle=byCenterPointRadius, numberSides=code_block_2)
code_block_3 = CodeBlock { 3; }
extrudeAsSolid = Curve.ExtrudeAsSolid(regularPolygon, code_block_3)
bySolid = PolySurface.BySolid(extrudeAsSolid)
code_block_4 = CodeBlock { c1 = Color.ByARGB(200,227,136,200); c2 = Color.ByARGB(200,100,136,200); {c1, c2}; }
bySurfaceColors = Display.Display.BySurfaceColors(bySolid, code_block_4.out2)
