# Dynamo graph BySweep (rail, profile).dyn (Dynamo 1.1.0.2093)

origin = Point.Origin()
code_block = CodeBlock { 4; 0; 120; }
ZAxis = Vector.ZAxis()
byCenterPointRadiusAngle = Arc.ByCenterPointRadiusAngle(center=origin, radius=code_block.out0, startAngle=code_block.out1, endAngle=code_block.out2, normal=ZAxis)
code_block_2 = CodeBlock { Point.ByCoordinates(2,0,4); Point.ByCoordinates(4,0,0); Point.ByCoordinates(4,0,8); }
byCenterPointStartPointEndPoint = Arc.ByCenterPointStartPointEndPoint(code_block_2.out0, code_block_2.out1, code_block_2.out2)
bySweep = PolySurface.BySweep(byCenterPointRadiusAngle, byCenterPointStartPointEndPoint)
