# Dynamo graph SelfIntersections.dyn (Dynamo 1.0.0.1180)

number_slider = DoubleSlider(7, range=3..10 step 1)
randomList = Math.RandomList(number_slider)
code_block = CodeBlock(x=randomList) { x*360; }
randomList_2 = Math.RandomList(number_slider)
code_block_2 = CodeBlock(x=randomList_2) { x*5; }
byCylindricalCoordinates = Point.ByCylindricalCoordinates(arg1=code_block, arg3=code_block_2)
byPoints = Polygon.ByPoints(byCylindricalCoordinates)
selfIntersections = Polygon.SelfIntersections(byPoints)
