# Dynamo graph ByPoints.dyn (Dynamo 1.0.1.1167)

number_slider = DoubleSlider(3, range=3..10 step 1)
randomList = Math.RandomList(number_slider)
randomList_2 = Math.RandomList(number_slider)
byCoordinates = Point.ByCoordinates(x=randomList, y=randomList_2)
byPoints = Polygon.ByPoints(byCoordinates)
