# Dynamo graph RegularPolygon.dyn (Dynamo 1.0.1.1167)

number_slider = DoubleSlider(6, range=3..10 step 1)
randomList = Math.RandomList(number_slider)
code_block = CodeBlock(x=randomList) { x*20; }
randomList_2 = Math.RandomList(number_slider)
code_block_2 = CodeBlock(x=randomList_2) { x*20; }
byCoordinates = Point.ByCoordinates(x=code_block, y=code_block_2)
byBestFitThroughPoints = Circle.ByBestFitThroughPoints(byCoordinates)
regularPolygon = Polygon.RegularPolygon(circle=byBestFitThroughPoints, numberSides=number_slider)
number_slider_2 = DoubleSlider(4, range=3..10 step 1)
randomList_3 = Math.RandomList(number_slider_2)
code_block_3 = CodeBlock(x=randomList_3) { x*20; }
randomList_4 = Math.RandomList(number_slider_2)
code_block_4 = CodeBlock(x=randomList_4) { x*20; }
byCoordinates_2 = Point.ByCoordinates(x=code_block_3, y=code_block_4)
byPoints = Polygon.ByPoints(byCoordinates_2)
