# Dynamo graph ByCornerPoints.dyn (Dynamo 1.0.1.1167)

number_slider = DoubleSlider(1.4, range=1..10 step 0.1)
number_slider_2 = DoubleSlider(4.1, range=1..10 step 0.1)
code_block = CodeBlock(x=number_slider, y=number_slider_2) { x; y; }
byCoordinates = Point.ByCoordinates(x=code_block.y, y=code_block.y)
byCoordinates_2 = Point.ByCoordinates(x=code_block.y, y=code_block.x)
byCoordinates_3 = Point.ByCoordinates(x=code_block.x, y=code_block.x)
byCoordinates_4 = Point.ByCoordinates(x=code_block.x, y=code_block.y)
byCornerPoints = Rectangle.ByCornerPoints(byCoordinates, byCoordinates_2, byCoordinates_3, byCoordinates_4)
join = List.Join(byCoordinates, byCoordinates_2, byCoordinates_3, byCoordinates_4)
byCornerPoints_2 = Rectangle.ByCornerPoints(join)
