# Dynamo graph ByWidthLength.dyn (Dynamo 1.0.1.1167)

number_slider = DoubleSlider(4.4, range=1..10 step 0.1)
number_slider_2 = DoubleSlider(2.8, range=1..10 step 0.1)
byWidthLength = Rectangle.ByWidthLength(width=number_slider, length=number_slider_2)
