# Dynamo graph ByWidthLength_cwl.dyn (Dynamo 1.0.1.1167)

origin = Point.Origin()
number_slider = DoubleSlider(0.8, range=0..1 step 0.1)
number_slider_2 = DoubleSlider(0.5, range=0..1 step 0.1)
code_block = CodeBlock(a=number_slider, b=number_slider_2) { Autodesk.DesignScript.Geometry.Vector.ByCoordinates(a,b,0); Autodesk.DesignScript.Geometry.Vector.ByCoordinates(0,1,0); }
byOriginVectors = CoordinateSystem.ByOriginVectors(origin=origin, xAxis=code_block.out0, yAxis=code_block.out1)
number_slider_3 = DoubleSlider(6.8, range=0..100 step 0.1)
number_slider_4 = DoubleSlider(2.7, range=0..100 step 0.1)
byWidthLength = Rectangle.ByWidthLength(cs=byOriginVectors, width=number_slider_3, length=number_slider_4)
