# Dynamo graph ByWidthLength_pwl.dyn (Dynamo 1.0.0.1180)

YZ = Plane.YZ()
number_slider = DoubleSlider(6.8, range=0..100 step 0.1)
number_slider_2 = DoubleSlider(2.7, range=0..100 step 0.1)
byWidthLength = Rectangle.ByWidthLength(plane=YZ, width=number_slider, length=number_slider_2)
