# Dynamo graph Height.dyn (Dynamo 1.0.0.1180)

number_slider = DoubleSlider(3.7, range=1..10 step 0.1)
byCoordinates = Point.ByCoordinates(x=number_slider, y=number_slider)
number_slider_2 = DoubleSlider(1.4, range=1..10 step 0.1)
byCoordinates_2 = Point.ByCoordinates(x=number_slider, y=number_slider_2)
byCoordinates_3 = Point.ByCoordinates(x=number_slider_2, y=number_slider_2)
byCoordinates_4 = Point.ByCoordinates(x=number_slider_2, y=number_slider)
byCornerPoints = Rectangle.ByCornerPoints(byCoordinates, byCoordinates_2, byCoordinates_3, byCoordinates_4)
height = Rectangle.Height(byCornerPoints)
width = Rectangle.Width(byCornerPoints)
