# Dynamo graph Centroid.dyn (Dynamo 1.0.0.1180)

byCenterPointRadius = Circle.ByCenterPointRadius()
code_block = CodeBlock { 0..360..36; }
sin = Math.Sin(code_block)
code_block_2 = CodeBlock { 0..10..0.5; }
translate = Geometry.Translate(geometry=byCenterPointRadius, xTranslation=sin, zTranslation=code_block_2)
byLoft = Solid.ByLoft(translate)
centroid = Solid.Centroid(byLoft)
