# Dynamo graph DifferenceAll.dyn (Dynamo 1.0.0.1180)

byLengths = Cuboid.ByLengths()
number_slider = DoubleSlider(0.4, range=-3..3 step 0.1)
number_slider_2 = DoubleSlider(-0.2, range=-3..3 step 0.1)
code_block = CodeBlock { -1..1..0.5; }
byCoordinates = Point.ByCoordinates(x=number_slider, y=number_slider_2, z=code_block)
number_slider_3 = DoubleSlider(0.5, range=0..3 step 0.1)
byCenterPointRadius = Sphere.ByCenterPointRadius(centerPoint=byCoordinates, radius=number_slider_3)
differenceAll = Solid.DifferenceAll(byLengths, byCenterPointRadius)
