# Dynamo graph ProjectInputOnto.dyn (Dynamo 1.0.0.1180)

# group: Create Surface to Project Onto
byCenterPointRadius = Circle.ByCenterPointRadius()
code_block = CodeBlock { 0..360..36; }
sin = Math.Sin(code_block)
code_block_2 = CodeBlock { 0..10..0.5; }
translate = Geometry.Translate(geometry=byCenterPointRadius, xTranslation=sin, zTranslation=code_block_2)
byLoft = Solid.ByLoft(translate)

# group: Create Curve to Project
XZ = Plane.XZ()
byPlaneRadius = Circle.ByPlaneRadius(plane=XZ)
code_block_3 = CodeBlock { 0; -2; 2; }
translate_2 = Geometry.Translate(geometry=byPlaneRadius, xTranslation=code_block_3.out0, yTranslation=code_block_3.out1, zTranslation=code_block_3.out2)

YAxis = Vector.YAxis()
projectInputOnto = Solid.ProjectInputOnto(byLoft, translate_2, YAxis)
