# Dynamo graph ThinShell.dyn (Dynamo 1.0.0.1180)

byLengths = Cuboid.ByLengths()
explode = Geometry.Explode(byLengths)
edges = Face.Edges(explode)
code_block = CodeBlock { 0; }
getItemAtIndex = List.GetItemAtIndex(list=edges, index=code_block)
number_slider = DoubleSlider(0.23, range=0..0.5 step 0.01)
chamfer = Solid.Chamfer(byLengths, getItemAtIndex, number_slider)
number_slider_2 = DoubleSlider(0.09, range=0..0.5 step 0.01)
number_slider_3 = DoubleSlider(0.24, range=0..0.5 step 0.01)
thinShell = Solid.ThinShell(chamfer, number_slider_2, number_slider_3)
