# Dynamo graph ByJoinedSurfaces.dyn (Dynamo 1.0.0.1180)

byCenterPointRadius = Circle.ByCenterPointRadius()
byPatch = Surface.ByPatch(byCenterPointRadius)
number_slider = DoubleSlider(2.1, range=0..10 step 0.1)
extrude = Curve.Extrude(curve=byCenterPointRadius, distance=number_slider)
translate = Geometry.Translate(geometry=byPatch, zTranslation=number_slider)
create = List.Create(byPatch, extrude, translate)
byJoinedSurfaces = Solid.ByJoinedSurfaces(create)
