# Dynamo graph ByLoft_guideCurve.dyn (Dynamo 1.0.0.1180)

code_block = CodeBlock { 2; }
byWidthLength = Rectangle.ByWidthLength(width=code_block)
code_block_2 = CodeBlock { -2; }
number_slider = DoubleSlider(5, range=0..10 step 0.1)
translate = Geometry.Translate(geometry=byWidthLength, xTranslation=code_block_2, zTranslation=number_slider)
create = List.Create(byWidthLength, translate)
code_block_3 = CodeBlock(z=number_slider) { 0..180..180/z; }
cos = Math.Cos(code_block_3)
code_block_4 = CodeBlock(x=cos) { x-2; }
code_block_5 = CodeBlock(z=number_slider) { 0..z..1; }
byCoordinates = Point.ByCoordinates(x=code_block_4, z=code_block_5)
byPoints = NurbsCurve.ByPoints(byCoordinates)
byLoft = Solid.ByLoft(create, byPoints)
