# Dynamo graph BySweep2Rails.dyn (Dynamo 1.1.0.2093)

code_block = CodeBlock { Point.ByCoordinates(-4,0,0); Point.ByCoordinates(-5,0,4); Vector.ZAxis(); }
byStartPointEndPointStartTangent = Arc.ByStartPointEndPointStartTangent(code_block.out0, code_block.out1, code_block.out2)
code_block_2 = CodeBlock { Point.ByCoordinates(4,0,0); Point.ByCoordinates(5,0,4); Vector.ZAxis(); }
byStartPointEndPointStartTangent_2 = Arc.ByStartPointEndPointStartTangent(code_block_2.out0, code_block_2.out1, code_block_2.out2)
code_block_3 = CodeBlock { 4; }
byCenterPointRadius = Circle.ByCenterPointRadius(radius=code_block_3)
bySweep2Rails = Solid.BySweep2Rails(byStartPointEndPointStartTangent, byStartPointEndPointStartTangent_2, byCenterPointRadius)
code_block_4 = CodeBlock(geometry=bySweep2Rails) { color = Color.ByARGB(100,141,198,217); Display.ByGeometryColor(geometry, color); }
