# Dynamo graph ByUnion.dyn (Dynamo 1.0.0.1180)

number_slider = DoubleSlider(0.4, range=-3..3 step 0.1)
number_slider_2 = DoubleSlider(-0.2, range=-3..3 step 0.1)
number_slider_3 = DoubleSlider(0.8, range=-3..3 step 0.1)
byCoordinates = Point.ByCoordinates(x=number_slider, y=number_slider_2, z=number_slider_3)
number_slider_4 = DoubleSlider(0.5, range=0..3 step 0.1)
byCenterPointRadius = Sphere.ByCenterPointRadius(centerPoint=byCoordinates, radius=number_slider_4)
byLengths = Cuboid.ByLengths()
create = List.Create(byCenterPointRadius, byLengths)
byUnion = Solid.ByUnion(create)
