# Dynamo graph Volume.dyn (Dynamo 1.0.0.1180)

byLengths = Cuboid.ByLengths()
explode = Geometry.Explode(byLengths)
edges = Face.Edges(explode)
code_block = CodeBlock { 0; }
getItemAtIndex = List.GetItemAtIndex(list=edges, index=code_block)
number_slider = DoubleSlider(0.23, range=0..0.5 step 0.01)
chamfer = Solid.Chamfer(byLengths, getItemAtIndex, number_slider)
volume = Solid.Volume(chamfer)
