# Dynamo graph ByCenterPointRadius.dyn (Dynamo 1.0.0.1180)

code_block = CodeBlock { 4; 2; -5; }
byCoordinates = Point.ByCoordinates(x=code_block.out0, y=code_block.out1, z=code_block.out2)
number_slider = DoubleSlider(5.5, range=0..100 step 0.1)
byCenterPointRadius = Sphere.ByCenterPointRadius(centerPoint=byCoordinates, radius=number_slider)
