# Dynamo graph CenterPoint.dyn (Dynamo 1.0.0.1180)

integer_slider = IntegerSlider(30, range=0..100 step 1)
randomList = Math.RandomList(integer_slider)
code_block = CodeBlock(x=randomList) { x*10; }
randomList_2 = Math.RandomList(integer_slider)
code_block_2 = CodeBlock(y=randomList_2) { y*10; }
randomList_3 = Math.RandomList(integer_slider)
code_block_3 = CodeBlock(z=randomList_3) { z*10; }
byCoordinates = Point.ByCoordinates(x=code_block, y=code_block_2, z=code_block_3)
byBestFit = Sphere.ByBestFit(byCoordinates)
centerPoint = Sphere.CenterPoint(byBestFit)
