# Dynamo graph ApproximateWithTolerance.dyn (Dynamo 1.0.0.1180)

number_slider = DoubleSlider(6, range=3..10 step 1)
code_block = CodeBlock(a=number_slider) { 0..360..360/(a-1); }
randomList = Math.RandomList(number_slider)
code_block_2 = CodeBlock(x=randomList) { x*5; }
randomList_2 = Math.RandomList(number_slider)
code_block_3 = CodeBlock(x=randomList_2) { x*5; }
byCylindricalCoordinates = Point.ByCylindricalCoordinates(arg1=code_block, arg2=code_block_2, arg3=code_block_3)
boolean = BoolSelector(true)
byPoints = NurbsCurve.ByPoints(byCylindricalCoordinates, boolean)
byPatch = Surface.ByPatch(byPoints)
approximateWithTolerance = Surface.ApproximateWithTolerance(byPatch)
