# Dynamo graph Join (surface, otherSurfaces).dyn (Dynamo 1.3.1.1736)

code_block = CodeBlock()
# ---------- code_block.designscript (8 lines) ----------
pt1 = Point.ByCoordinates(0,3,0);
pt2 = Point.ByCoordinates(1,4,0);
pt3 = Point.ByCoordinates(5,1,0);
pt4 = Point.ByCoordinates(3,0,0);
pts = {pt1, pt2, pt3, pt4};

pCurve = PolyCurve.ByPoints(pts, true);
pCurveFillet = PolyCurve.Fillet(pCurve, 0.5);
# ----------------------------------------
extrude = Curve.Extrude(code_block.pCurveFillet)
byPatch = Surface.ByPatch(code_block.pCurveFillet)
join = Surface.Join(extrude, byPatch)
