# Dynamo graph TrimWithEdgeLoops.dyn (Dynamo 1.1.0.2093)

trimmed_surface_geometry = DoubleSlider(0.3, range=-4..1 step 0.1)
code_block = CodeBlock(x=trimmed_surface_geometry)
# ---------- code_block.designscript (25 lines) ----------
//Surface to trim
Point.ByCoordinates(0,0,0);
6;
Vector.XAxis();

//Inner loop 1
pt1 = Point.ByCoordinates(0,3,4);
pt2 = Point.ByCoordinates(0,2,4);
pt3 = Point.ByCoordinates(0,x*-1,-2);
pt4 = Point.ByCoordinates(0,5,2);
pts = {pt1, pt2, pt3, pt4};
pCurve = PolyCurve.ByPoints(pts, true);
pFillet = PolyCurve.Fillet(pCurve, 0.25);

//Inner loop 2
pt5 = Point.ByCoordinates(0,-3,-4);
pt6 = Point.ByCoordinates(0,-2,-4);
pt7 = Point.ByCoordinates(0,x,2);
pt8 = Point.ByCoordinates(0,-5,-2);
pts2 = {pt5, pt6, pt7, pt8};
pCurve2 = PolyCurve.ByPoints(pts2, true);
pFillet2 = PolyCurve.Fillet(pCurve2, 0.25);

//Inner loops
loops = {pFillet, pFillet2};
# ----------------------------------------
byCenterPointRadiusNormal = Circle.ByCenterPointRadiusNormal(code_block.out0, code_block.out1, code_block.out2)
byPatch = Surface.ByPatch(byCenterPointRadiusNormal)
trimWithEdgeLoops = Surface.TrimWithEdgeLoops(byPatch, code_block.loops)
code_block_2 = CodeBlock(geometry=byPatch) { color = Color.ByARGB(100,141,198,217); Display.ByGeometryColor(geometry, color); }
