# Dynamo graph ByLoft.dyn (Dynamo 1.0.0.1180)

number_slider = DoubleSlider(9.2, range=0..20 step 0.1)
code_block = CodeBlock(a=number_slider) { Point.ByCoordinates(0, a, 0); Point.ByCoordinates(10, a, 0); }
byStartPointEndPoint = Line.ByStartPointEndPoint(startPoint=code_block.out0, endPoint=code_block.out1)
code_block_2 = CodeBlock { 0..10..1; }
number_slider_2 = DoubleSlider(2.9, range=0..100 step 0.1)
code_block_3 = CodeBlock { 0..360..36; }
code_block_4 = CodeBlock(a=number_slider_2, x=code_block_3) { a*Math.Sin(x); }
byCoordinates = Point.ByCoordinates(x=code_block_2, z=code_block_4)
byPoints = NurbsCurve.ByPoints(byCoordinates)
create = List.Create(byStartPointEndPoint, byPoints)
byLoft = Surface.ByLoft(create)
