# Dynamo graph ByRevolve.dyn (Dynamo 1.0.0.1180)

code_block = CodeBlock { 0..360..36; }
cos = Math.Cos(code_block)
code_block_2 = CodeBlock(x=cos) { x-2; }
code_block_3 = CodeBlock { 0..5..0.5; }
byCoordinates = Point.ByCoordinates(x=code_block_2, z=code_block_3)
byPoints = NurbsCurve.ByPoints(byCoordinates)
number_slider = DoubleSlider(66, range=0..360 step 1)
number_slider_2 = DoubleSlider(239, range=0..360 step 1)
byRevolve = Surface.ByRevolve(byPoints, arg3=number_slider, arg4=number_slider_2)
