# Dynamo graph BySweep.dyn (Dynamo 1.0.0.1180)

code_block = CodeBlock { 0..10..1; }
code_block_2 = CodeBlock { 0..360..36; }
sin = Math.Sin(code_block_2)
byCoordinates = Point.ByCoordinates(y=code_block, z=sin)
byPoints = NurbsCurve.ByPoints(byCoordinates)
origin = Point.Origin()
ZAxis = Vector.ZAxis()
code_block_3 = CodeBlock { -90; }
rotate = Geometry.Rotate(geometry=byPoints, origin=origin, axis=ZAxis, degrees=code_block_3)
bySweep = Surface.BySweep(byPoints, rotate)
