# Dynamo graph ClosedInV.dyn (Dynamo 1.1.0.2093)

code_block = CodeBlock { 5; }
byCenterPointRadius = Circle.ByCenterPointRadius(radius=code_block)
code_block_2 = CodeBlock { 3; }
extrude = Curve.Extrude(curve=byCenterPointRadius, distance=code_block_2)
closedInV = Surface.ClosedInV(extrude)
watch = Watch(closedInV)
