# Dynamo graph ByParametersOnSurface.dyn (Dynamo 1.1.0.2093)

code_block = CodeBlock { Math.RandomList(400); Math.RandomList(400); }
byCoordinates = UV.ByCoordinates(code_block.out0, code_block.out1)
code_block_2 = CodeBlock()
# ---------- code_block_2.designscript (6 lines) ----------
pt1 = Point.ByCoordinates(0,0);
pt2 = Point.ByCoordinates(8,0);
pt3 = Point.ByCoordinates(12,12);
pt4 = Point.ByCoordinates(6,6,4);
pt5 = Point.ByCoordinates(0,16,-2);
pts = {pt1,pt2,pt3,pt4, pt5};
# ----------------------------------------
boolean = BoolSelector(true)
byControlPoints = NurbsCurve.ByControlPoints(code_block_2.pts, arg2=boolean)
byPatch = Surface.ByPatch(byControlPoints)
byParametersOnSurface = Tessellation.Delaunay.ByParametersOnSurface(byCoordinates, byPatch)
