# Dynamo graph ByParametersOnSurface.dyn (Dynamo 1.1.0.2093)

code_block = CodeBlock { 50; }
randomList = Math.RandomList(code_block)
randomList_2 = Math.RandomList(code_block)
byCoordinates = UV.ByCoordinates(randomList, randomList_2)
code_block_2 = CodeBlock { 10; }
byWidthLength = Rectangle.ByWidthLength(width=code_block_2, length=code_block_2)
byPatch = Surface.ByPatch(byWidthLength)
byParametersOnSurface = Tessellation.Voronoi.ByParametersOnSurface(byCoordinates, byPatch)
intersect = Geometry.Intersect(geometry=byParametersOnSurface, other=byPatch)
