# Dynamo graph Edges.dyn (Dynamo 1.1.0.2093)

byCorners = Cuboid.ByCorners()
edges = Topology.Edges(byCorners)
watch = Watch(edges)
curveGeometry = Edge.CurveGeometry(watch)
code_block = CodeBlock(geometry=byCorners) { color = Color.ByARGB(100,141,198,217); Display.ByGeometryColor(geometry, color); }
