# Dynamo graph Faces.dyn (Dynamo 1.1.0.2093)

code_block = CodeBlock { cube = Cuboid.ByLengths(4,4,4); PolySurface.BySolid(cube); }
edges = Face.Edges(code_block.out1)
code_block_2 = CodeBlock { 1.2; }
chamfer = PolySurface.Chamfer(code_block.out1, edges, code_block_2)
faces = Topology.Faces(chamfer)
watch = Watch(faces)
edges_2 = Face.Edges(chamfer)
code_block_3 = CodeBlock { 0.3; }
chamfer_2 = PolySurface.Chamfer(chamfer, edges_2, code_block_3)
faces_2 = Topology.Faces(chamfer_2)
watch_2 = Watch(faces_2)
count = List.Count(faces_2)
count_2 = List.Count(faces)
code_block_4 = CodeBlock(geo=chamfer_2) { vect = Vector.XAxis(); dist = 5; Geometry.Translate(geo, vect, dist); }
