# Dynamo graph Vertices.dyn (Dynamo 1.1.0.2093)

byCorners = Cuboid.ByCorners()
code_block = CodeBlock(geometry=byCorners) { color = Color.ByARGB(100,141,198,217); Display.ByGeometryColor(geometry, color); }
vertices = Topology.Vertices(byCorners)
watch = Watch(vertices)
pointGeometry = Vertex.PointGeometry(watch)
