# Dynamo graph U.dyn (Dynamo 1.1.0.2093)

code_block = CodeBlock()
# ---------- code_block.designscript (5 lines) ----------
x = Math.RandomList(4);
y = Math.RandomList(4);
z = Math.RandomList(4);
pts = Point.ByCoordinates(x*10,y*10,z*10);
NurbsCurve.ByPoints(pts, true);
# ----------------------------------------
byPatch = Surface.ByPatch(code_block.out4)
approximateWithTolerance = Surface.ApproximateWithTolerance(byPatch)
integer_slider = IntegerSlider(468, range=0..500 step 1)
code_block_2 = CodeBlock(nSurface=approximateWithTolerance, uv_Index=integer_slider)
# ---------- code_block_2.designscript (3 lines) ----------
controlPts = NurbsSurface.ControlPoints(nSurface);
controlPts = List.Flatten(controlPts, 1);
controlPt = List.GetItemAtIndex(controlPts, uv_Index);
# ----------------------------------------
UVParameterAtPoint = Surface.UVParameterAtPoint(approximateWithTolerance, code_block_2.out1)
U = UV.U(UVParameterAtPoint)
watch = Watch(U)
watch_2 = Watch(UVParameterAtPoint)
