# Dynamo graph Add.dyn (Dynamo 1.1.0.2093)

origin = Point.Origin()
ZAxis = Vector.ZAxis()
XAxis = Vector.XAxis()
add = Vector.Add(ZAxis, XAxis)
code_block = CodeBlock { 5; }
byStartPointDirectionLength = Line.ByStartPointDirectionLength(startPoint=origin, direction=add, length=code_block)
