# Dynamo graph AngleAboutAxis.dyn (Dynamo 1.1.0.2093)

origin = Point.Origin()
z_elevation = DoubleSlider(10, range=0..10 step 0.1)
code_block = CodeBlock(zElevation=z_elevation) { Vector.ByCoordinates(10,5,zElevation); Vector.ZAxis(); 5; }
byStartPointDirectionLength = Line.ByStartPointDirectionLength(startPoint=origin, direction=code_block.out0, length=code_block.out2)
rotation_degrees = DoubleSlider(87.1, range=0..360 step 0.1)
rotate = Vector.Rotate(code_block.out0, code_block.out1, rotation_degrees)
byStartPointDirectionLength_2 = Line.ByStartPointDirectionLength(startPoint=origin, direction=rotate, length=code_block.out2)
angleAboutAxis = Vector.AngleAboutAxis(code_block.out0, rotate, code_block.out1)
watch = Watch(angleAboutAxis)
