# Dynamo graph AsPoint.dyn (Dynamo 1.1.0.2093)

code_block = CodeBlock { 10; 5; 6; }
byCoordinates = Vector.ByCoordinates(x=code_block.out0, y=code_block.out1, z=code_block.out2)
asPoint = Vector.AsPoint(byCoordinates)
watch = Watch(asPoint)
