# Dynamo graph Dot.dyn (Dynamo 1.1.0.2093)

origin = Point.Origin()
code_block = CodeBlock { Vector.ByCoordinates(10,5,6); Vector.ByCoordinates(1,10,1); 5; }
byStartPointDirectionLength = Line.ByStartPointDirectionLength(startPoint=origin, direction=code_block.out0, length=code_block.out2)
byStartPointDirectionLength_2 = Line.ByStartPointDirectionLength(startPoint=origin, direction=code_block.out1, length=code_block.out2)
dot = Vector.Dot(code_block.out0, code_block.out1)
watch = Watch(dot)
