# Dynamo graph IsAlmostEqualTo.dyn (Dynamo 1.1.0.2093)

ZAxis = Vector.ZAxis()
vector_direction = DoubleSlider(0, range=0..5 step 0.1)
code_block = CodeBlock { 1; }
byCoordinates = Vector.ByCoordinates(x=vector_direction, y=vector_direction, z=code_block)
isAlmostEqualTo = Vector.IsAlmostEqualTo(ZAxis, byCoordinates)
watch = Watch(isAlmostEqualTo)
code_block_2 = CodeBlock(v1=ZAxis, v2=byCoordinates)
# ---------- code_block_2.designscript (4 lines) ----------
pt1 = Point.ByCoordinates(0,0);
pt2 = Point.ByCoordinates(4,0);
Line.ByStartPointDirectionLength(pt1, v1, 5);
Line.ByStartPointDirectionLength(pt2, v2, 5);
# ----------------------------------------
