# Dynamo graph IsParallel.dyn (Dynamo 1.1.0.2093)

origin = Point.Origin()
code_block = CodeBlock { 1; }
byCoordinates = Vector.ByCoordinates(x=code_block)
code_block_2 = CodeBlock { 5; }
byStartPointDirectionLength = Line.ByStartPointDirectionLength(startPoint=origin, direction=byCoordinates, length=code_block_2)
code_block_3 = CodeBlock { Point.ByCoordinates(0,2); }
parallel_test = DoubleSlider(0.1, range=0..3 step 0.1)
byCoordinates_2 = Vector.ByCoordinates(x=code_block, y=parallel_test)
byStartPointDirectionLength_2 = Line.ByStartPointDirectionLength(startPoint=code_block_3, direction=byCoordinates_2, length=code_block_2)
isParallel = Vector.IsParallel(byCoordinates, byCoordinates_2)
watch = Watch(isParallel)
