# Dynamo graph Normalized.dyn (Dynamo 1.1.0.2093)

code_block = CodeBlock { 1; }
byCoordinates = Vector.ByCoordinates(x=code_block, y=code_block)
length = Vector.Length(byCoordinates)
watch = Watch(length)
normalized = Vector.Normalized(byCoordinates)
length_2 = Vector.Length(normalized)
watch_2 = Watch(length_2)
