# Dynamo graph Reverse.dyn (Dynamo 1.1.0.2093)

origin = Point.Origin()
vector_direction = DoubleSlider(1, range=0..5 step 0.1)
code_block = CodeBlock { 1; }
byCoordinates = Vector.ByCoordinates(x=vector_direction, y=vector_direction, z=code_block)
code_block_2 = CodeBlock { 5; }
byStartPointDirectionLength = Line.ByStartPointDirectionLength(startPoint=origin, direction=byCoordinates, length=code_block_2)
reverse = Vector.Reverse(byCoordinates)
byStartPointDirectionLength_2 = Line.ByStartPointDirectionLength(startPoint=origin, direction=reverse, length=code_block_2)
