# Dynamo graph Rotate (vector, axis, degrees).dyn (Dynamo 1.1.0.2093)

origin = Point.Origin()
code_block = CodeBlock { 1; }
byCoordinates = Vector.ByCoordinates(x=code_block, y=code_block, z=code_block)
ZAxis = Vector.ZAxis()
number_slider = DoubleSlider(30.7, range=0..100 step 0.1)
rotate = Vector.Rotate(byCoordinates, ZAxis, number_slider)
code_block_2 = CodeBlock { 4; }
byStartPointDirectionLength = Line.ByStartPointDirectionLength(startPoint=origin, direction=rotate, length=code_block_2)
XAxis = Vector.XAxis()
YAxis = Vector.YAxis()
