# Dynamo graph Rotate (vector, plane, degrees).dyn (Dynamo 1.3.1.1736)

origin = Point.Origin()
code_block = CodeBlock { 1; }
byCoordinates = Vector.ByCoordinates(x=code_block, y=code_block, z=code_block)
XZ = Plane.XZ()
number_slider = DoubleSlider(54.6, range=0..90 step 0.1)
rotate = Vector.Rotate(byCoordinates, XZ, number_slider)
code_block_2 = CodeBlock { 4; }
byStartPointDirectionLength = Line.ByStartPointDirectionLength(startPoint=origin, direction=rotate, length=code_block_2)
