# Dynamo graph Scale (vector, scale_factor).dyn (Dynamo 1.1.0.2093)

code_block = CodeBlock { 1; }
byCoordinates = Vector.ByCoordinates(x=code_block, y=code_block, z=code_block)
number_slider = DoubleSlider(7.2, range=0..10 step 0.1)
scale = Vector.Scale(vector=byCoordinates, scale_factor=number_slider)
length = Vector.Length(scale)
watch = Watch(length)
length_2 = Vector.Length(byCoordinates)
watch_2 = Watch(length_2)
