# Dynamo graph Scale (vector, xScaleFactor, yScaleFactor, zScaleFactor).dyn (Dynamo 1.1.0.2093)

code_block = CodeBlock { 1; }
byCoordinates = Vector.ByCoordinates(x=code_block, y=code_block, z=code_block)
code_block_2 = CodeBlock { 2; }
scale = Vector.Scale(byCoordinates, code_block_2)
length = Vector.Length(scale)
watch = Watch(length)
length_2 = Vector.Length(byCoordinates)
watch_2 = Watch(length_2)
scale_2 = Vector.Scale(byCoordinates, arg2=code_block_2, arg3=code_block_2)
length_3 = Vector.Length(scale_2)
watch_3 = Watch(length_3)
