# Dynamo graph Subtract.dyn (Dynamo 1.1.0.2093)

code_block = CodeBlock { 1; }
number_slider = DoubleSlider(1.42, range=0..5 step 0.01)
byCoordinates = Vector.ByCoordinates(x=code_block, z=number_slider)
ZAxis = Vector.ZAxis()
ZAxis_2 = Vector.ZAxis()
subtract = Vector.Subtract(byCoordinates, ZAxis_2)
code_block_2 = CodeBlock(v1=byCoordinates, v2=ZAxis, v3=subtract)
# ---------- code_block_2.designscript (5 lines) ----------
pt = Point.ByCoordinates(0,0,0);

Line.ByStartPointDirectionLength(pt, v1, 5);
Line.ByStartPointDirectionLength(pt, v2, 5);
Line.ByStartPointDirectionLength(pt, v3, 5);
# ----------------------------------------
subtracted_vector = Object.Identity(code_block_2.out3)
