# Dynamo graph ByCoordinates (x, y, z).dyn (Dynamo 1.1.0.2093)

origin = Point.Origin()
code_block = CodeBlock { 1; }
byCoordinates = Vector.ByCoordinates(x=code_block, z=code_block)
code_block_2 = CodeBlock { 10; }
byStartPointDirectionLength = Line.ByStartPointDirectionLength(startPoint=origin, direction=byCoordinates, length=code_block_2)
