# Dynamo graph ByCoordinates (x, y, z, normalized).dyn (Dynamo 1.1.0.2093)

code_block = CodeBlock { 2; }
boolean = BoolSelector(false)
byCoordinates = Vector.ByCoordinates(x=code_block, y=code_block, normalized=boolean)
length = Vector.Length(byCoordinates)
watch = Watch(length)
origin = Point.Origin()
byStartPointDirectionLength = Line.ByStartPointDirectionLength(startPoint=origin, direction=byCoordinates, length=length)
