# Dynamo graph ByTwoPoints.dyn (Dynamo 1.1.0.2093)

code_block = CodeBlock { Point.ByCoordinates(2,4,0); Point.ByCoordinates(4,5,2); }
byTwoPoints = Vector.ByTwoPoints(start=code_block.out0, end=code_block.out1)
distanceTo = Geometry.DistanceTo(geometry=code_block.out0, other=code_block.out1)
byStartPointDirectionLength = Line.ByStartPointDirectionLength(startPoint=code_block.out0, direction=byTwoPoints, length=distanceTo)
length = Vector.Length(byTwoPoints)
