# Dynamo graph XAxis.dyn (Dynamo 1.1.0.2093)

origin = Point.Origin()
XAxis = Vector.XAxis()
code_block = CodeBlock { 10; }
byStartPointDirectionLength = Line.ByStartPointDirectionLength(startPoint=origin, direction=XAxis, length=code_block)
