# Dynamo graph YAxis.dyn (Dynamo 1.1.0.2093)

origin = Point.Origin()
YAxis = Vector.YAxis()
code_block = CodeBlock { 10; }
byStartPointDirectionLength = Line.ByStartPointDirectionLength(startPoint=origin, direction=YAxis, length=code_block)
