# Dynamo graph ZAxis.dyn (Dynamo 1.1.0.2093)

origin = Point.Origin()
ZAxis = Vector.ZAxis()
code_block = CodeBlock { 10; }
byStartPointDirectionLength = Line.ByStartPointDirectionLength(startPoint=origin, direction=ZAxis, length=code_block)
