# Dynamo graph Length.dyn (Dynamo 1.1.0.2093)

code_block = CodeBlock { Point.ByCoordinates(0,2,0); Vector.ByCoordinates(4,0,4); }
length = Vector.Length(code_block.out1)
watch = Watch(length)
number_slider = DoubleSlider(1, range=1..2 step 0.01)
code_block_2 = CodeBlock(x=watch, y=number_slider) { x*y; }
watch_2 = Watch(code_block_2)
byStartPointDirectionLength = Line.ByStartPointDirectionLength(startPoint=code_block.out0, direction=code_block.out1, length=watch_2)
