# Dynamo graph X.dyn (Dynamo 1.1.0.2093)

code_block = CodeBlock { Point.ByCoordinates(0,2,0); Vector.ByCoordinates(4,2,3); }
number_slider = DoubleSlider(1.66, range=1..2 step 0.01)
scale = Vector.Scale(vector=code_block.out1, scale_factor=number_slider)
length = Vector.Length(scale)
byStartPointDirectionLength = Line.ByStartPointDirectionLength(startPoint=code_block.out0, direction=code_block.out1, length=length)
X = Vector.X(code_block.out1)
watch = Watch(X)
X_2 = Vector.X(scale)
watch_2 = Watch(X_2)
