# Dynamo graph Z.dyn (Dynamo 1.1.0.2093)

code_block = CodeBlock { Point.ByCoordinates(0,2,0); Vector.ByCoordinates(4,2,3); }
vector_scale = DoubleSlider(1.65, range=1..2 step 0.01)
scale = Vector.Scale(vector=code_block.out1, scale_factor=vector_scale)
length = Vector.Length(scale)
byStartPointDirectionLength = Line.ByStartPointDirectionLength(startPoint=code_block.out0, direction=code_block.out1, length=length)
Z = Vector.Z(code_block.out1)
watch = Watch(Z)
Z_2 = Vector.Z(scale)
watch_2 = Watch(Z_2)
code_block_2 = CodeBlock {  }
