# Dynamo graph AdjacentFaces.dyn (Dynamo 1.1.0.2093)

code_block = CodeBlock { 4; }
byCoordinates = Point.ByCoordinates(x=code_block, y=code_block, z=code_block)
byCorners = Cuboid.ByCorners(highPoint=byCoordinates)
code_block_2 = CodeBlock(geometry=byCorners) { color = Color.ByARGB(100,141,198,217); Display.ByGeometryColor(geometry, color); }
edges = Topology.Edges(byCorners)
startVertex = Edge.StartVertex(edges)
index_selector = IntegerSlider(6, range=0..11 step 1)
getItemAtIndex = List.GetItemAtIndex(list=startVertex, index=index_selector)
adjacentFaces = Vertex.AdjacentFaces(getItemAtIndex)
watch = Watch(adjacentFaces)
surfaceGeometry = Face.SurfaceGeometry(watch)
code_block_3 = CodeBlock(geometry=surfaceGeometry) { color = Color.ByARGB(200,141,198,217); Display.ByGeometryColor(geometry, color); }
pointGeometry = Vertex.PointGeometry(getItemAtIndex)
