# Dynamo graph PointGeometry.dyn (Dynamo 1.1.0.2093)

code_block = CodeBlock { 4; }
byCoordinates = Point.ByCoordinates(x=code_block, y=code_block, z=code_block)
byCorners = Cuboid.ByCorners(highPoint=byCoordinates)
edges = Topology.Edges(byCorners)
startVertex = Edge.StartVertex(edges)
pointGeometry = Vertex.PointGeometry(startVertex)
code_block_2 = CodeBlock(geometry=byCorners) { color = Color.ByARGB(100,141,198,217); Display.ByGeometryColor(geometry, color); }
