# Dynamo graph ReadFromFile.dyn (Dynamo 1.1.0.2093)

file_path = Filename("..\..\..\..\_REFERENCE\sampleexcel.xlsx")
fromPath = FileObject(file_path)  # "File.FromPath"
code_block = CodeBlock { "samplesheet"; }
readFromFile = Excel.ReadFromFile(file=fromPath, sheetName=code_block)
watch = Watch(readFromFile)
