# Dynamo graph WriteToFile.dyn (Dynamo 1.1.0.2093)

code_block = CodeBlock { 0..10..#9; }
create = List.Create(code_block, code_block)
watch = Watch(create)
file_path = Filename("..\..\..\..\_REFERENCE\sampleexcel.xlsx")
code_block_2 = CodeBlock { "samplesheet"; }
code_block_3 = CodeBlock { 0; }
code_block_4 = CodeBlock { 1; }
writeToFile = Excel.WriteToFile(filePath=file_path, sheetName=code_block_2, startRow=code_block_3, startCol=code_block_4, data=create)
watch_2 = Watch(writeToFile)
