# Dynamo graph NotEqualTo.dyn (Dynamo 1.0.0.1180)

number_slider = DoubleSlider(47.7, range=0..100 step 0.1)
number_slider_2 = DoubleSlider(12.6, range=0..100 step 0.1)
ne = number_slider != number_slider_2
watch = Watch(ne)
