# Dynamo graph Or.dyn (Dynamo 1.0.0.1180)

boolean = BoolSelector(true)
boolean_2 = BoolSelector(false)
or_ = boolean || boolean_2
watch = Watch(or_)
boolean_3 = BoolSelector(true)
boolean_4 = BoolSelector(true)
or_2 = boolean_3 || boolean_4
watch_2 = Watch(or_2)
boolean_5 = BoolSelector(false)
boolean_6 = BoolSelector(false)
or_3 = boolean_5 || boolean_6
watch_3 = Watch(or_3)
