# Dynamo graph ByParametersOnFace.dyn (Dynamo 1.3.0.875)

code_block = CodeBlock { 0..1..#2; }
byCoordinates = UV.ByCoordinates(code_block, code_block, lacing=CrossProduct)
flatten = Flatten(byCoordinates)
code_block_2 = CodeBlock { {0,1000,2000,3000}; {0,1000,0,1000}; }
byCoordinates_2 = Point.ByCoordinates(x=code_block_2.out0, z=code_block_2.out1)
byControlPoints = NurbsCurve.ByControlPoints(byCoordinates_2)
YAxis = Vector.YAxis()
number_slider = DoubleSlider(4000, range=0..4000 step 0.1)
extrude = Curve.Extrude(curve=byControlPoints, direction=YAxis, distance=number_slider)
byGeometry = ImportInstance.ByGeometry(extrude)
elementFaceReferences = Element.ElementFaceReferences(byGeometry)
family_types = FamilyTypes("adaptive frame:adaptive frame")
byParametersOnFace = AdaptiveComponent.ByParametersOnFace(flatten, elementFaceReferences, family_types)
pointAtParameter = Surface.PointAtParameter(surface=extrude, u=code_block, v=code_block, lacing=CrossProduct)
