# Dynamo graph ByName.dyn (Dynamo 1.3.0.875)

code_block = CodeBlock()
# ---------- code_block.designscript (6 lines) ----------
sc = "Structural Columns";
sf = "Structural Foundations";
fl = "Floors";
wa = "Walls";
rf = "Roofs";
{sc, sf, fl, wa, rf};
# ----------------------------------------
byName = Category.ByName(code_block.out5)
