# Dynamo graph AsFamilyInstance.dyn (Dynamo 1.3.0.875)

categories = Categories("CurtainWallPanels")
all_elements_of_category = ElementsOfCategory(categories)
asFamilyInstance = CurtainPanel.AsFamilyInstance(all_elements_of_category)
