# Dynamo graph Boundaries.dyn (Dynamo 1.3.0.875)

categories = Categories("CurtainWallPanels")
all_elements_of_category = ElementsOfCategory(categories)
boundaries = CurtainPanel.Boundaries(all_elements_of_category)
