# Dynamo graph HasPlane.dyn (Dynamo 1.3.0.875)

categories = Categories("CurtainWallPanels")
all_elements_of_category = ElementsOfCategory(categories)
hasPlane = CurtainPanel.HasPlane(all_elements_of_category)
