# Dynamo graph Height.dyn (Dynamo 1.3.0.875)

categories = Categories("CurtainWallPanels")
all_elements_of_category = ElementsOfCategory(categories)
isRectangular = CurtainPanel.IsRectangular(all_elements_of_category)
filterByBoolMask = List.FilterByBoolMask(list=all_elements_of_category, mask=isRectangular)
height = CurtainPanel.Height(filterByBoolMask.in)
