# Dynamo graph Length.dyn (Dynamo 1.3.0.875)

categories = Categories("CurtainWallPanels")
all_elements_of_category = ElementsOfCategory(categories)
length = CurtainPanel.Length(all_elements_of_category)
