# Dynamo graph PanelPlane.dyn (Dynamo 1.3.0.875)

categories = Categories("CurtainWallPanels")
all_elements_of_category = ElementsOfCategory(categories)
panelPlane = CurtainPanel.PanelPlane(all_elements_of_category)
