# Dynamo graph ByReferencePoints.dyn (Dynamo 1.3.0.875)

code_block = CodeBlock { {0,10,20,30}; }
code_block_2 = CodeBlock { {0,10,0,10}; }
byCoordinates = Point.ByCoordinates(x=code_block, y=code_block_2)
byPoint = ReferencePoint.ByPoint(byCoordinates)
byReferencePoints = CurveByPoints.ByReferencePoints(byPoint)
