# Dynamo graph ElementCurveReference.dyn (Dynamo 1.3.0.875)

element_types = ElementTypes("CurveElement")
all_elements_of_type = ElementsOfType(element_types)
elementCurveReference = CurveElement.ElementCurveReference(all_elements_of_type)
