# Dynamo graph SetCurve.dyn (Dynamo 1.3.0.875)

current = Document.Current()
activeView = Document.ActiveView(current)
byCenterPointRadius = Circle.ByCenterPointRadius()
regularPolygon = Polygon.RegularPolygon(circle=byCenterPointRadius)
explode = Geometry.Explode(regularPolygon)
byCurve = DetailCurve.ByCurve(activeView, explode)
code_block = CodeBlock { 0..5..1; }
byCoordinates = Point.ByCoordinates(x=code_block)
code_block_2 = CodeBlock { 12; }
byCoordinates_2 = Point.ByCoordinates(y=code_block_2)
byStartPointEndPoint = Line.ByStartPointEndPoint(startPoint=byCoordinates, endPoint=byCoordinates_2)
setCurve = DetailCurve.SetCurve(byCurve, byStartPointEndPoint)
