# Dynamo graph ByCurve.dyn (Dynamo 1.3.0.875)

current = Document.Current()
activeView = Document.ActiveView(current)
byCenterPointRadius = Circle.ByCenterPointRadius()
regularPolygon = Polygon.RegularPolygon(circle=byCenterPointRadius)
explode = Geometry.Explode(regularPolygon)
byCurve = DetailCurve.ByCurve(activeView, explode)
