# Dynamo graph ByElements.dyn (Dynamo 1.3.0.875)

byElements = Dimension.ByElements()  # unwired: arg0, arg1
views = Views("Level 1")
byCurve = ModelCurve.ByCurve()  # unwired: arg0
code_block = CodeBlock { {0,2000,4000,6000}; }
byCoordinates = Point.ByCoordinates(x=code_block)
code_block_2 = CodeBlock { 2000; }
byCoordinates_2 = Point.ByCoordinates(x=code_block, y=code_block_2)
byStartPointEndPoint = Line.ByStartPointEndPoint(startPoint=byCoordinates, endPoint=byCoordinates_2)
