# Dynamo graph Suffix.dyn (Dynamo 1.3.0.875)

select_model_element = DSModelElementSelection()  # 1 picked in the model
code_block = CodeBlock { "(grid)"; }
setSuffix = Dimension.SetSuffix(select_model_element, code_block)
suffix = Dimension.Suffix(select_model_element)
