# Dynamo graph ValueOverride.dyn (Dynamo 1.3.0.875)

select_model_element = DSModelElementSelection()  # 1 picked in the model
code_block = CodeBlock { "(grid spacing)"; }
setValueOverride = Dimension.SetValueOverride(select_model_element, code_block)
valueOverride = Dimension.ValueOverride(select_model_element)
