# Dynamo graph FromExisting.dyn (Dynamo 1.3.0.875)

element_types = ElementTypes("DimensionType")
all_elements_of_type = ElementsOfType(element_types)
code_block = CodeBlock { 0; }
getItemAtIndex = List.GetItemAtIndex(list=all_elements_of_type, index=code_block)
name = Element.Name(getItemAtIndex)
code_block_2 = CodeBlock { "New Dim Style"; }
fromExisting = DimensionType.FromExisting(getItemAtIndex, code_block_2)
name_2 = Element.Name(fromExisting)
