# Dynamo graph ByMesh.dyn (Dynamo 1.3.0.875)

element_types = ElementTypes("TopographySurface")
all_elements_of_type = ElementsOfType(element_types)
mesh = Topography.Mesh(all_elements_of_type)
categories = Categories("GenericModel")
code_block = CodeBlock { "Generic Topography"; }
byMesh = DirectShape.ByMesh(mesh, categories, arg3=code_block)
