# Dynamo graph Spacing Rule Layout.dyn (Dynamo 1.3.0.875)

select_model_element = DSModelElementSelection()
code_block = CodeBlock { "(grid)"; }
setPrefix = Dimension.SetPrefix(select_model_element, code_block)
prefix = Dimension.Prefix(select_model_element)
