# Dynamo graph Points.dyn (Dynamo 1.3.0.875)

code_block = CodeBlock { {0,10,20,30}; {0,10,0,10}; }
byCoordinates = Point.ByCoordinates(x=code_block.out0, y=code_block.out1)
byControlPoints = NurbsCurve.ByControlPoints(byCoordinates)
referenceCurveByCurve = ModelCurve.ReferenceCurveByCurve(byControlPoints)
integer_slider = IntegerSlider(7, range=0..10 step 1)
byCurveAndDivisions = DividedPath.ByCurveAndDivisions(referenceCurveByCurve, integer_slider)
points = DividedPath.Points(byCurveAndDivisions)
