# Dynamo graph UDivisions.dyn (Dynamo 1.3.0.875)

code_block = CodeBlock { {0,10,20,30}; {0,10,0,10}; }
byCoordinates = Point.ByCoordinates(x=code_block.out0, y=code_block.out1)
byControlPoints = NurbsCurve.ByControlPoints(byCoordinates)
number_slider = DoubleSlider(15.9, range=0..100 step 0.1)
extrude = Curve.Extrude(curve=byControlPoints, distance=number_slider)
byGeometry = ImportInstance.ByGeometry(extrude)
elementFaceReferences = Element.ElementFaceReferences(byGeometry)
integer_slider = IntegerSlider(5, range=1..10 step 1)
byFaceAndUVDivisions = DividedSurface.ByFaceAndUVDivisions(elementFaceReferences, integer_slider, integer_slider)
UDivisions = DividedSurface.UDivisions(byFaceAndUVDivisions)
