# Dynamo graph GetMaterials.dyn (Dynamo 1.2.1.3083)

# group: Open with Revit file: rac_basic_sample_project.rvt
# note: The Revit sample file can be found in Revit's installation directory, typically located in:
# C:\Program Files\Autodesk\Revit 2017\Samples

family_types = FamilyTypes("M_Pile-Steel Pipe:600mm Diameter")
all_elements_of_family_type = ElementsOfFamilyType(family_types)
getMaterials = Element.GetMaterials(element=all_elements_of_family_type)
