# Dynamo graph OverrideColorInView.dyn (Dynamo 1.2.1.3083)

family_types = FamilyTypes("M_Pile-Steel Pipe:600mm Diameter")
byFamilyType = FamilyInstance.ByFamilyType(family_types)
code_block = CodeBlock { a = 200; r = 141; g = 198; b = 217; Color.ByARGB(a,r,g,b); 0; }
color_range = ColorRange(code_block.out4, code_block.out5, code_block.out5)
overrideColorInView = Element.OverrideColorInView(element=byFamilyType, color=color_range)
