# Dynamo graph OverrideInView.dyn (Dynamo 1.3.0.875)

categories = Categories("Rooms")
all_elements_of_category = ElementsOfCategory(categories)
number_slider = DoubleSlider(0, range=0..100 step 0.1)
byProperties = Revit.Filter.OverrideGraphicSettings.ByProperties(arg10=number_slider)
boolean = BoolSelector(false)
overrideInView = Element.OverrideInView(element=all_elements_of_category, overrides=byProperties, hide=boolean)
