# Dynamo graph SetLocation.dyn (Dynamo 1.2.1.3083)

# group: Open with Revit file: rac_basic_sample_project.rvt
# note: The Revit sample file can be found in Revit's installation directory, typically located in:
# C:\Program Files\Autodesk\Revit 2017\Samples

family_types = FamilyTypes("M_Concrete-Round-Column with Drop Caps:M_1000")
all_elements_of_family_type = ElementsOfFamilyType(family_types)
number_slider = DoubleSlider(-1000, range=-1000..1000 step 1)
code_block = CodeBlock(input=number_slider) { x = -438.068; y = input; z = -1800; Point.ByCoordinates(x,y,z); }
setLocation = Element.SetLocation(all_elements_of_family_type, code_block.out3)
