# Dynamo graph SetParameterByName.dyn (Dynamo 1.2.1.3083)

select_model_elements = DSModelElementsSelection()  # 8 picked in the model
integer_slider = IntegerSlider(6, range=0..8 step 1)
getItemAtIndex = List.GetItemAtIndex(list=select_model_elements, index=integer_slider)
code_block = CodeBlock { "Height Offset From Level"; }
number_slider = DoubleSlider(-800, range=-1500..-800 step 1)
setParameterByName = Element.SetParameterByName(element=getItemAtIndex, parameterName=code_block, value=number_slider)
