# Dynamo graph ElementCurveReferences.dyn (Dynamo 1.2.1.3083)

# group: Open with Revit file: rac_basic_sample_project.rvt
# note: The Revit sample file can be found in Revit's installation directory, typically located in:
# C:\Program Files\Autodesk\Revit 2017\Samples

categories = Categories("GenericModel")
all_elements_of_category = ElementsOfCategory(categories)
elementCurveReferences = Element.ElementCurveReferences(all_elements_of_category)
