# Dynamo graph ElementType.dyn (Dynamo 1.3.0.875)

categories = Categories("StructuralFoundation")
all_elements_of_category = ElementsOfCategory(categories)
elementType = Element.ElementType(all_elements_of_category)
