# Dynamo graph SetRotation.dyn (Dynamo 1.2.1.3083)

family_types = FamilyTypes("M_Pile-Steel Pipe:600mm Diameter")
byFamilyType = FamilyInstance.ByFamilyType(family_types)
number_slider = DoubleSlider(90, range=0..359 step 0.1)
setRotation = FamilyInstance.SetRotation(familyInstance=byFamilyType, degree=number_slider)
