# Dynamo graph ByCoordinates.dyn (Dynamo 1.2.1.3083)

family_types = FamilyTypes("M_Pile Cap-600 Pile:600 x 600 x 900mm")
select_model_element = DSModelElementSelection()  # 1 picked in the model
code_block = CodeBlock(t1=select_model_element) { geometry1 = t1.GetLocation(); num1 = geometry1.X; num2 = geometry1.Y; num3 = geometry1.Z; }
number_slider = DoubleSlider(2102, range=0..4000 step 0.1)
code_block_2 = CodeBlock(y=code_block.num2, input=number_slider) { a=y-input; b=(y-input*2); {a,b}; }
byCoordinates = FamilyInstance.ByCoordinates(family_types, code_block.num1, code_block_2.out2, code_block.num3)
