# Dynamo graph ByFace.dyn (Dynamo 1.2.1.3083)

family_types = FamilyTypes("M_Slab Edge-Thickened:600 x 300mm")
select_face = DSFaceSelection()  # 1 picked in the model
select_edges = SelectEdges()  # 1 picked in the model
byFace = FamilyInstance.ByFace(family_types, select_face, select_edges)
