# Dynamo graph ByPoint.dyn (Dynamo 1.2.1.3083)

family_types = FamilyTypes("M_Pile Cap-600 Pile:600 x 600 x 900mm")
select_edge = DSEdgeSelection()  # 1 picked in the model
select_edge_2 = DSEdgeSelection()  # 1 picked in the model
integer_slider = IntegerSlider(4, range=2..6 step 1)
code_block = CodeBlock(t3=select_edge, t4=select_edge_2, t5=integer_slider)
# ---------- code_block.designscript (10 lines) ----------
point1 = t3.StartPoint;
point2 = t3.EndPoint;
vector1 = Vector.ByTwoPoints(point1, point2);
num1 = t3.Length;
x = num1;
t1 = x / 2;
geometry1 = t4.Translate(vector1, t1);
x1 = t5;
t2 = (0..1..#x1);
point3 = geometry1.PointAtParameter(t2);
# ----------------------------------------
byPoint = FamilyInstance.ByPoint(familyType=family_types, point=code_block.point3)
