# Dynamo graph ByPointAndLevel.dyn (Dynamo 1.2.1.3083)

family_types = FamilyTypes("Dining Chair (3):Dining Chair (3)")
select_edge = DSEdgeSelection()  # 1 picked in the model
select_edge_2 = DSEdgeSelection()  # 1 picked in the model
integer_slider = IntegerSlider(6, range=2..6 step 1)
code_block = CodeBlock(t3=select_edge, t4=select_edge_2, t5=integer_slider)
# ---------- code_block.designscript (10 lines) ----------
point1 = t3.StartPoint;
point2 = t3.EndPoint;
vector1 = Vector.ByTwoPoints(point1, point2);
num1 = t3.Length;
x = num1;
t1 = x / 2;
geometry1 = t4.Translate(vector1, t1);
x1 = t5;
t2 = (0.3..0.8..#x1);
point3 = geometry1.PointAtParameter(t2);
# ----------------------------------------
levels = Levels("Level 1 Living Rm.")
levels_2 = Levels("Level 1")
create = List.Create(levels, levels_2)
byPointAndLevel = FamilyInstance.ByPointAndLevel(familyType=family_types, point=code_block.point3, level=create, lacing=CrossProduct)
