# Dynamo graph FacingOrientation.dyn (Dynamo 1.2.1.3083)

family_types = FamilyTypes("System Panel:Glazed")
byFamilyType = FamilyInstance.ByFamilyType(family_types)
facingOrientation = FamilyInstance.FacingOrientation(byFamilyType)
