# Dynamo graph GetType.dyn (Dynamo 1.2.1.3083)

family_types = FamilyTypes("System Panel:Glazed")
byFamilyType = FamilyInstance.ByFamilyType(family_types)
getType = FamilyInstance.GetType(byFamilyType)
