# Dynamo graph Location.dyn (Dynamo 1.2.1.3083)

family_types = FamilyTypes("M_Pile Cap-600 Pile:600 x 600 x 900mm")
byFamilyType = FamilyInstance.ByFamilyType(family_types)
location = FamilyInstance.Location(byFamilyType)
