# Dynamo graph ByFamilyAndName.dyn (Dynamo 1.2.1.3083)

code_block = CodeBlock { "M_Room Tag"; }
byName = Family.ByName(code_block)
code_block_2 = CodeBlock { "Room Tag"; "Room Tag With Area"; }
byFamilyAndName = FamilyType.ByFamilyAndName(family=byName, name=code_block_2.out1)
