# Dynamo graph ByFamilyNameAndTypeName.dyn (Dynamo 1.2.1.3083)

code_block = CodeBlock { "M_Room Tag"; }
code_block_2 = CodeBlock { "Room Tag"; "Room Tag With Area"; }
byFamilyNameAndTypeName = FamilyType.ByFamilyNameAndTypeName(code_block, code_block_2.out1)
