# Dynamo graph VoidByGeometry.dyn (Dynamo 1.3.0.875)

code_block = CodeBlock { Point.ByCoordinates(0,0,3); Point.ByCoordinates(3,0,3); Point.ByCoordinates(3,0,7); Point.ByCoordinates(0,0,7); }
byCornerPoints = Rectangle.ByCornerPoints(code_block.out0, code_block.out1, code_block.out2, code_block.out3)
YAxis = Vector.YAxis()
extrudeAsSolid = Curve.ExtrudeAsSolid(curve=byCornerPoints, direction=YAxis)
code_block_2 = CodeBlock { "Opening"; }
categories = Categories("GenericModel")
file_path = Filename("..\..\..\..\..\..\..\..\..\..\..\..\..\ProgramData\Autodesk\RVT 2017\Family Templates\English_I\Generic Model.rft")
voidByGeometry = FamilyType.VoidByGeometry(extrudeAsSolid, code_block_2, categories, file_path)
