# Dynamo graph Family.dyn (Dynamo 1.3.0.875)

code_block = CodeBlock { a="Room Tag"; b="Room Tag With Area"; c="Boxed"; {a,b,c}; }
byName = FamilyType.ByName(code_block.out3)
family = FamilyType.Family(byName)
