# Dynamo graph ByCurves.dyn (Dynamo 1.3.0.875)

views = Views("Level 1")
select_model_element = DSModelElementSelection()  # 1 picked in the model
coreBoundary = Room.CoreBoundary(select_model_element)
select_filled_region_type = FilledRegionTypes("Vertical")
byCurves = FilledRegion.ByCurves(views, coreBoundary, select_filled_region_type)
