# Dynamo graph AddPoint.dyn (Dynamo 1.3.0.875)

select_model_element = DSModelElementSelection()  # 1 picked in the model
select_face = DSFaceSelection()  # 1 picked in the model
code_block = CodeBlock { 0.5; }
pointAtParameter = Surface.PointAtParameter(surface=select_face, u=code_block, v=code_block)
code_block_2 = CodeBlock { Vector.ByCoordinates(0,0,-200); }
translate = Geometry.Translate(geometry=pointAtParameter, direction=code_block_2)
addPoint = Floor.AddPoint(select_model_element, translate)
