# Dynamo graph ByOutlineTypeAndLevel (outline, floorType, level).dyn (Dynamo 1.3.0.875)

code_block = CodeBlock { 30; 50; }
byWidthLength = Rectangle.ByWidthLength(width=code_block.out0, length=code_block.out1)
explode = Geometry.Explode(byWidthLength)
byJoinedCurves = PolyCurve.ByJoinedCurves(explode)
ZAxis = Vector.ZAxis()
number_slider = DoubleSlider(30, range=0..100 step 10)
code_block_2 = CodeBlock(x=number_slider) { (x/10)+1; }
code_block_3 = CodeBlock(height=number_slider, floors=code_block_2) { 0..height..#floors; }
translate = Geometry.Translate(geometry=byJoinedCurves, direction=ZAxis, distance=code_block_3)
floor_types = FloorTypes("Floor 1")
levels = Levels("Level 1")
byOutlineTypeAndLevel = Floor.ByOutlineTypeAndLevel(outline=translate, floorType=floor_types, level=levels)
