# Dynamo graph ByOutlineTypeAndLevel (outlineCurves, floorType, level).dyn (Dynamo 1.3.0.875)

code_block = CodeBlock { 30; 50; }
byWidthLength = Rectangle.ByWidthLength(width=code_block.out0, length=code_block.out1)
ZAxis = Vector.ZAxis()
number_slider = DoubleSlider(30, range=0..100 step 10)
code_block_2 = CodeBlock(x=number_slider) { (x/10)+1; }
code_block_3 = CodeBlock(height=number_slider, floors=code_block_2) { 0..height..#floors; }
translate = Geometry.Translate(geometry=byWidthLength, direction=ZAxis, distance=code_block_3)
explode = Geometry.Explode(translate)
floor_types = FloorTypes("Floor 1")
levels = Levels("Level 1")
byOutlineTypeAndLevel = Floor.ByOutlineTypeAndLevel(outlineCurves=explode, floorType=floor_types, level=levels)
