# Dynamo graph ByLoftCrossSections (curves, isSolid).dyn (Dynamo 1.3.0.875)

code_block = CodeBlock { 0..20..#4; }
byCoordinates = Point.ByCoordinates(z=code_block)
code_block_2 = CodeBlock { 0..50..#4; }
translate = Geometry.Translate(geometry=byCoordinates@L1, xTranslation=code_block_2)
code_block_3 = CodeBlock { {4,8,4,8}; }
byCenterPointRadius = Circle.ByCenterPointRadius(centerPoint=translate, radius=code_block_3)
transpose = List.Transpose(byCenterPointRadius)
byCurve = ModelCurve.ByCurve(transpose)
elementCurveReferences = Element.ElementCurveReferences(byCurve@L2)
boolean = BoolSelector(true)
byLoftCrossSections = Form.ByLoftCrossSections(elementCurveReferences, boolean)
