# Dynamo graph ByLoftCrossSections.dyn (Dynamo 1.3.0.875)

code_block = CodeBlock { 0..20..#4; }
byCoordinates = Point.ByCoordinates(z=code_block)
code_block_2 = CodeBlock { {4,8,4,8}; }
byCenterPointRadius = Circle.ByCenterPointRadius(centerPoint=byCoordinates, radius=code_block_2)
byCurve = ModelCurve.ByCurve(byCenterPointRadius)
elementCurveReferences = Element.ElementCurveReferences(byCurve@L2)
boolean = BoolSelector(true)
byLoftCrossSections = Form.ByLoftCrossSections(elementCurveReferences, boolean)
