# Dynamo graph FindByName.dyn (Dynamo 1.3.0.875)

code_block = CodeBlock { "sample global param"; }
code_block_2 = CodeBlock { "Integer"; }
byName = GlobalParameter.ByName(code_block, code_block_2)
code_block_3 = CodeBlock { "sample global param"; }
findByName = GlobalParameter.FindByName(code_block_3)
