# Dynamo graph Value.dyn (Dynamo 1.3.0.875)

code_block = CodeBlock { "sample global param"; }
code_block_2 = CodeBlock { "Integer"; }
byName = GlobalParameter.ByName(code_block, code_block_2)
value = GlobalParameter.Value(byName)
code_block_3 = CodeBlock { 4; }
setValue = GlobalParameter.SetValue(byName, code_block_3)
