# Dynamo graph Visible.dyn (Dynamo 1.3.0.875)

code_block = CodeBlock { "sample global param"; }
code_block_2 = CodeBlock { "Integer"; }
byName = GlobalParameter.ByName(code_block, code_block_2)
visible = GlobalParameter.Visible(byName)
