# Dynamo graph ByArc.dyn (Dynamo 1.2.1.3083)

select_point_on_face = DSPointOnElementSelection()  # 1 picked in the model
number_slider = DoubleSlider(2472.2, range=0..10000 step 0.1)
number_slider_2 = DoubleSlider(102.7, range=0..359 step 0.1)
number_slider_3 = DoubleSlider(305.4, range=0..359 step 0.1)
ZAxis = Vector.ZAxis()
byCenterPointRadiusAngle = Arc.ByCenterPointRadiusAngle(center=select_point_on_face, radius=number_slider, startAngle=number_slider_2, endAngle=number_slider_3, normal=ZAxis)
byArc = Grid.ByArc(byCenterPointRadiusAngle)
