# Dynamo graph ByStartPointEndPoint.dyn (Dynamo 1.2.1.3083)

select_edge = DSEdgeSelection()  # 1 picked in the model
startPoint = Curve.StartPoint(select_edge)
endPoint = Curve.EndPoint(select_edge)
byStartPointEndPoint = Grid.ByStartPointEndPoint(startPoint, endPoint)
