# Dynamo graph ElementCurveReference.dyn (Dynamo 1.2.1.3083)

element_types = ElementTypes("Grid")
all_elements_of_type = ElementsOfType(element_types)
elementCurveReference = Grid.ElementCurveReference(all_elements_of_type)
