# Dynamo graph ByGeometries.dyn (Dynamo 1.3.0.875)

file_path = Filename(".\solar panels.sat")
importFromSAT = Geometry.ImportFromSAT(file_path)
byGeometries = ImportInstance.ByGeometries(importFromSAT)
