# Dynamo graph ByElevationAndName.dyn (Dynamo 1.2.1.3083)

number_slider = DoubleSlider(-1452, range=-3000..0 step 1)
code_block = CodeBlock { "Basement"; }
byElevationAndName = Level.ByElevationAndName(number_slider, code_block)
