# Dynamo graph ByLevelOffsetAndName.dyn (Dynamo 1.2.1.3083)

levels = Levels("Level 1")
number_slider = DoubleSlider(-1452, range=-3000..0 step 1)
code_block = CodeBlock { "Basement"; }
byLevelOffsetAndName = Level.ByLevelOffsetAndName(levels, number_slider, code_block)
