# Dynamo graph Name.dyn (Dynamo 1.3.0.875)

categories = Categories("StructuralColumns")
all_elements_of_category = ElementsOfCategory(categories)
getMaterials = Element.GetMaterials(element=all_elements_of_category)
name = Material.Name(getMaterials)
