# Dynamo graph StructuralParameters.dyn (Dynamo 1.2.1.3083)

# group: Revit sample file: rac_basic_sample_project.rvt
# note: This Dynamo example file has been created with the basic sample project in the Revit installation directory, typically found in:
# C:\Program Files\Autodesk\Revit 2017\Samples

code_block = CodeBlock { conc = "Concrete, Cast In Situ"; co = "Copper"; df = "Default Floor"; gt = "Glass - Transparent"; {conc, co, df, gt}; }
byName = Material.ByName(code_block.out4)
structuralParameters = Material.StructuralParameters(byName)
