# Dynamo graph SurfacePatternColor.dyn (Dynamo 1.3.0.875)

code_block = CodeBlock { conc = "Concrete, Cast In Situ"; co = "Copper"; df = "Default Floor"; gt = "Glass - Transparent"; {conc, co, df, gt}; }
byName = Material.ByName(code_block.out4)
surfacePatternColor = Material.SurfacePatternColor(byName)
