# Dynamo graph ByCurve.dyn (Dynamo 1.3.0.875)

code_block = CodeBlock { 15..30..#5; }
byCoordinates = Point.ByCoordinates(x=code_block, y=code_block, lacing=CrossProduct)
byCenterPointRadius = Circle.ByCenterPointRadius(centerPoint=byCoordinates)
byCurve = ModelCurve.ByCurve(byCenterPointRadius)
code_block_2 = CodeBlock { {0,10,20,30}; {0,10,0,10}; }
byCoordinates_2 = Point.ByCoordinates(x=code_block_2.out0, y=code_block_2.out1)
byControlPoints = NurbsCurve.ByControlPoints(byCoordinates_2)
byCurve_2 = ModelCurve.ByCurve(byControlPoints)
