# Dynamo graph ReferenceCurveByCurve.dyn (Dynamo 1.3.0.875)

code_block = CodeBlock { {0,10,20,30}; {0,10,0,10}; }
byCoordinates = Point.ByCoordinates(x=code_block.out0, y=code_block.out1)
byControlPoints = NurbsCurve.ByControlPoints(byCoordinates)
referenceCurveByCurve = ModelCurve.ReferenceCurveByCurve(byControlPoints)
code_block_2 = CodeBlock { 15..30..#5; }
byCoordinates_2 = Point.ByCoordinates(x=code_block_2, y=code_block_2, lacing=CrossProduct)
byCenterPointRadius = Circle.ByCenterPointRadius(centerPoint=byCoordinates_2)
referenceCurveByCurve_2 = ModelCurve.ReferenceCurveByCurve(byCenterPointRadius)
