# Dynamo graph Position.dyn (Dynamo 1.3.0.875)

code_block = CodeBlock { "modeltext!"; }
byOriginNormal = Plane.ByOriginNormal()
byPlane = SketchPlane.ByPlane(byOriginNormal)
code_block_2 = CodeBlock { 0; }
code_block_3 = CodeBlock { 1; }
element_types = ElementTypes("ModelTextType")
all_elements_of_type = ElementsOfType(element_types)
byTextSketchPlaneAndPosition = ModelText.ByTextSketchPlaneAndPosition(code_block, byPlane, code_block_2, code_block_2, code_block_3, all_elements_of_type)
position = ModelText.Position(byTextSketchPlaneAndPosition)
