# Dynamo graph AsFamilyInstance.dyn (Dynamo 1.3.0.875)

categories = Categories("CurtainWallMullions")
all_elements_of_category = ElementsOfCategory(categories)
asFamilyInstance = Mullion.AsFamilyInstance(all_elements_of_category)
