# Dynamo graph SupportedPanels.dyn (Dynamo 1.3.0.875)

select_model_element = DSModelElementSelection()  # 1 picked in the model
byElement = Mullion.ByElement(select_model_element)
supportedPanels = Mullion.SupportedPanels(byElement)
