# Dynamo graph LocationCurve.dyn (Dynamo 1.3.0.875)

select_model_element = DSModelElementSelection()  # 1 picked in the model
byElement = CurtainPanel.ByElement(select_model_element)
supportingMullions = CurtainPanel.SupportingMullions(byElement)
locationCurve = Mullion.LocationCurve(supportingMullions)
