# Dynamo graph SetValue.dyn (Dynamo 1.3.0.875)

family_types = FamilyTypes("System Panel:Glazed")
code_block = CodeBlock { "Thickness"; }
parameterByName = Parameter.ParameterByName(element=family_types, name=code_block)
code_block_2 = CodeBlock { 30; }
setValue = Parameter.SetValue(parameterByName, code_block_2)
