# Dynamo graph IsShared.dyn (Dynamo 1.3.0.875)

family_types = FamilyTypes("M_Pile-Steel Pipe:600mm Diameter")
all_elements_of_family_type = ElementsOfFamilyType(family_types)
code_block = CodeBlock { "Type"; }
parameterByName = Parameter.ParameterByName(element=all_elements_of_family_type, name=code_block)
isShared = Parameter.IsShared(parameterByName)
