# Dynamo graph ParameterType.dyn (Dynamo 1.3.0.875)

family_types = FamilyTypes("System Panel:Glazed")
parameters = Element.Parameters(family_types)
parameterType = Parameter.ParameterType(parameters)
