# Dynamo graph ByLine.dyn (Dynamo 1.3.0.875)

code_block = CodeBlock { a=Point.ByCoordinates(40,-100,0); b=Point.ByCoordinates(-20,100,0); Line.ByStartPointEndPoint(a,b); }
byLine = ReferencePlane.ByLine(code_block.out2)
