# Dynamo graph ElementPlaneReference.dyn (Dynamo 1.3.0.875)

code_block = CodeBlock { a=Point.ByCoordinates(40,-100,0); b=Point.ByCoordinates(-20,100,0); }
byStartPointEndPoint = ReferencePlane.ByStartPointEndPoint(code_block.a, code_block.b)
elementPlaneReference = ReferencePlane.ElementPlaneReference(byStartPointEndPoint)
