# Dynamo graph ByLengthOnCurveReference.dyn (Dynamo 1.3.0.875)

code_block = CodeBlock()
# ---------- code_block.designscript (6 lines) ----------
a = ReferencePoint.ByCoordinates(0, 0, 0);
b = ReferencePoint.ByCoordinates(20, 20, 0);
c = ReferencePoint.ByCoordinates(0, 40, 0);
pts = {a, b, c};
curve = CurveByPoints.ByReferencePoints(pts, false);
Element.Geometry(curve);
# ----------------------------------------
number_slider = DoubleSlider(0.7, range=0..1 step 0.1)
segmentLengthAtParameter = Curve.SegmentLengthAtParameter(code_block.out5, number_slider)
byLengthOnCurveReference = ReferencePoint.ByLengthOnCurveReference(code_block.curve, segmentLengthAtParameter)
