# Dynamo graph ByParametersOnFaceReference.dyn (Dynamo 1.3.0.875)

code_block = CodeBlock()
# ---------- code_block.designscript (5 lines) ----------
a = ReferencePoint.ByCoordinates(0, 0, 0);
b = ReferencePoint.ByCoordinates(20, 20, 0);
c = ReferencePoint.ByCoordinates(0, 40, 0);
pts = {a, b, c};
curve = CurveByPoints.ByReferencePoints(pts, false);
# ----------------------------------------
number_slider = DoubleSlider(0.8, range=0..1 step 0.1)
byParameterOnCurveReference = ReferencePoint.ByParameterOnCurveReference(code_block.curve, number_slider)
