# Dynamo graph ByPointVectorDistance.dyn (Dynamo 1.3.0.875)

origin = Point.Origin()
code_block = CodeBlock { Vector.ByCoordinates(2,2,0); }
number_slider = DoubleSlider(6.4, range=0..100 step 0.1)
byPointVectorDistance = ReferencePoint.ByPointVectorDistance(origin, code_block, number_slider)
