# Dynamo graph Point.dyn (Dynamo 1.3.0.875)

code_block = CodeBlock { -10..10..#5; }
byCoordinates = ReferencePoint.ByCoordinates(x=code_block, y=code_block, lacing=CrossProduct)
point = ReferencePoint.Point(byCoordinates)
