# Dynamo graph X.dyn (Dynamo 1.3.0.875)

code_block = CodeBlock { -100..100..#5; }
byCoordinates = ReferencePoint.ByCoordinates(x=code_block, y=code_block, lacing=CrossProduct)
X = ReferencePoint.X(byCoordinates)
