# Dynamo graph XZPlane.dyn (Dynamo 1.3.0.875)

code_block = CodeBlock { 10; 40; 35; }
byCoordinates = ReferencePoint.ByCoordinates(x=code_block.out0, y=code_block.out1, z=code_block.out2)
XZPlane = ReferencePoint.XZPlane(byCoordinates)
