# Dynamo graph Select Revision Number Type.dyn (Dynamo 1.3.0.875)

select_revision_number_type = RevisionNumberType("Alphanumeric")
watch = Watch(select_revision_number_type)
select_revision_number_type_2 = RevisionNumberType("Numeric")
watch_2 = Watch(select_revision_number_type_2)
select_revision_number_type_3 = RevisionNumberType("None")
watch_3 = Watch(select_revision_number_type_3)
