# Dynamo graph Select Revision Numbering.dyn (Dynamo 1.3.0.875)

select_revision_numbering = RevisionNumbering("PerProject")
watch = Watch(select_revision_numbering)
select_revision_numbering_2 = RevisionNumbering("PerSheet")
watch_2 = Watch(select_revision_numbering_2)
