# Dynamo graph Select Revision Visibility.dyn (Dynamo 1.3.0.875)

select_revision_visibility = RevisionVisibility("CloudAndTagVisible")
watch = Watch(select_revision_visibility)
select_revision_visibility_2 = RevisionVisibility("Hidden")
watch_2 = Watch(select_revision_visibility_2)
select_revision_visibility_3 = RevisionVisibility("TagVisible")
watch_3 = Watch(select_revision_visibility_3)
