# Dynamo graph SetIssued.dyn (Dynamo 1.3.0.875)

select_revision = RevitRevisions("Seq. 1 (Issued) - Revision 1")
issued = Revision.Issued(select_revision)
boolean = BoolSelector(true)
setIssued = Revision.SetIssued(select_revision, boolean)
