# Dynamo graph SetIssuedBy.dyn (Dynamo 1.3.0.875)

select_revision = RevitRevisions("Seq. 1 - Revision 1")
issuedBy = Revision.IssuedBy(select_revision)
code_block = CodeBlock { "Studio X"; }
setIssuedBy = Revision.SetIssuedBy(select_revision, code_block)
