# Dynamo graph SetIssuedTo.dyn (Dynamo 1.3.0.875)

select_revision = RevitRevisions("Seq. 1 - Revision 1")
issuedTo = Revision.IssuedTo(select_revision)
code_block = CodeBlock { "Department of Buildings"; }
setIssuedTo = Revision.SetIssuedTo(select_revision, code_block)
