# Dynamo graph SetRevisionDate.dyn (Dynamo 1.3.0.875)

select_revision = RevitRevisions("Seq. 1 - Revision 1")
revisionDate = Revision.RevisionDate(select_revision)
code_block = CodeBlock { "04/01/2017"; }
setRevisionDate = Revision.SetRevisionDate(select_revision, code_block)
