# Dynamo graph ByName.dyn (Dynamo 1.3.0.875)

code_block = CodeBlock { "90% CD Set"; "03/07/2017"; "Updated consultant backgrounds"; }
boolean = BoolSelector(false)
code_block_2 = CodeBlock { "Studio X"; "Client"; }
select_revision_visibility = RevisionVisibility("TagVisible")
select_revision_number_type = RevisionNumberType("Numeric")
byName = Revision.ByName(code_block.out0, code_block.out1, code_block.out2, boolean, code_block_2.out0, code_block_2.out1, select_revision_visibility, select_revision_number_type)
