# Dynamo graph Revision.dyn (Dynamo 1.3.0.875)

views = Views("Level 1")
number_slider = DoubleSlider(62.3, range=1..100 step 0.1)
number_slider_2 = DoubleSlider(36.6, range=1..100 step 0.1)
byWidthLength = Rectangle.ByWidthLength(width=number_slider, length=number_slider_2)
explode = Geometry.Explode(byWidthLength)
reverse = Curve.Reverse(explode)
select_revision = RevitRevisions("Seq. 1 - Revision 1")
byCurve = RevisionCloud.ByCurve(views, reverse, select_revision)
revision = RevisionCloud.Revision(byCurve)
