# Dynamo graph ByOutlineExtrusionTypeAndLevel.dyn (Dynamo 1.3.0.875)

code_block = CodeBlock { 2000; }
byWidthLength = Rectangle.ByWidthLength(width=code_block, length=code_block)
code_block_2 = CodeBlock { 500; }
boolean = BoolSelector(false)
fillet = PolyCurve.Fillet(byWidthLength, code_block_2, boolean)
code_block_3 = CodeBlock { "Roof 1"; }
byName = RoofType.ByName(code_block_3)
levels = Levels("Level 1")
byOutlineTypeAndLevel = Roof.ByOutlineTypeAndLevel(outline=fillet, roofType=byName, level=levels)
code_block_4 = CodeBlock { Vector.ByCoordinates(0,0,1); }
byOriginNormal = Plane.ByOriginNormal(normal=code_block_4)
code_block_5 = CodeBlock { 0.00; 50.00; }
byOutlineExtrusionTypeAndLevel = Roof.ByOutlineExtrusionTypeAndLevel(fillet, byName, levels, byOriginNormal, code_block_5.out0, code_block_5.out1)
