# Dynamo graph ByOutlineTypeAndLevel.dyn (Dynamo 1.3.0.875)

code_block = CodeBlock { 2000; }
byWidthLength = Rectangle.ByWidthLength(width=code_block, length=code_block)
code_block_2 = CodeBlock { 500; }
boolean = BoolSelector(false)
fillet = PolyCurve.Fillet(byWidthLength, code_block_2, boolean)
code_block_3 = CodeBlock { "Roof 1"; }
byName = RoofType.ByName(code_block_3)
levels = Levels("Level 1")
byOutlineTypeAndLevel = Roof.ByOutlineTypeAndLevel(outline=fillet, roofType=byName, level=levels)
