# Dynamo graph IsInsideRoom.dyn (Dynamo 1.2.1.3083)

categories = Categories("Rooms")
all_elements_of_category = ElementsOfCategory(categories)
integer_slider = IntegerSlider(7, range=0..13 step 1)
getItemAtIndex = List.GetItemAtIndex(list=all_elements_of_category, index=integer_slider)
family_types = FamilyTypes("Dining Chair (3):Dining Chair (3)")
byFamilyType = FamilyInstance.ByFamilyType(family_types)
location = FamilyInstance.Location(byFamilyType)
isInsideRoom = Room.IsInsideRoom(getItemAtIndex, location)
