# Dynamo graph SetNumber.dyn (Dynamo 1.2.1.3083)

categories = Categories("Rooms")
all_elements_of_category = ElementsOfCategory(categories)
integer_slider = IntegerSlider(10, range=0..13 step 1)
getItemAtIndex = List.GetItemAtIndex(list=all_elements_of_category, index=integer_slider)
code_block = CodeBlock { "Stair"; }
setName = Room.SetName(getItemAtIndex, code_block)
name = Room.Name(getItemAtIndex)
