# Dynamo graph ByLocation.dyn (Dynamo 1.2.1.3083)

levels = Levels("Foundation")
select_point_on_face = DSPointOnElementSelection()  # 1 picked in the model
code_block = CodeBlock { "Exterior Mechanical Area"; }
code_block_2 = CodeBlock { "001"; }
byLocation = Room.ByLocation(levels, select_point_on_face, code_block, code_block_2)
