# Dynamo graph CenterBoundary.dyn (Dynamo 1.2.1.3083)

categories = Categories("Rooms")
all_elements_of_category = ElementsOfCategory(categories)
centerBoundary = Room.CenterBoundary(all_elements_of_category)
