# Dynamo graph CoreBoundary.dyn (Dynamo 1.2.1.3083)

categories = Categories("Rooms")
all_elements_of_category = ElementsOfCategory(categories)
coreBoundary = Room.CoreBoundary(all_elements_of_category)
