# Dynamo graph CoreCenterBoundary.dyn (Dynamo 1.2.1.3083)

categories = Categories("Rooms")
all_elements_of_category = ElementsOfCategory(categories)
coreCenterBoundary = Room.CoreCenterBoundary(all_elements_of_category)
