# Dynamo graph FinishBoundary.dyn (Dynamo 1.2.1.3083)

categories = Categories("Rooms")
all_elements_of_category = ElementsOfCategory(categories)
finishBoundary = Room.FinishBoundary(all_elements_of_category)
