# Dynamo graph ElementPlaneReference.dyn (Dynamo 1.3.0.875)

code_block = CodeBlock { Vector.ByCoordinates(1,1,1); }
byOriginNormal = Plane.ByOriginNormal(normal=code_block)
byPlane = SketchPlane.ByPlane(byOriginNormal)
elementPlaneReference = SketchPlane.ElementPlaneReference(byPlane)
