# Dynamo graph BeamByCurve.dyn (Dynamo 1.3.0.875)

select_edge = DSEdgeSelection()  # 1 picked in the model
number_slider = DoubleSlider(865, range=0..3000 step 0.1)
code_block = CodeBlock(x=number_slider) { x*-1; }
offset = Curve.Offset(curve=select_edge, distance=code_block)
levels = Levels("Level 2")
structural_framing_types = StructuralFramingTypes("356mm")
beamByCurve = StructuralFraming.BeamByCurve(curve=offset, level=levels, structuralFramingType=structural_framing_types)
