# Dynamo graph BraceByCurve.dyn (Dynamo 1.3.0.875)

select_model_element = DSModelElementSelection()  # 1 picked in the model
location = StructuralFraming.Location(select_model_element)
number_slider = DoubleSlider(6, range=1..10 step 1)
code_block = CodeBlock(divs=number_slider) { 0..1..#divs; }
select_model_element_2 = DSModelElementSelection()  # 1 picked in the model
location_2 = StructuralFraming.Location(select_model_element_2)
code_block_2 = CodeBlock(curve1=location, t1=code_block, curve2=location_2)
# ---------- code_block_2.designscript (11 lines) ----------
point1 = curve1.PointAtParameter(t1);
t2 = List.ShiftIndices(point1, 1);
t3 = List.DropItems(t2, 1);
point2 = curve2.PointAtParameter(t1);
t4 = List.DropItems(point2, 1);
line1 = Line.ByStartPointEndPoint(t3, t4);
t5 = List.ShiftIndices(point1, -1);
t6 = List.DropItems(t5, -1);
t7 = List.DropItems(point2, -1);
line2 = Line.ByStartPointEndPoint(t6, t7);
t8 = {line1, line2};
# ----------------------------------------
levels = Levels("Level 1")
structural_framing_types = StructuralFramingTypes("30mm")
braceByCurve = StructuralFraming.BraceByCurve(code_block_2.t8, levels, structural_framing_types)
