# Dynamo graph ColumnByCurve.dyn (Dynamo 1.3.0.875)

select_model_element = DSModelElementSelection()  # 1 picked in the model
location = StructuralFraming.Location(select_model_element)
code_block = CodeBlock { 0.22; }
pointAtParameter = Curve.PointAtParameter(curve=location, param=code_block)
number_slider = DoubleSlider(575.8, range=0..1000 step 0.1)
code_block_2 = CodeBlock { 1000; -3000; }
translate = Geometry.Translate(geometry=pointAtParameter, xTranslation=number_slider, zTranslation=code_block_2.out1)
byStartPointEndPoint = Line.ByStartPointEndPoint(startPoint=translate, endPoint=pointAtParameter)
levels = Levels("Level 1")
structural_column_types = StructuralColumnTypes("200UB25.4")
columnByCurve = StructuralFraming.ColumnByCurve(curve=byStartPointEndPoint, level=levels, structuralColumnType=structural_column_types)
