# Dynamo graph Location.dyn (Dynamo 1.3.0.875)

family_types = FamilyTypes("M_TJL Wood Open Web Joist:356mm")
all_elements_of_family_type = ElementsOfFamilyType(family_types)
location = StructuralFraming.Location(all_elements_of_family_type)
