# Dynamo graph ByElementAndLocation.dyn (Dynamo 1.3.0.875)

code_block = CodeBlock { "Right"; "Center"; }
views = Views("Level 1")
family_types = FamilyTypes("Single-Flush:800 x 2100")
all_elements_of_family_type = ElementsOfFamilyType(family_types)
getLocation = Element.GetLocation(all_elements_of_family_type)
number_slider = DoubleSlider(1113.9, range=-4000..4000 step 0.1)
translate = Geometry.Translate(geometry=getLocation, xTranslation=number_slider)
boolean = BoolSelector(true)
boolean_2 = BoolSelector(false)
byElementAndLocation = Tag.ByElementAndLocation(view=views, element=all_elements_of_family_type, location=translate, horizontal=boolean, addLeader=boolean_2)
