# Dynamo graph ByElementAndOffset.dyn (Dynamo 1.3.0.875)

views = Views("Level 1")
categories = Categories("Doors")
all_elements_of_category = ElementsOfCategory(categories)
code_block = CodeBlock { Vector.ByCoordinates(0,1000,0); }
code_block_2 = CodeBlock { "Right"; "Center"; }
boolean = BoolSelector(true)
boolean_2 = BoolSelector(false)
byElementAndOffset = Tag.ByElementAndOffset(views, all_elements_of_category, code_block, code_block_2.out0, code_block_2.out1, boolean, boolean_2)
