# Dynamo graph TaggedElement.dyn (Dynamo 1.3.0.875)

views = Views("Level 1")
categories = Categories("Doors")
all_elements_of_category = ElementsOfCategory(categories)
boolean = BoolSelector(true)
boolean_2 = BoolSelector(false)
code_block = CodeBlock { "Right"; "Center"; }
byElement = Tag.ByElement(views, all_elements_of_category, boolean, boolean_2, code_block.out0, code_block.out1)
taggedElement = Tag.TaggedElement(byElement)
