# Dynamo graph SetHorizontalAlignment.dyn (Dynamo 1.3.0.875)

element_types = ElementTypes("TextNote")
all_elements_of_type = ElementsOfType(element_types)
code_block = CodeBlock { "Right"; }
setHorizontalAlignment = TextNote.SetHorizontalAlignment(all_elements_of_type, code_block)
