# Dynamo graph SetKeepRotatedTextReadable.dyn (Dynamo 1.3.0.875)

element_types = ElementTypes("TextNote")
all_elements_of_type = ElementsOfType(element_types)
boolean = BoolSelector(true)
setKeepRotatedTextReadable = TextNote.SetKeepRotatedTextReadable(all_elements_of_type, boolean)
