# Dynamo graph SetText.dyn (Dynamo 1.3.0.875)

element_types = ElementTypes("TextNote")
all_elements_of_type = ElementsOfType(element_types)
code_block = CodeBlock { "text note override"; }
setText = TextNote.SetText(all_elements_of_type, code_block)
