# Dynamo graph ByLocation.dyn (Dynamo 1.3.0.875)

views = Views("Level 1")
categories = Categories("StructuralColumns")
all_elements_of_category = ElementsOfCategory(categories)
getLocation = Element.GetLocation(all_elements_of_category)
code_block = CodeBlock { "Structural Columns"; }
code_block_2 = CodeBlock { "Center"; }
byLocation = TextNote.ByLocation(view=views, location=getLocation, text=code_block, alignment=code_block_2)
