# Dynamo graph HorizontalAlignment.dyn (Dynamo 1.3.0.875)

element_types = ElementTypes("TextNote")
all_elements_of_type = ElementsOfType(element_types)
horizontalAlignment = TextNote.HorizontalAlignment(all_elements_of_type)
