# Dynamo graph VerticalAlignment.dyn (Dynamo 1.3.0.875)

element_types = ElementTypes("TextNote")
all_elements_of_type = ElementsOfType(element_types)
verticalAlignment = TextNote.VerticalAlignment(all_elements_of_type)
