# Dynamo graph ByPoints.dyn (Dynamo 1.3.0.875)

code_block = CodeBlock { 0..1000..#10; }
byCoordinates = Point.ByCoordinates(x=code_block, y=code_block, lacing=CrossProduct)
flatten = Flatten(byCoordinates)
code_block_2 = CodeBlock { 0..100..#100; }
shuffle = List.Shuffle(code_block_2)
translate = Geometry.Translate(geometry=flatten, zTranslation=shuffle)
byPoints = Topography.ByPoints(translate)
