# Dynamo graph ByCurveAndHeight.dyn (Dynamo 1.3.0.875)

number_slider = DoubleSlider(4570.2, range=1000..5000 step 0.1)
integer_slider = IntegerSlider(5, range=1..10 step 1)
code_block = CodeBlock(spacing=number_slider, count=integer_slider) { 0..spacing..#count; }
byCoordinates = Point.ByCoordinates(x=code_block)
number_slider_2 = DoubleSlider(2000, range=500..2000 step 0.1)
byCoordinates_2 = Point.ByCoordinates(x=code_block, y=number_slider_2)
byStartPointEndPoint = Line.ByStartPointEndPoint(startPoint=byCoordinates, endPoint=byCoordinates_2)
number_slider_3 = DoubleSlider(2608.6, range=0..4000 step 0.1)
levels = Levels("Level 1")
wall_types = WallTypes("Interior - Partition")
byCurveAndHeight = Wall.ByCurveAndHeight(curve=byStartPointEndPoint, height=number_slider_3, level=levels, wallType=wall_types)
