# Dynamo graph Detail Level.dyn (Dynamo 1.3.0.875)

code_block = CodeBlock { Color.ByARGB(255,255,0,0); }
fill_patterns = FillPatterns("Solid fill")
byProperties = Revit.Filter.OverrideGraphicSettings.ByProperties(code_block, arg4=fill_patterns)
