# Dynamo graph ByOriginDirection.dyn (Dynamo 1.3.0.875)

basePoint = Coordinates.BasePoint()
code_block = CodeBlock { 2000; }
number_slider = DoubleSlider(1433.6, range=0..10000 step 0.1)
translate = Geometry.Translate(geometry=basePoint, yTranslation=code_block, zTranslation=number_slider)
XAxis = Vector.XAxis()
integer_slider = IntegerSlider(6, range=1..10 step 1)
views = Views("{3D}")
byOriginDirection = Revit.References.RayBounce.ByOriginDirection(translate, XAxis, integer_slider, views)
watch = Watch(byOriginDirection.out0)
watch_2 = Watch(byOriginDirection.out1)
