# Dynamo graph ByProperties.dyn (Dynamo 1.3.0.875)

export_column_headers = ExportColumnHeaders("MultipleRows")
code_block = CodeBlock { ","; }
boolean = BoolSelector(true)
export_text_qualifier = ExportTextQualifier("DoubleQuote")
boolean_2 = BoolSelector(false)
byProperties = Revit.Schedules.ScheduleExportOptions.ByProperties(export_column_headers, code_block, boolean, export_text_qualifier, boolean_2)
