# Dynamo graph All Elements of Category.dyn (Dynamo 1.3.0.875)

categories = Categories("StructuralColumns")
all_elements_of_category = ElementsOfCategory(categories)
watch = Watch(all_elements_of_category)
