# Dynamo graph All Elements of Family Type.dyn (Dynamo 1.3.0.875)

family_types = FamilyTypes("M_Pile Cap-600 Pile:600 x 600 x 900mm")
all_elements_of_family_type = ElementsOfFamilyType(family_types)
watch = Watch(all_elements_of_family_type)
