# Dynamo graph Get Family Parameter.dyn (Dynamo 1.3.0.875)

family_types = FamilyTypes("Curtain Wall Dbl Glass:Curtain Wall Dbl Glass")
get_family_parameter = FamilyInstanceParameters("Offset(Type)(double)", family_types)
watch = Watch(get_family_parameter)
