# Dynamo graph Select Divided Surface Families.dyn (Dynamo 1.3.0.875)

family_types = FamilyTypes("M_Pile Cap-600 Pile:600 x 600 x 900mm")
get_family_parameter = FamilyInstanceParameters("Length(Type)(double)", family_types)
select_divided_surface_families = DSDividedSurfaceFamiliesSelection()
