# Dynamo graph ExportAsImage.dyn (Dynamo 1.3.0.875)

current = Document.Current()
activeView = Document.ActiveView(current)
file_path = Filename("..\..\..\..\..\REFERENCE\Solar Analysis.jpg")
exportAsImage = View.ExportAsImage(activeView, file_path)
