# Dynamo graph SetCategoryOverrides.dyn (Dynamo 1.3.0.875)

views = Views("Level 2")
views_2 = Views("Level 1")
create = List.Create(views, views_2)
categories = Categories("Walls")
code_block = CodeBlock { Color.ByARGB(255,255,0,0); }
fill_patterns = FillPatterns("Solid fill")
byProperties = Revit.Filter.OverrideGraphicSettings.ByProperties(code_block, arg4=fill_patterns)
boolean = BoolSelector(false)
setCategoryOverrides = View.SetCategoryOverrides(create, categories, byProperties, boolean)
