# Dynamo graph SetFilterOverrides.dyn (Dynamo 1.3.0.875)

views = Views("Typ. Wall Section")
views_2 = Views("Main Stair Detail")
views_3 = Views("Level 1")
create = List.Create(views, views_2, views_3)
element_types = ElementTypes("ParameterFilterElement")
all_elements_of_type = ElementsOfType(element_types)
code_block = CodeBlock { 0; }
getItemAtIndex = List.GetItemAtIndex(list=all_elements_of_type, index=code_block)
views_4 = Views("Level 2")
filterOverrides = View.FilterOverrides(views_4, getItemAtIndex)
boolean = BoolSelector(true)
setFilterOverrides = View.SetFilterOverrides(view=create, parameterFilter=getItemAtIndex, overrides=filterOverrides, hide=boolean)
