# Dynamo graph ByEyePointAndTarget.dyn (Dynamo 1.2.1.3083)

basePoint = Coordinates.BasePoint()
ZAxis = Vector.ZAxis()
number_slider = DoubleSlider(6532.8, range=0..20000 step 0.1)
translate = Geometry.Translate(geometry=basePoint, direction=ZAxis, distance=number_slider)
code_block = CodeBlock { 15000; }
byCenterPointRadius = Circle.ByCenterPointRadius(centerPoint=translate, radius=code_block)
number_slider_2 = DoubleSlider(0.64, range=0..1 step 0.001)
pointAtParameter = Curve.PointAtParameter(curve=byCenterPointRadius, param=number_slider_2)
code_block_2 = CodeBlock { "Base Point View"; }
byEyePointAndTarget = AxonometricView.ByEyePointAndTarget(pointAtParameter, basePoint, code_block_2)
