# Dynamo graph ByEyePointTargetAndElement.dyn (Dynamo 1.2.1.3083)

basePoint = Coordinates.BasePoint()
ZAxis = Vector.ZAxis()
number_slider = DoubleSlider(9727, range=0..20000 step 0.1)
translate = Geometry.Translate(geometry=basePoint, direction=ZAxis, distance=number_slider)
code_block = CodeBlock { 15000; }
byCenterPointRadius = Circle.ByCenterPointRadius(centerPoint=translate, radius=code_block)
number_slider_2 = DoubleSlider(0.648, range=0..1 step 0.001)
pointAtParameter = Curve.PointAtParameter(curve=byCenterPointRadius, param=number_slider_2)
code_block_2 = CodeBlock { "Base Point View"; }
select_model_element = DSModelElementSelection()  # 1 picked in the model
boolean = BoolSelector(true)
byEyePointTargetAndElement = AxonometricView.ByEyePointTargetAndElement(pointAtParameter, basePoint, code_block_2, select_model_element, boolean)
