# Dynamo graph ByEyePointAndTarget.dyn (Dynamo 1.2.1.3083)

select_point_on_face = DSPointOnElementSelection()  # 1 picked in the model
code_block = CodeBlock { 15000; }
byCenterPointRadius = Circle.ByCenterPointRadius(centerPoint=select_point_on_face, radius=code_block)
number_slider = DoubleSlider(0.555, range=0.5..0.85 step 0.001)
pointAtParameter = Curve.PointAtParameter(curve=byCenterPointRadius, param=number_slider)
select_model_element = DSModelElementSelection()  # 1 picked in the model
code_block_2 = CodeBlock { "Dynamo Perspective View"; }
boolean = BoolSelector(false)
byEyePointAndTarget = PerspectiveView.ByEyePointAndTarget(pointAtParameter, select_point_on_face, select_model_element, code_block_2, boolean)
