# Dynamo graph ByEyePointTargetAndBoundingBox.dyn (Dynamo 1.2.1.3083)

code_block = CodeBlock { Point.ByCoordinates(-1476,-3246,1665); }
code_block_2 = CodeBlock { 15000; }
byCenterPointRadius = Circle.ByCenterPointRadius(centerPoint=code_block, radius=code_block_2)
number_slider = DoubleSlider(0.533, range=0.5..0.85 step 0.001)
pointAtParameter = Curve.PointAtParameter(curve=byCenterPointRadius, param=number_slider)
select_model_element = DSModelElementSelection()  # 1 picked in the model
boundingBox = Geometry.BoundingBox(select_model_element)
code_block_3 = CodeBlock { "Dynamo Perspective View"; }
boolean = BoolSelector(true)
byEyePointTargetAndBoundingBox = PerspectiveView.ByEyePointTargetAndBoundingBox(pointAtParameter, code_block, boundingBox, code_block_3, boolean)
