# Dynamo graph AddFields.dyn (Dynamo 1.3.0.875)

categories = Categories("Windows")
code_block = CodeBlock { "Window Type Schedule"; }
schedule_type = ScheduleTypes("RegularSchedule")
createSchedule = ScheduleView.CreateSchedule(category=categories, name=code_block, scheduleType=schedule_type)
views = Views("Window Type Schedule")
schedulableFields = ScheduleView.SchedulableFields(views)
code_block_2 = CodeBlock { 0; 2; 11; 18; 26; }
create = List.Create(code_block_2.out0, code_block_2.out1, code_block_2.out2, code_block_2.out3, code_block_2.out4)
getItemAtIndex = List.GetItemAtIndex(list=schedulableFields, index=create)
addFields = ScheduleView.AddFields(scheduleView=createSchedule, fields=getItemAtIndex)
