# Dynamo graph AddFilters.dyn (Dynamo 1.3.0.875)

views = Views("How do I")
fields = ScheduleView.Fields(views)
code_block = CodeBlock { 1; }
getItemAtIndex = List.GetItemAtIndex(list=fields, index=code_block)
schedule_filter_type = ScheduleFilterType("Equal")
code_block_2 = CodeBlock { "01 - Basic"; }
byFieldTypeAndValue = Revit.Schedules.ScheduleFilter.ByFieldTypeAndValue(field=getItemAtIndex, filterType=schedule_filter_type, value=code_block_2)
addFilters = ScheduleView.AddFilters(scheduleView=views, scheduleFilters=byFieldTypeAndValue)
