# Dynamo graph Export Column Headers.dyn (Dynamo 1.3.0.875)

views = Views("How do I")
file_path = Filename("..\..\..\..\..\..\REFERENCE\How do I.csv")
export_column_headers = ExportColumnHeaders("None")
byProperties = Revit.Schedules.ScheduleExportOptions.ByProperties(export_column_headers)
export = ScheduleView.Export(views, file_path, byProperties)
