# Dynamo graph Export Text Qualifier.dyn (Dynamo 1.3.0.875)

views = Views("How do I")
file_path = Filename("..\..\..\..\..\..\REFERENCE\How do I.csv")
export_text_qualifier = ExportTextQualifier("Quote")
byProperties = Revit.Schedules.ScheduleExportOptions.ByProperties(arg3=export_text_qualifier)
export = ScheduleView.Export(views, file_path, byProperties)
