# Dynamo graph Export.dyn (Dynamo 1.3.0.875)

views = Views("How do I")
file_path = Filename("..\..\..\..\..\..\REFERENCE\How do I.csv")
byProperties = Revit.Schedules.ScheduleExportOptions.ByProperties()
export = ScheduleView.Export(views, file_path, byProperties)
