# Dynamo graph RemoveFields.dyn (Dynamo 1.3.0.875)

views = Views("How do I")
fields = ScheduleView.Fields(views)
code_block = CodeBlock { 3; }
getItemAtIndex = List.GetItemAtIndex(list=fields, index=code_block)
removeFields = ScheduleView.RemoveFields(views, getItemAtIndex)
