# Dynamo graph CreateSchedule.dyn (Dynamo 1.3.0.875)

categories = Categories("Walls")
code_block = CodeBlock { "Wall Type Schedule"; }
schedule_type = ScheduleTypes("RegularSchedule")
createSchedule = ScheduleView.CreateSchedule(category=categories, name=code_block, scheduleType=schedule_type)
