# Dynamo graph ByBoundingBox.dyn (Dynamo 1.2.1.3083)

select_model_element = DSModelElementSelection()  # 1 picked in the model
boundingBox = Geometry.BoundingBox(select_model_element)
byBoundingBox = SectionView.ByBoundingBox(boundingBox)
