# Dynamo graph ByCoordinateSystemMinPointMaxPoint.dyn (Dynamo 1.2.1.3083)

identity = CoordinateSystem.Identity()
select_model_element = DSModelElementSelection()  # 1 picked in the model
code_block = CodeBlock(t1=select_model_element) { boundingBox1 = t1.BoundingBox; point1 = boundingBox1.MinPoint; point2 = boundingBox1.MaxPoint; }
byCoordinateSystemMinPointMaxPoint = SectionView.ByCoordinateSystemMinPointMaxPoint(identity, code_block.point1, code_block.point2)
