# Dynamo graph ByNameNumberTitleBlockAndView.dyn (Dynamo 1.2.1.3083)

# group: Open with Revit file: rac_basic_sample_project.rvt
# note: The Revit sample file can be found in Revit's installation directory, typically located in:
# C:\Program Files\Autodesk\Revit 2017\Samples

code_block = CodeBlock { "North Elevation"; }
code_block_2 = CodeBlock { "A200"; }
family_types = FamilyTypes("A1 metric:A1 metric")
categories = Categories("Views")
all_elements_of_category = ElementsOfCategory(categories)
code_block_3 = CodeBlock { 1; }
getItemAtIndex = List.GetItemAtIndex(list=all_elements_of_category, index=code_block_3)
byNameNumberTitleBlockAndView = Sheet.ByNameNumberTitleBlockAndView(sheetName=code_block, sheetNumber=code_block_2, titleBlockFamilyType=family_types, view=getItemAtIndex)
