# Dynamo graph ByNameNumberTitleBlockAndViews.dyn (Dynamo 1.3.0.875)

code_block = CodeBlock { "Renderings"; }
code_block_2 = CodeBlock { "A500"; }
family_types = FamilyTypes("A1 metric:A1 metric")
views = Views("From Yard")
views_2 = Views("Living Room")
views_3 = Views("Kitchen")
create = List.Create(views, views_2, views_3)
byNameNumberTitleBlockAndViews = Sheet.ByNameNumberTitleBlockAndViews(code_block, code_block_2, family_types, create)
