# Dynamo graph FilterOverrides.dyn (Dynamo 1.3.0.875)

views = Views("Level 2")
element_types = ElementTypes("ParameterFilterElement")
all_elements_of_type = ElementsOfType(element_types)
code_block = CodeBlock { 0; }
getItemAtIndex = List.GetItemAtIndex(list=all_elements_of_type, index=code_block)
filterOverrides = View.FilterOverrides(views, getItemAtIndex)
