# Dynamo graph IsViewTemplate.dyn (Dynamo 1.3.0.875)

views = Views("Site Plan")
isViewTemplate = View.IsViewTemplate(views)
views_2 = Views("Level 2")
isViewTemplate_2 = View.IsViewTemplate(views_2)
