# Dynamo graph View3D.dyn (Dynamo 1.2.1.3083)

code_block = CodeBlock { "Dynamo 3D View"; }
createUniqueViewName = View3D.CreateUniqueViewName(code_block)
code_block_2 = CodeBlock { "Level 1"; }
createUniqueViewName_2 = View3D.CreateUniqueViewName(code_block_2)
code_block_3 = CodeBlock { "Section Perspective"; }
createUniqueViewName_3 = View3D.CreateUniqueViewName(code_block_3)
